# Dynamo graph CreateResx.dyn (Dynamo 3.0.4.7905)
# packages: Rhythm 2024.3.1

string = StringInput("D:\repos_john\RhythmForDynamo\!Documentation\NodeIcons")
string_2 = StringInput("D:\repos_john\RhythmForDynamo\src\RhythmRevit\RhythmRevitImages.resx")
ʳʰʸᵗʰᵐ_system = Rhythm.Helpers.System.CreateResxImageFile(imageDirectoryPath=string, resxFilePath=string_2)
