# Dynamo graph NodeIconCreator.dyn (Dynamo 1.3.3.4651)

# group: Inputs
beta = BoolSelector(false)
new_node_name = StringInput("Rhythm.About.About.AboutRhythm")

string = StringInput("D:\Source\Repos\rhythm_for_dynamo\Rhythm\Resources\[beta].Large.png")
string_2 = StringInput("D:\Source\Repos\rhythm_for_dynamo\Rhythm\Resources\[beta].Small.png")
create = List.Create(string, string_2)
string_3 = StringInput("D:\Source\Repos\rhythm_for_dynamo\Rhythm\Resources\[Replace].Large.png")
string_4 = StringInput("D:\Source\Repos\rhythm_for_dynamo\Rhythm\Resources\[Replace].Small.png")
create_2 = List.Create(string_3, string_4)
if_ = If(test=beta, true=create, false=create_2)
fromPath = FileObject(if_)  # "File.FromPath"
replacement_text = StringInput("[beta]")
replacement_text_2 = StringInput("[Replace]")
if_2 = If(test=beta, true=replacement_text, false=replacement_text_2)
replace = String.Replace(str=if_, searchFor=if_2, replaceWith=new_node_name)
code_block = CodeBlock { true; }
copy = File.Copy(fromPath, replace, code_block)
