# Dynamo graph NodeIconGenerator.dyn (Dynamo 3.0.4.7905)

file_path = Filename("NodeIcons\[replace].Large.png")  # graph input
fromPath = FileObject(path=file_path)  # "File.FromPath"
string = StringInput("D:\repos_john\RhythmForDynamo\!Documentation\NodeIcons\")  # graph input
file_path_2 = Filename("..\src\RhythmRevit\bin\Release R25\RhythmRevit.xml")  # graph input
fromPath_2 = FileObject(path=file_path_2)  # "File.FromPath"
readText = FileSystem.ReadText(file=fromPath_2)
string_2 = StringInput("<member name=\"M:")  # graph input
string_3 = StringInput("\">")  # graph input
split = String.Split(string=readText, separator0=string_2, separator1=string_3)
code_block = CodeBlock { "Rhythm.Revit"; }
startsWith = String.StartsWith(string=split, searchFor=code_block)
filterByBoolMask = List.FilterByBoolMask(list=split, mask=startsWith)
code_block_2 = CodeBlock { "("; }
split_2 = String.Split(string=filterByBoolMask.in, separator0=code_block_2)
firstItem = List.FirstItem(list=split_2@L2)
string_4 = StringInput(".Large.png")  # graph input
code_block_3 = CodeBlock(x=string, y=firstItem, z=string_4) { x+y+z; }
code_block_4 = CodeBlock { 1; }
copyFile = FileSystem.CopyFile(file=fromPath, destinationPath=code_block_3, overwrite=code_block_4)
