# Dynamo graph ElevationMarker.CreateElevationByMarkerIndex-Example.dyn (Dynamo 1.3.2.2480)

select_model_element = DSModelElementSelection()  # 1 picked in the model
getLocation = Element.GetLocation(select_model_element)
code_block = CodeBlock { 96; }
viewFamilyTypes = ViewFamilyTypes("Building Elevation")
createElevationMarker = RevitElements.ElevationMarker.CreateElevationMarker(getLocation, code_block, viewFamilyTypes)
activeView = Custom[Springs.Doc.ActiveView]()  # Selects the current document's active view. Supports more view types than the built-in option. Will be depreciated once the bult in node works with all plan types.
code_block_2 = CodeBlock { 0..3; }
createElevationByMarkerIndex = RevitElements.ElevationMarker.CreateElevationByMarkerIndex(createElevationMarker, activeView, code_block_2, lacing=Longest)
