# Dynamo graph Rhythm.Helpers.Helpers.Toggle.dyn "Helpers.Toggle-Example" (Dynamo 2.9.0.3137)

code_block = CodeBlock { 1; }
boolean = BoolSelector(true)
toggle = Rhythm.Helpers.Helpers.Toggle(obj=code_block, toggle=boolean)
