# Dynamo graph Rhythm.String.Modify.FormatWith.dyn "Modify.FormatWith-Example" (Dynamo 2.9.0.3137)

code_block = CodeBlock()
# ---------- code_block.designscript (2 lines) ----------
"Hello {0} from dynamo.
Today is {1}";
# ----------------------------------------
currentUserName = Rhythm.Helpers.System.CurrentUserName()
now = DateTime.Now()
list_create = List.Create(item0=currentUserName, item1=now)
formatWith = Rhythm.String.Modify.FormatWith(str=code_block, args=list_create)
watch = Watch(formatWith)
