# Dynamo graph Rhythm.String.Modify.ToQuantity.dyn "Modify.ToQuantity-Example" (Dynamo 2.9.0.3137)

code_block = CodeBlock { "today I was driving and saw {0}"; }
code_block_2 = CodeBlock { "ox"; 5; }
toQuantity = Rhythm.String.Modify.ToQuantity(str=code_block_2.out0, quantity=code_block_2.out1)
formatWith = Rhythm.String.Modify.FormatWith(str=code_block, args=toQuantity)
