# Dynamo graph Rhythm.Revit.Elements.Elements.GetParameterValueByNameTypeOrInstance.dyn "Elements.GetParameterValueByNameTypeOrInstance" (Dynamo 2.13.1.3887)
# packages: Rhythm 2022.3.3

select_model_element = DSModelElementSelection()  # 1 picked in the model
code_block = CodeBlock { "Type Mark"; }
ʳʰʸᵗʰᵐ_elements = Rhythm.Revit.Elements.Elements.GetParameterValueByNameTypeOrInstance(element=select_model_element, parameterName=code_block)
