# Dynamo custom node AdaptiveComponent.PlacementPoints.dyf (Dynamo 1.2.1.3083)
# category: Rhythm.Revit.Elements.AdaptiveComponent
# This node retrieves the adaptive components points.

AdaptiveComponent = Input()
code_block = CodeBlock(item=AdaptiveComponent) { Flatten({item}); }
python_script = Python(IN[0]=code_block)
# ---------- python_script.python (60 lines) ----------
#Copyright(c) 2017, john pierson
# @60secondrevit, http://sixtysecondrevit.com
import clr
clr.AddReference('ProtoGeometry')
from Autodesk.DesignScript.Geometry import *

# Import RevitAPI
clr.AddReference("RevitAPI")
import Autodesk
from Autodesk.Revit.DB import *
from Autodesk.Revit.DB.Analysis import *

# Import DocumentManager and TransactionManager
clr.AddReference("RevitServices")
import RevitServices
from RevitServices.Persistence import DocumentManager
from RevitServices.Transactions import TransactionManager

clr.AddReference("RevitNodes")
import Revit
clr.ImportExtensions(Revit.Elements)
clr.ImportExtensions(Revit.GeometryConversion)
doc = DocumentManager.Instance.CurrentDBDocument
uiapp = DocumentManager.Instance.CurrentUIApplication
app = uiapp.Application

#The inputs to this node will be stored as a list in the IN variable.
dataEnteringNode = IN
#Custom flatten definition to manage lists in here
def flatten(*args):
    for x in args:
        if hasattr(x, '__iter__'):
            for y in flatten(*x):
                yield y
        else:
            yield x

#unwrap all elements to use with API
items = UnwrapElement(IN[0])

#get the reference points
refPoints = list()
for i in items:
	try:
		refPoints.append(AdaptiveComponentInstanceUtils.GetInstancePlacementPointElementRefIds(i))
	except:
		refPoints.append(list())
		
refPointsFlat = flatten(refPoints)

#select the points to obtain the elements
refPointsEle = list()
for r in refPointsFlat:
	try:
		refPointsEle.append(doc.GetElement(r))
	except:
		refPointsEle.append(list())

#Assign your output to the OUT variable
OUT = refPointsEle
# ----------------------------------------
code_block_2 = CodeBlock { 4; }
chop = List.Chop(list=python_script, lengths=code_block_2)
point = ReferencePoint.Point(chop)
points = Output(point)
