# Dynamo custom node All Elements of Type in Document.dyf (Dynamo 1.2.1.3083)
# category: Rhythm.Revit.Selection
# All elements of given type in specified document. This works for unopened files and for linked documents.

document = Input()  # This allows you to specify a document to get element types from
code_block = CodeBlock(item=document) { Flatten({item}); }
element_type = Input()
python_script = Python(IN[0]=code_block, IN[1]=element_type)
# ---------- python_script.python (52 lines) ----------
#Copyright(c) 2017, john pierson
# @60secondrevit, http://sixtysecondrevit.com
#based on nodes from the great Dimitar Venkov and Andreas Dieckmann
import clr
clr.AddReference('ProtoGeometry')
from Autodesk.DesignScript.Geometry import *

# Import RevitAPI
clr.AddReference("RevitAPI")
import Autodesk
from Autodesk.Revit.DB import *
from Autodesk.Revit.DB.Analysis import *

# Import DocumentManager and TransactionManager
clr.AddReference("RevitServices")
import RevitServices
from RevitServices.Persistence import DocumentManager
from RevitServices.Transactions import TransactionManager

clr.AddReference("RevitNodes")
import Revit
clr.ImportExtensions(Revit.Elements)
clr.ImportExtensions(Revit.GeometryConversion)
#Custom flatten definition to manage lists in here
def flatten(*args):
    for x in args:
        if hasattr(x, '__iter__'):
            for y in flatten(*x):
                yield y
        else:
            yield x
#The inputs to this node will be stored as a list in the IN variable.
doc = IN[0]
dataEnteringNode = IN
typelist = list()
for d in doc:
	try:
		typelist.append(FilteredElementCollector(d).OfClass(IN[1]))
	except:
		typelist.append(list())

revitTypes = flatten(typelist)
newList = list()

for i in revitTypes:
	try:
		newList.append(i.ToDSType(True))
	except:
		newList.append(list())

#Assign your output to the OUT variable.
OUT = newList, typelist
# ----------------------------------------
code_block_2 = CodeBlock(input=python_script) { elements = input[0]; internal = input[1]; }
count = Count(code_block_2.internal, lacing=Longest)
chop = List.Chop(list=code_block_2.elements, lengths=count)
elements = Output(chop)
