# Dynamo custom node All Framing at Reference Level.dyf (Dynamo 1.3.2.2480)
# category: Rhythm.Revit.Selection.Selection.Actions
# Collects all of the structural framing at a specific reference level

categories = Categories("StructuralFraming")
all_elements_of_category = ElementsOfCategory(categories)
code_block = CodeBlock { "Reference Level"; }
getParameterValueByName = Element.GetParameterValueByName(element=all_elements_of_category, parameterName=code_block)
name = Element.Name(getParameterValueByName)
Level = Input()
code_block_2 = CodeBlock { true; }
contains = String.Contains(str=name, searchFor=Level, ignoreCase=code_block_2)
filterByBoolMask = List.FilterByBoolMask(list=all_elements_of_category, mask=contains)
code_block_3 = CodeBlock { "Name"; }
getParameterValueByName_2 = Element.GetParameterValueByName(element=Level, parameterName=code_block_3)
contains_2 = String.Contains(str=name, searchFor=getParameterValueByName_2, ignoreCase=code_block_2)
filterByBoolMask_2 = List.FilterByBoolMask(list=all_elements_of_category, mask=contains_2)
create = List.Create(filterByBoolMask.in, filterByBoolMask_2.in)
flatten = Flatten(create)
isNull = Object.IsNull()  # unwired: arg0
filter = List.Filter(flatten, isNull)
Framing_at_Reference_Level = Output(filter.out1)
