# Dynamo custom node All Upper.dyf (Dynamo 0.8.0.950)
# category: Rhythm.Tools
# This converts the ase of selected items to UPPER. Inputs require booleans to enable for category.

categories = Categories("TextNotes")
all_elements_of_category = ElementsOfCategory(categories)
ConvertText = Input(ConvertText : bool = false)
toggle = Custom[Rhythm.Toggle](list=all_elements_of_category, boolean=ConvertText)  # Toggle that ffers two outputs. Created for Dynamo 0.8.1 because of changes to the "IF" node
python_script = Python(IN[0]=toggle.in)
# ---------- python_script.python (49 lines) ----------
#DPS Text Uppercase Script
#Original Credit for python script goes to dwane@dsdraughting.com

import clr
clr.AddReference('ProtoGeometry')
from Autodesk.DesignScript.Geometry import *

# Import ToDSType(bool) extension method
clr.AddReference("RevitNodes")
import Revit
clr.ImportExtensions(Revit.Elements)

# Import DocumentManager and TransactionManager
clr.AddReference("RevitServices")
import RevitServices
from RevitServices.Persistence import DocumentManager
from RevitServices.Transactions import TransactionManager

from System.Collections.Generic import *

# Import RevitAPI
clr.AddReference("RevitAPI")
import Autodesk

doc = DocumentManager.Instance.CurrentDBDocument
uiapp = DocumentManager.Instance.CurrentUIApplication
app = uiapp.Application

#The inputs to this node will be stored as a list in the IN variable.
dataEnteringNode = IN

#unwrap all elements to use with API
elements = []
for i in IN[0]:
	elements.append(UnwrapElement(i))

# "Start" the transaction
TransactionManager.Instance.EnsureInTransaction(doc)

#apply color override to elements in an input list
for i in elements:
	id = i.Id
	i.Text=i.Text.upper()

# "End" the transaction
TransactionManager.Instance.TransactionTaskDone()

#Assign your output to the OUT variable
OUT = IN[0]
# ----------------------------------------
categories_2 = Categories("Rooms")
all_elements_of_category_2 = ElementsOfCategory(categories_2)
code_block = CodeBlock { "Name"; }
getParameterValueByName = Element.GetParameterValueByName(element=all_elements_of_category_2, parameterName=code_block)
toUpper = String.ToUpper(getParameterValueByName)
ConvertRooms = Input(ConvertRooms : bool = false)
toggle_2 = Custom[Rhythm.Toggle](list=toUpper, boolean=ConvertRooms)
setParameterByName = Element.SetParameterByName(element=all_elements_of_category_2, parameterName=code_block, value=toggle_2.in)
Rooms = Output(setParameterByName)
categories_3 = Categories("Levels")
all_elements_of_category_3 = ElementsOfCategory(categories_3)
getParameterValueByName_2 = Element.GetParameterValueByName(element=all_elements_of_category_3, parameterName=code_block)
toUpper_2 = String.ToUpper(getParameterValueByName_2)
ConvertLevels = Input(ConvertLevels : bool = false)
toggle_3 = Custom[Rhythm.Toggle](list=toUpper_2, boolean=ConvertLevels)
setParameterByName_2 = Element.SetParameterByName(element=all_elements_of_category_3, parameterName=code_block, value=toggle_3.in)
Levels = Output(setParameterByName_2)
categories_4 = Categories("Sheets")
all_elements_of_category_4 = ElementsOfCategory(categories_4)
code_block_2 = CodeBlock { "Sheet Name"; }
getParameterValueByName_3 = Element.GetParameterValueByName(element=all_elements_of_category_4, parameterName=code_block_2)
toUpper_3 = String.ToUpper(getParameterValueByName_3)
ConvertSheets = Input(ConvertSheets : bool = false)
toggle_4 = Custom[Rhythm.Toggle](list=toUpper_3, boolean=ConvertSheets)
setParameterByName_3 = Element.SetParameterByName(element=all_elements_of_category_4, parameterName=code_block_2, value=toggle_4.in)
Sheets = Output(setParameterByName_3)
element_types = ElementTypes("ViewDrafting")
all_elements_of_type = ElementsOfType(element_types)
element_types_2 = ElementTypes("ViewPlan")
all_elements_of_type_2 = ElementsOfType(element_types_2)
element_types_3 = ElementTypes("ViewSection")
all_elements_of_type_3 = ElementsOfType(element_types_3)
create = List.Create(all_elements_of_type, all_elements_of_type_2, all_elements_of_type_3)
flatten = Flatten(create)
code_block_3 = CodeBlock { "Title on Sheet"; }
getParameterValueByName_4 = Element.GetParameterValueByName(element=flatten, parameterName=code_block_3)
string_from_object = FromObject(getParameterValueByName_4)
toUpper_4 = String.ToUpper(string_from_object)
ConvertViewsTitleOnSheet = Input(ConvertViewsTitleOnSheet : bool = false)
toggle_5 = Custom[Rhythm.Toggle](list=toUpper_4, boolean=ConvertViewsTitleOnSheet)
setParameterByName_4 = Element.SetParameterByName(element=flatten, parameterName=code_block_3, value=toggle_5.in)
Views = Output(setParameterByName_4)
