# Dynamo custom node Ayuda.IsClockworkInstalled.dyf (Dynamo 0.8.1.1823)
# category: Rhythm.Core.Ayuda
# This node determines if clockwork is installed. Useful with a toggle.

currentUserAppData = Custom[OS.CurrentUserAppData]()  # This retrieves the current user's appdata location
length = String.Length(currentUserAppData)
string = StringInput("\Dynamo\0.8\packages")
insert = String.Insert(str=currentUserAppData, index=length, toInsert=string)
fromPath = DirectoryObject(insert)  # "Directory.FromPath"
string_2 = StringInput("Clockwork for Dynamo 0.7.x")
contents = Directory.Contents(fromPath, string_2)
isEmpty = List.IsEmpty(contents)
bool = Output(isEmpty)
