# Dynamo custom node Ayuda.ThisOrThat.dyf (Dynamo 0.9.0.3067)
# category: Rhythm.Core.Ayuda
# This node is a toggle between two inputs.

Item1 = Input(Item1 : var[]..[])
Item2 = Input(Item2 : var[]..[])
create = List.Create(Item1, Item2)
Toggle = Input(Toggle : bool)
code_block = CodeBlock { 0; 1; }
if_ = If(test=Toggle, true=code_block.out0, false=code_block.out1)
getItemAtIndex = List.GetItemAtIndex(list=create, index=if_)
clean = Custom[Output.Clean](input=getItemAtIndex)  # This will return a single value or list from one input.
var = Output(clean)  # "var[]..[]"
