# Dynamo custom node BasicFileInfo.SavedInVersion.dyf (Dynamo 1.2.1.3083)
# category: Rhythm.Revit.Application.BasicFileInfo
# This will supply the version that the revit model is saved in.

filePath = Input(filePath : string)
code_block = CodeBlock(item=filePath) { Flatten({item}); }
python_script = Python(IN[0]=code_block)
# ---------- python_script.python (39 lines) ----------
#Copyright(c) 2017, john pierson
# @60secondrevit, http://sixtysecondrevit.com
import clr
clr.AddReference('ProtoGeometry')
from Autodesk.DesignScript.Geometry import *

# Import Element wrapper extension methods
clr.AddReference("RevitNodes")
import Revit
clr.ImportExtensions(Revit.Elements)

# Import geometry conversion extension methods
clr.ImportExtensions(Revit.GeometryConversion)

# Import DocumentManager and TransactionManager
clr.AddReference("RevitServices")
import RevitServices
from RevitServices.Persistence import DocumentManager
from RevitServices.Transactions import TransactionManager

doc = DocumentManager.Instance.CurrentDBDocument
uiapp = DocumentManager.Instance.CurrentUIApplication
app = uiapp.Application

# Import RevitAPI
clr.AddReference("RevitAPI")
import Autodesk
from Autodesk.Revit.DB import *

items = IN[0]

typelist = list()
for i in items:
	try:
		typelist.append(BasicFileInfo.Extract(i).SavedInVersion)
	except:
		typelist.append(list())
		
OUT = typelist
# ----------------------------------------
clean = Custom[Output.Clean](input=python_script)  # This will return a single value or list from one input.
revitVersion = Output(clean)
