# Dynamo custom node CableTray.Space.dyf (Dynamo 1.0.0.1180)
# category: Rhythm.Revit.Elements.CableTray.Query
# This node will determine the space a cable tray's center falls within.

categories = Categories("MEPSpaces")
all_elements_of_category = ElementsOfCategory(categories)
cableTray = Input()
code_block = CodeBlock(item=cableTray) { Flatten({item}); }
python_script = Python(IN[0]=code_block)
# ---------- python_script.python (58 lines) ----------
import clr
clr.AddReference('RevitAPI')
from Autodesk.Revit.DB import *

clr.AddReference("RevitNodes")
import Revit
clr.ImportExtensions(Revit.GeometryConversion)

items = UnwrapElement(IN[0])
pointlist = list()
curvepointlist = list()
ispoint = list()
iscurve = list()
curves = list()
haslocation = list()

for item in items:
	try:
		# points and text notes
		pointlist.append(item.Coord.ToPoint())
		ispoint.append(True)
		iscurve.append(False)
		haslocation.append(True)
	except:
		try:
			loc = item.Location
			if loc.ToString() == 'Autodesk.Revit.DB.LocationCurve':
				# line-based elements (e.g. walls)
				curvepoints = (loc.Curve.GetEndPoint(0).ToPoint(),loc.Curve.GetEndPoint(1).ToPoint())
				curvepointlist.append(curvepoints)
				curves.append(loc.Curve.ToProtoType())
				ispoint.append(False)
				iscurve.append(True)
				haslocation.append(True)
			elif loc.ToString() == 'Autodesk.Revit.DB.LocationPoint':
				# point-based elements
				pointlist.append(loc.Point.ToPoint())
				ispoint.append(True)
				iscurve.append(False)
				haslocation.append(True)
			else:
				ispoint.append(False)
				iscurve.append(False)
				haslocation.append(False)
		except:
			try:
				# curves
				curvepoints = (item.GetEndPoint(0).ToPoint(),item.GetEndPoint(1).ToPoint())
				curvepointlist.append(curvepoints)
				curves.append(item.ToProtoType())
				ispoint.append(False)
				iscurve.append(True)
				haslocation.append(True)
			except:
				ispoint.append(False)
				iscurve.append(False)
				haslocation.append(False)
OUT = (pointlist,curvepointlist,curves,ispoint,iscurve,haslocation)
# ----------------------------------------
code_block_2 = CodeBlock(line=python_script) { line[2]; 0.5; }
pointAtParameter = Curve.PointAtParameter(curve=code_block_2.out0, param=code_block_2.out1)
python_script_2 = Python(IN[0]=all_elements_of_category, IN[1]=pointAtParameter)
# ---------- python_script_2.python (23 lines) ----------
import clr
clr.AddReference('RevitAPI')
from Autodesk.Revit.DB import *

clr.AddReference("RevitNodes")
import Revit
clr.ImportExtensions(Revit.GeometryConversion)

rooms = UnwrapElement(IN[0])
points = [x.ToXyz() for x in IN[1]]
roomlist = list()
for point in points:
	booleans = list()
	for room in rooms:
		try:
			if room.IsPointInSpace(point):
				booleans.append(True)
			else:
				booleans.append(False)
		except:
			booleans.append(False)
	roomlist.append(booleans)
OUT = roomlist
# ----------------------------------------
flatten = Flatten(python_script_2)
filterByBoolMask = List.FilterByBoolMask(list=all_elements_of_category, mask=flatten)
clean = Custom[Output.Clean](input=filterByBoolMask.in)  # This will return a single value or list from one input.
space = Output(clean)
