# Dynamo custom node Collector.Areas.dyf (Dynamo 1.2.1.3083)
# category: Rhythm.Revit.Collector
# This is an area collector element that utilizes mostly OOTB nodes.

areaType = Input(areaType : string = "")  # Specify area type to filter by here. Leave blank for all area types.
string = StringInput("")

# group: Collects areas and filters out unplaced areas.
categories = Categories("Areas")
all_elements_of_category = ElementsOfCategory(categories)
code_block = CodeBlock { "Area"; ""; }
getParameterValueByName = Element.GetParameterValueByName(element=all_elements_of_category, parameterName=code_block.out0)
ne = getParameterValueByName != code_block.out1
filterByBoolMask = List.FilterByBoolMask(list=all_elements_of_category, mask=ne)

Level = Input()

# group: Filters for level location then area type.
eq = areaType == string
code_block_2 = CodeBlock { "Level"; }
getParameterValueByName_2 = Element.GetParameterValueByName(element=filterByBoolMask.in, parameterName=code_block_2)
name = Element.Name(Level)
eq_2 = getParameterValueByName_2 == name
filterByBoolMask_2 = List.FilterByBoolMask(list=filterByBoolMask.in, mask=eq_2)
code_block_3 = CodeBlock { "Area Type"; }
getParameterValueByName_3 = Element.GetParameterValueByName(element=filterByBoolMask_2.in, parameterName=code_block_3)
eq_3 = getParameterValueByName_3 == areaType

filterByBoolMask_3 = List.FilterByBoolMask(list=filterByBoolMask_2.in, mask=eq_3)
thisOrThat = Custom[Ayuda.ThisOrThat](Toggle=eq, Item1=filterByBoolMask_2.in, Item2=filterByBoolMask_3.in)  # This node is a toggle between two inputs.

# group: The area elements
identity = Object.Identity(thisOrThat)

areaElements = Output(identity)
name_2 = Element.Name(identity)
name_3 = Output(name_2)  # "name"
code_block_4 = CodeBlock { "Number"; }
getParameterValueByName_4 = Element.GetParameterValueByName(element=identity, parameterName=code_block_4)
number = Output(getParameterValueByName_4)
code_block_5 = CodeBlock { "Area"; }
getParameterValueByName_5 = Element.GetParameterValueByName(element=identity, parameterName=code_block_5)
area = Output(getParameterValueByName_5)

# group: This node made possible from clockwork,
python_script = Python(IN[0]=thisOrThat)
# ---------- python_script.python (52 lines) ----------
import clr
clr.AddReference('RevitAPI')
from Autodesk.Revit.DB import *
import Autodesk

clr.AddReference("RevitNodes")
import Revit
clr.ImportExtensions(Revit.GeometryConversion)

clr.AddReference("RevitServices")
import RevitServices
from RevitServices.Persistence import DocumentManager

uiapp = DocumentManager.Instance.CurrentUIApplication
app = uiapp.Application
items = UnwrapElement(IN[0])
version = app.VersionNumber
elementlist = list()
curvelist = list()

for item in items:
	doc = item.Document
	calculator = SpatialElementGeometryCalculator(doc)
	options = Autodesk.Revit.DB.SpatialElementBoundaryOptions()
	# get boundary location from area computation settings
	boundloc = Autodesk.Revit.DB.AreaVolumeSettings.GetAreaVolumeSettings(doc).GetSpatialElementBoundaryLocation(SpatialElementType.Room)
	options.SpatialElementBoundaryLocation = boundloc
	#method #1 - get boundary segments
	blist = list()
	clist = list()
	try:
		for boundarylist in item.GetBoundarySegments(options):
			for boundary in boundarylist:
				blist.append(doc.GetElement(boundary.ElementId))
				if version > 2016:
					clist.append(boundary.GetCurve().ToProtoType())
				else:
					clist.append(boundary.Curve.ToProtoType())
	except:
		pass
	#method #2 - spatial element geometry calculator
	try:
		results = calculator.CalculateSpatialElementGeometry(item)
		for face in results.GetGeometry().Faces:
			for bface in results.GetBoundaryFaceInfo(face):
				blist.append(doc.GetElement(bface.SpatialBoundaryElement.HostElementId))
	except:
		pass	
	# write results to list
	elementlist.append(blist)
	curvelist.append(clist)
OUT = (elementlist,curvelist)
# ----------------------------------------

# group: Constructs the area boundaries
code_block_6 = CodeBlock(lines=python_script) { lines[1]; }
byJoinedCurves = PolyCurve.ByJoinedCurves(code_block_6)
code_block_7 = CodeBlock { 0..1..#100; }
pointAtParameter = Curve.PointAtParameter(curve=byJoinedCurves, param=code_block_7, lacing=CrossProduct)

identity_2 = Object.Identity(code_block_6)
unconnectedBoundaries = Output(identity_2)

# group: Boundaries of areas
byPoints = Polygon.ByPoints(pointAtParameter)

connectedBoundaries = Output(byPoints)

# group: Location of Areas
getLocation = Element.GetLocation(thisOrThat)

areaLocation = Output(getLocation)
