# Dynamo custom node Collector.DuctsBySystem.dyf (Dynamo 0.8.1.1823)
# category: Rhythm.Revit.Selection
# This collects all ducts in the project and organizes them by System Classification

element_types = ElementTypes("Duct")
all_elements_of_type = ElementsOfType(element_types)
RunMe = Input(RunMe : bool = false)
toggle = Custom[Rhythm.Toggle](list=all_elements_of_type, boolean=RunMe)  # Toggle that offers two outputs. Created for Dynamo 0.8.1 because of changes to the "IF" node
code_block = CodeBlock { "System Classification"; "System Type"; }
getParameterValueByName = Element.GetParameterValueByName(parameterName=code_block.out0)
groupByKey = GroupByKey(toggle.in, getParameterValueByName)
getParameterValueByName_2 = Element.GetParameterValueByName(element=groupByKey, parameterName=code_block.out1)
code_block_2 = CodeBlock { 0; }
getItemAtIndex = List.GetItemAtIndex(index=code_block_2)
map = List.Map(list=getParameterValueByName_2, f_x=getItemAtIndex)
SystemTypes = Output(map)
getParameterValueByName_3 = Element.GetParameterValueByName(element=groupByKey, parameterName=code_block.out0)
map_2 = List.Map(list=getParameterValueByName_3, f_x=getItemAtIndex)
SystemClassifications = Output(map_2)
Ducts_GroupedBySystem = Output(groupByKey)  # "Ducts(GroupedBySystem)"
