# Dynamo custom node Collector.KeynoteTags.dyf (Dynamo 0.8.1.1823)
# category: Rhythm.Revit.Selection
# This collects all of the keynote tags in the model. Similar to other nodes, but this doesn't use python.

element_types = ElementTypes("FamilySymbol")
# note: Sets the leader arrowhead for all keynote tags
all_elements_of_type = ElementsOfType(element_types)
RunMe = Input(RunMe : bool = false)
toggle = Custom[Rhythm.Toggle](list=all_elements_of_type, boolean=RunMe)  # Toggle that offers two outputs. Created for Dynamo 0.8.1 because of changes to the "IF" node
name = Element.Name(toggle.in)
code_block = CodeBlock { "Keynote"; true; }
contains = String.Contains(searchFor=code_block.out0, ignoreCase=code_block.out1)
map = List.Map(list=name, f_x=contains)
filterByBoolMask = List.FilterByBoolMask(list=toggle.in, mask=map)
Keynote_Tags = Output(filterByBoolMask.in)
