# Dynamo custom node Collector.ModelGroupByName.dyf (Dynamo 1.3.2.2480)
# category: Rhythm.Revit.Collector
# This will collect all instances of a model group by given name.

groupName = Input(groupName : string)
code_block = CodeBlock(item=groupName) { DSCore.List.Flatten({item},-1); }
python_script = Python(IN[0]=code_block)
# ---------- python_script.python (38 lines) ----------
#Copyright(c) 2017, john pierson
# @60secondrevit, http://sixtysecondrevit.com

import clr
clr.AddReference('ProtoGeometry')
from Autodesk.DesignScript.Geometry import *

# Import DocumentManager and TransactionManager
clr.AddReference("RevitServices")
import RevitServices
from RevitServices.Persistence import DocumentManager
from RevitServices.Transactions import TransactionManager

# Import RevitAPI
clr.AddReference("RevitAPI")
import Autodesk
from Autodesk.Revit.DB import *

doc = DocumentManager.Instance.CurrentDBDocument
uiapp = DocumentManager.Instance.CurrentUIApplication
app = uiapp.Application

from System.Collections.Generic import *


#The inputs to this node will be stored as a list in the IN variable.
dataEnteringNode = IN
name = IN[0]
collector = FilteredElementCollector(doc)
groups = collector.OfCategory(BuiltInCategory.OST_IOSModelGroups).WhereElementIsNotElementType().ToElements()

groupInstances = []
for i in groups:
	for n in name:
		if i.Name == n:
			groupInstances.append(i)

OUT = groupInstances
# ----------------------------------------
groupInstances = Output(python_script)
