# Dynamo custom node Collector.OfExteriorWalls.dyf (Dynamo 1.3.1.1736)
# category: Rhythm.Revit.Collector
# This node will collect all exterior (function) walls.

toggle = Input(toggle : bool =false)
python_script = Python(IN[0]=toggle)
# ---------- python_script.python (37 lines) ----------
#Copyright(c) 2017, john pierson
# @60secondrevit, http://sixtysecondrevit.com

import clr
clr.AddReference('ProtoGeometry')
from Autodesk.DesignScript.Geometry import *

# Import DocumentManager and TransactionManager
clr.AddReference("RevitServices")
import RevitServices
from RevitServices.Persistence import DocumentManager
from RevitServices.Transactions import TransactionManager

# Import RevitAPI
clr.AddReference("RevitAPI")
import Autodesk
from Autodesk.Revit.DB import *

doc = DocumentManager.Instance.CurrentDBDocument
uiapp = DocumentManager.Instance.CurrentUIApplication
app = uiapp.Application

from System.Collections.Generic import *


#The inputs to this node will be stored as a list in the IN variable.
dataEnteringNode = IN
collector = FilteredElementCollector(doc)
walls = collector.OfCategory(BuiltInCategory.OST_Walls).WhereElementIsNotElementType().ToElements()

interiorWalls = []
for i in walls:

	if i.WallType.get_Parameter(BuiltInParameter.FUNCTION_PARAM).AsValueString() == "Exterior":
		interiorWalls.append(i)

OUT = interiorWalls
# ----------------------------------------
exteriorWalls = Output(python_script)
