# Dynamo custom node Collector.OfLegendViews.dyf (Dynamo 1.3.2.2480)
# category: Rhythm.Revit.Collector
# This node will collect all legend views in the project.

refresh = Input(refresh: bool = false)
python_script = Python(IN[0]=refresh)
# ---------- python_script.python (36 lines) ----------
#Copyright(c) 2017, john pierson
# @60secondrevit, http://sixtysecondrevit.com

import clr
clr.AddReference('ProtoGeometry')
from Autodesk.DesignScript.Geometry import *

# Import DocumentManager and TransactionManager
clr.AddReference("RevitServices")
import RevitServices
from RevitServices.Persistence import DocumentManager
from RevitServices.Transactions import TransactionManager

# Import RevitAPI
clr.AddReference("RevitAPI")
import Autodesk
from Autodesk.Revit.DB import *

doc = DocumentManager.Instance.CurrentDBDocument
uiapp = DocumentManager.Instance.CurrentUIApplication
app = uiapp.Application

from System.Collections.Generic import *


#The inputs to this node will be stored as a list in the IN variable.
dataEnteringNode = IN
collector = FilteredElementCollector(doc)
sheets = collector.OfCategory(BuiltInCategory.OST_Views).ToElements()

sheetInstances = []
for i in sheets:
	if i.ViewType.ToString() == "Legend":
		sheetInstances.append(i)

OUT = sheetInstances
# ----------------------------------------
legendViews = Output(python_script)
