# Dynamo custom node Collector.PipesBySystem.dyf (Dynamo 1.2.1.3083)
# category: Rhythm.Revit.Collector
# This collects all pipes in the project and organizes them by System Classification

element_types = ElementTypes("Pipe")
all_elements_of_type = ElementsOfType(element_types)
RunMe = Input(RunMe : bool = false)
toggle = Custom[Rhythm.Toggle](list=all_elements_of_type, boolean=RunMe)  # Toggle that offers two outputs. Created for Dynamo 0.8.1 because of changes to the "IF" node
code_block = CodeBlock { "System Classification"; "System Type"; }
getParameterValueByName = Element.GetParameterValueByName(parameterName=code_block.out0)  # unwired: element
groupByFunction = GroupByFunction(toggle.in, getParameterValueByName)
getParameterValueByName_2 = Element.GetParameterValueByName(element=groupByFunction, parameterName=code_block.out1)
code_block_2 = CodeBlock { 0; }
getItemAtIndex = List.GetItemAtIndex(index=code_block_2)  # unwired: list
map = List.Map(list=getParameterValueByName_2, f_x=getItemAtIndex)
SystemTypes = Output(map)
getParameterValueByName_3 = Element.GetParameterValueByName(element=groupByFunction, parameterName=code_block.out0)
map_2 = List.Map(list=getParameterValueByName_3, f_x=getItemAtIndex)
SystemClassifications = Output(map_2)
Pipes_GroupedBySystem = Output(groupByFunction)  # "Pipes(GroupedBySystem)"
