# Dynamo custom node Collector.PlacedRooms.dyf (Dynamo 1.3.0.875)
# category: Rhythm.Revit.Collector
# This will collect placed rooms in current file.

toggle = Input(toggle : bool = false)
python_script = Python(IN[0]=toggle)
# ---------- python_script.python (36 lines) ----------
#Copyright(c) 2017, john pierson
# @60secondrevit, http://sixtysecondrevit.com

import clr
clr.AddReference('ProtoGeometry')
from Autodesk.DesignScript.Geometry import *

# Import DocumentManager and TransactionManager
clr.AddReference("RevitServices")
import RevitServices
from RevitServices.Persistence import DocumentManager
from RevitServices.Transactions import TransactionManager

# Import RevitAPI
clr.AddReference("RevitAPI")
import Autodesk
from Autodesk.Revit.DB import *

doc = DocumentManager.Instance.CurrentDBDocument
uiapp = DocumentManager.Instance.CurrentUIApplication
app = uiapp.Application

from System.Collections.Generic import *


#The inputs to this node will be stored as a list in the IN variable.
dataEnteringNode = IN
collector = FilteredElementCollector(doc)
rooms = collector.OfCategory(BuiltInCategory.OST_Rooms).ToElements()

roomInstances = []
for i in rooms:
	if i.Area != 0:
		roomInstances.append(i)

OUT = roomInstances
# ----------------------------------------
rooms = Output(python_script)
