# Dynamo custom node Collector.TagTypes.dyf (Dynamo 0.9.0.3067)
# category: Rhythm.Revit.Selection
# This node collects the tag types in the model.

categories = Categories("RoomTags")
all_elements_of_category = ElementsOfCategory(categories)
RunMe = Input(RunMe : bool = false)
toggle = Custom[Rhythm.Toggle](list=all_elements_of_category, boolean=RunMe)  # Toggle that offers two outputs. Created for Dynamo 0.8.1 because of changes to the "IF" node
python_script = Python(IN[0]=toggle.in)
# ---------- python_script.python (19 lines) ----------
#All credit for this python script goes to Andreas Dieckmann
#Download his clockwork package
import clr
clr.AddReference('RevitAPI')
from Autodesk.Revit.DB import *

clr.AddReference("RevitServices")
import RevitServices
from RevitServices.Persistence import DocumentManager

doc = DocumentManager.Instance.CurrentDBDocument
items = UnwrapElement(IN[0])
typelist = list()
for item in items:
	try:
		typelist.append(doc.GetElement(item.GetTypeId()))
	except:
		typelist.append(list())
OUT = typelist
# ----------------------------------------
uniqueItems = List.UniqueItems(python_script)
Room_Tag_Types = Output(uniqueItems)
categories_2 = Categories("DoorTags")
all_elements_of_category_2 = ElementsOfCategory(categories_2)
toggle_2 = Custom[Rhythm.Toggle](list=all_elements_of_category_2, boolean=RunMe)
python_script_2 = Python(IN[0]=toggle_2.in)  # same code as python_script
uniqueItems_2 = List.UniqueItems(python_script_2)
Door_Tag_Types = Output(uniqueItems_2)
categories_3 = Categories("WindowTags")
all_elements_of_category_3 = ElementsOfCategory(categories_3)
toggle_3 = Custom[Rhythm.Toggle](list=all_elements_of_category_3, boolean=RunMe)
python_script_3 = Python(IN[0]=toggle_3.in)  # same code as python_script
uniqueItems_3 = List.UniqueItems(python_script_3)
Window_Tag_Types = Output(uniqueItems_3)
categories_4 = Categories("WallTags")
all_elements_of_category_4 = ElementsOfCategory(categories_4)
toggle_4 = Custom[Rhythm.Toggle](list=all_elements_of_category_4, boolean=RunMe)
python_script_4 = Python(IN[0]=toggle_4.in)  # same code as python_script
uniqueItems_4 = List.UniqueItems(python_script_4)
Wall_Tag_Types = Output(uniqueItems_4)
