# Dynamo custom node Collector.Viewports.dyf (Dynamo 1.2.1.3083)
# category: Rhythm.Revit.Collector
# This collects all of the viewports in the model and outputs the name, title on sheet, scale and viewport type.

RunMe = Input(RunMe : bool = false)

# group: We collect all of the viewports and query all parameters
categories = Categories("Viewports")
all_elements_of_category = ElementsOfCategory(categories)
toggle = Custom[Rhythm.Toggle](list=all_elements_of_category, boolean=RunMe)  # Toggle that offers two outputs. Created for Dynamo 0.8.1 because of changes to the "IF" node
parameters = Element.Parameters(toggle.in)
string_from_object = FromObject(parameters)

Elements = Output(toggle.in)

# group: Here we begin to filter out the duplicated vie name parameter.
uniqueItems = List.UniqueItems()  # unwired: arg0
map = List.Map(list=string_from_object, f_x=uniqueItems)
code_block = CodeBlock { "View Name"; }
contains = String.Contains(str=map, searchFor=code_block)
filterByBoolMask = List.FilterByBoolMask(list=map, mask=contains)
flatten = Flatten(filterByBoolMask.in)
code_block_2 = CodeBlock { ": "; false; }
removePriorToCharacter = Custom[String.RemovePriorToCharacter](str=flatten, Character=code_block_2.out0, ignoreCase=code_block_2.out1)  # This will remove all characters prior to the input character. Accepts strings.; unwired: removeInitalCharacter

# group: This gets title on sheet to help filter out in the future.
code_block_3 = CodeBlock { "Title on Sheet"; }
getParameterValueByName = Element.GetParameterValueByName(element=toggle.in, parameterName=code_block_3)
code_block_4 = CodeBlock { "test"; }
code_block_5 = CodeBlock { ""; }
eq = _ == code_block_5  # unwired: arg0
replaceByCondition = Replace(getParameterValueByName, code_block_4, eq)
code_block_6 = CodeBlock { 2; }
cycle = List.Cycle(amount=code_block_6)  # unwired: list
map_2 = List.Map(list=replaceByCondition, f_x=cycle)
flatten_2 = Flatten(map_2)
code_block_7 = CodeBlock { {"","test"}; }
count = List.Count(getParameterValueByName)
code_block_8 = CodeBlock(a=count) { a; }
cycle_2 = List.Cycle(list=code_block_7, amount=code_block_8)
eq_2 = flatten_2 == cycle_2
filterByBoolMask_2 = List.FilterByBoolMask(list=flatten_2, mask=eq_2)

# group: We finally have the actual view names of each view. Instead of a mixture of title on sheet/ view name
trimWhitespace = String.TrimWhitespace(removePriorToCharacter)
eq_3 = trimWhitespace == filterByBoolMask_2.out
filterByBoolMask_3 = List.FilterByBoolMask(list=trimWhitespace, mask=eq_3)

ViewNames = Output(filterByBoolMask_3.out)
TitleOnSheet = Output(getParameterValueByName)
code_block_9 = CodeBlock { "Scale Value    1:"; }
getParameterValueByName_2 = Element.GetParameterValueByName(element=toggle.in, parameterName=code_block_9)
ViewScale_1 = Output(getParameterValueByName_2)  # "ViewScale 1:x"
