# Dynamo custom node CurtainGrid.AllSegmentCurves.dyf (Dynamo 1.2.1.3083)
# category: Rhythm.Revit.Elements.CurtainGrid
# This will return the vertical and horizontal curtain grid segments regardless if hidden or not. Groups by U and V.

curtainGrid = Input()
code_block = CodeBlock(item=curtainGrid) { Flatten({item}); }
python_script = Python(IN[0]=code_block)
# ---------- python_script.python (34 lines) ----------
#Copyright(c) 2017, john pierson
# @60secondrevit, http://sixtysecondrevit.com
import clr
clr.AddReference('RevitAPI')
from Autodesk.Revit.DB import *
import Autodesk

clr.AddReference("RevitNodes")
import Revit
clr.ImportExtensions(Revit.GeometryConversion)

clr.AddReference("RevitServices")
import RevitServices
from RevitServices.Persistence import DocumentManager

doc = DocumentManager.Instance.CurrentDBDocument

#The inputs to this node will be stored as a list in the IN variable.
dataEnteringNode = IN

#unwrap all elements to use with API
items = UnwrapElement(IN[0])

#apply API method to list
typelist = list()
for i in items:
	try:
		typelist.append(i.AllSegmentCurves.ToProtoType())
	except:
		typelist.append(list())


#Assign your output to the OUT variable
OUT = typelist
# ----------------------------------------
curves = PolyCurve.Curves(python_script)
count = Count(curtainGrid, lacing=Longest)
chop = List.Chop(list=curves, lengths=count)
allSegmentCurves = Output(chop)
