# Dynamo custom node CurtainGrid.ByElement.dyf (Dynamo 1.2.1.3083)
# category: Rhythm.Revit.Elements.CurtainGrid
# Gets the curtain grids by the host element. Seperates into U and V

hostingElement = Input()
python_script = Python(IN[0]=hostingElement)
# ---------- python_script.python (27 lines) ----------
import clr
clr.AddReference('RevitAPI')
from Autodesk.Revit.DB import *
import Autodesk

clr.AddReference("RevitNodes")
import Revit
clr.ImportExtensions(Revit.GeometryConversion)

clr.AddReference("RevitServices")
import RevitServices
from RevitServices.Persistence import DocumentManager


doc = DocumentManager.Instance.CurrentDBDocument

#The inputs to this node will be stored as a list in the IN variable.
dataEnteringNode = IN

#unwrap all elements to use with API
walls = UnwrapElement(IN[0])

#apply lineweight override to elements in an input list
curtainGrid = walls.CurtainGrid

#Assign your output to the OUT variable
OUT = (curtainGrid.GetUGridLineIds()), (curtainGrid.GetVGridLineIds())
# ----------------------------------------
code_block = CodeBlock(x=python_script) { x[0]; x[1]; }
python_script_2 = Python(IN[0]=code_block.out0)
# ---------- python_script_2.python (25 lines) ----------
#Copyright(c) 2017, john pierson
# @60secondrevit, http://sixtysecondrevit.com
import clr
clr.AddReference('RevitAPI')
from Autodesk.Revit.DB import *

clr.AddReference("RevitNodes")
import Revit
clr.ImportExtensions(Revit.Elements)

clr.AddReference("RevitServices")
import RevitServices
from RevitServices.Persistence import DocumentManager

doc = DocumentManager.Instance.CurrentDBDocument
items = UnwrapElement(IN[0])

elementlist = list()
unmatched = list()
for item in items:
	try: 
		elementlist.append(doc.GetElement(item).ToDSType(True))
	except:
		unmatched.append(item)
OUT = (elementlist, unmatched)
# ----------------------------------------
code_block_2 = CodeBlock(seq=python_script_2) { seq[0]; }
python_script_3 = Python(IN[0]=code_block.out1)  # same code as python_script_2
code_block_3 = CodeBlock(seq=python_script_3) { seq[0]; }
code_block_4 = CodeBlock(u=code_block_2, v=code_block_3) { {u,v}; }
curtainGrid = Output(code_block_4)  # "curtainGrid[]"
