# Dynamo custom node CurtainGrid.ExistingSegmentCurves.dyf (Dynamo 1.2.1.3083)
# category: Rhythm.Revit.Elements.CurtainGrid
# Retrieve all the existing segment curves of the grid line.  Groups by U and V.

curtainGrid = Input()
code_block = CodeBlock(item=curtainGrid) { Flatten({item}); }
python_script = Python(IN[0]=code_block)
# ---------- python_script.python (34 lines) ----------
#Copyright(c) 2017, john pierson
# @60secondrevit, http://sixtysecondrevit.com
import clr
clr.AddReference('RevitAPI')
from Autodesk.Revit.DB import *
import Autodesk

clr.AddReference("RevitNodes")
import Revit
clr.ImportExtensions(Revit.GeometryConversion)

clr.AddReference("RevitServices")
import RevitServices
from RevitServices.Persistence import DocumentManager

doc = DocumentManager.Instance.CurrentDBDocument

#The inputs to this node will be stored as a list in the IN variable.
dataEnteringNode = IN

#unwrap all elements to use with API
items = UnwrapElement(IN[0])

#apply API method to list
typelist = list()
for i in items:
	try:
		typelist.append(i.ExistingSegmentCurves)
	except:
		typelist.append(list())


#Assign your output to the OUT variable
OUT = typelist
# ----------------------------------------
code_block_2 = CodeBlock(item=python_script) { Flatten({item}); }
python_script_2 = Python(IN[0]=code_block_2)
# ---------- python_script_2.python (25 lines) ----------
#Copyright(c) 2017, john pierson
# @60secondrevit, http://sixtysecondrevit.com
import clr
clr.AddReference('RevitAPI')
from Autodesk.Revit.DB import *

clr.AddReference("RevitNodes")
import Revit
clr.ImportExtensions(Revit.GeometryConversion)

clr.AddReference("RevitServices")
import RevitServices
from RevitServices.Persistence import DocumentManager
from RevitServices.Transactions import TransactionManager

doc = DocumentManager.Instance.CurrentDBDocument
curves = UnwrapElement(IN[0])
elementlist = []

TransactionManager.Instance.EnsureInTransaction(doc)
for curve in curves:
	revitCurves = curve.ToProtoType()
	elementlist.append(revitCurves)
TransactionManager.Instance.TransactionTaskDone()
OUT = elementlist
# ----------------------------------------
count = Count(python_script, lacing=Longest)
chop = List.Chop(list=python_script_2, lengths=count)
count_2 = Count(curtainGrid, lacing=Longest)
chop_2 = List.Chop(list=chop, lengths=count_2)
existingSegmentCurves = Output(chop_2)
