# Dynamo custom node CurtainGrid.RemoveSegment.dyf (Dynamo 1.1.0.2065)
# category: Rhythm.Revit.Elements.CurtainGrid
# Removes segments from curtain grids. Can't take lists yet. Use with List.Combine.

removeSegmentsFunction = Custom[CurtainGrid.RemoveSegmentsFunction]()  # Function to apply to remove segments node
element = Input()
curve = Input()
count = Count(curve, lacing=Longest)
cycle = List.Cycle(list=element, amount=count, lacing=Longest)
flatten = Flatten(cycle)
code_block = CodeBlock { 1; }
chop = List.Chop(list=flatten, lengths=code_block)
toRevitType = Custom[Geometry.ToRevitType](var=curve)  # This will convert designscript geometyr into Revit.DB types. Currently tested with curves, nurbs curves and solids.
combine = List.Combine(removeSegmentsFunction, chop, toRevitType)
flatten_2 = Flatten(combine)
uniqueItems = List.UniqueItems(flatten_2)
