# Dynamo custom node CurtainGrid.RemoveSegmentsFunction.dyf (Dynamo 1.2.1.3083)
# category: Rhythm.Revit.Elements.CurtainGrid
# Function to apply to remove segments node

element = Input()
curve = Input()
python_script = Python(IN[0]=element, IN[1]=curve)
# ---------- python_script.python (47 lines) ----------
#Copyright(c) 2017, john pierson
# @60secondrevit, http://sixtysecondrevit.com
import clr
clr.AddReference('ProtoGeometry')
from Autodesk.DesignScript.Geometry import *

# Import ToDSType(bool) extension method
clr.AddReference("RevitNodes")
import Revit
clr.ImportExtensions(Revit.Elements)

# Import DocumentManager and TransactionManager
clr.AddReference("RevitServices")
import RevitServices
from RevitServices.Persistence import DocumentManager
from RevitServices.Transactions import TransactionManager

from System.Collections.Generic import *

# Import RevitAPI
clr.AddReference("RevitAPI")
import Autodesk

doc = DocumentManager.Instance.CurrentDBDocument
uiapp = DocumentManager.Instance.CurrentUIApplication
app = uiapp.Application

#The inputs to this node will be stored as a list in the IN variable.
dataEnteringNode = IN

#unwrap all elements to use with API
elements = []
for i in IN[0]:
	elements.append(UnwrapElement(i))

# "Start" the transaction
TransactionManager.Instance.EnsureInTransaction(doc)

#apply lineweight override to elements in an input list
for i in elements:
	i.RemoveSegment(IN[1])

# "End" the transaction
TransactionManager.Instance.TransactionTaskDone()

#Assign your output to the OUT variable
OUT = IN[0]
# ----------------------------------------
