# Dynamo custom node Curve.FromLine.dyf (Dynamo 0.9.0.3067)
# category: Rhythm.Geometry.Curve
# This will translate a line element to a curve.

create = List.Create()
empty = List.Empty()
line = Input()
addItemToFront = List.AddItemToFront(item=empty, list=line)
flatten = Flatten(addItemToFront)
startPoint = Curve.StartPoint(flatten)
endPoint = Curve.EndPoint(flatten)
combine = List.Combine(create, startPoint, endPoint)
byPoints = PolyCurve.ByPoints(points=combine)
explode = Geometry.Explode(byPoints)
clean = Custom[Output.Clean](input=explode)  # This will return a single value or list from one input.
curve = Output(clean)
