# Dynamo custom node DImension.Properties.dyf (Dynamo 1.3.0.875)
# category: Rhythm.Revit.Elements.Dimension
# This will reports some of the available properties of a dimension.

dimension = Input()
usesProjectSettings = Custom[Dimension.UsesProjectSettings](dimension=dimension)  # This will determine if a dimension uses project settings.
type = Custom[Element.Type](element=usesProjectSettings.overriddenSettings)  # This retrieves the element type of the given elements. (if available) Similar to others available but no python here.
python_script = Python(IN[0]=type)
# ---------- python_script.python (73 lines) ----------
#Copyright(c) 2017, john pierson
# @60secondrevit, http://sixtysecondrevit.com
import clr
clr.AddReference('ProtoGeometry')
from Autodesk.DesignScript.Geometry import *

# Import ToDSType(bool) extension method
clr.AddReference("RevitNodes")
import Revit
clr.ImportExtensions(Revit.Elements)

# Import DocumentManager and TransactionManager
clr.AddReference("RevitServices")
import RevitServices
from RevitServices.Persistence import DocumentManager
from RevitServices.Transactions import TransactionManager

from System.Collections.Generic import *

# Import RevitAPI
clr.AddReference("RevitAPI")
import Autodesk
#Custom flatten definition to manage lists in here
def flatten(*args):
    for x in args:
        if hasattr(x, '__iter__'):
            for y in flatten(*x):
                yield y
        else:
            yield x
            

doc = DocumentManager.Instance.CurrentDBDocument
uiapp = DocumentManager.Instance.CurrentUIApplication
app = uiapp.Application

#The inputs to this node will be stored as a list in the IN variable.
dataEnteringNode = IN

#unwrap all elements to use with API
dims = UnwrapElement(IN[0])
TransactionManager.Instance.EnsureInTransaction(doc)
#apply lineweight override to elements in an input list
formatOptions = list()
valueList = list()
colorList = list()
for i in dims:
	try:
		formatOptions.append(i.GetUnitsFormatOptions())	
		colorList.append(i.GetParameters("Color"))		
	except:
		formatOptions.append(list())


for i in formatOptions:
	try:
		valueList.append(i.DisplayUnits)
		valueList.append(i.Accuracy)		
	except:
		valueList.append(list())

colorListFlat = flatten(colorList)
for c in colorListFlat:
	try:
		valueList.append(c.AsDouble())
	except:
		valueList.append(list())

# "End" the transaction
TransactionManager.Instance.TransactionTaskDone()

#Assign your output to the OUT variable
OUT = valueList
# ----------------------------------------
code_block = CodeBlock(output=python_script) { output[0]; output[1]; output[2]; }
displayUnits = Output(code_block.out0)
accuracy = Output(code_block.out1)
color = Output(code_block.out2)
overridenDimensions = Output(usesProjectSettings.overriddenSettings)
dimensionsThatUseProjectSettings = Output(usesProjectSettings.usesProjectSettings)
