# Dynamo custom node Dash Remover.dyf (Dynamo 0.8.1.1823)
# category: Rhythm.Tools
# This node removes the dash at index 2 if it exists. The reason being, NCS states that no dash shall be used.

ctrl_click_to_view = CodeBlock { "http://www.nationalcadstandard.org/ncs5/pdfs/ncs5_uds1.pdf"; }
categories = Categories("TitleBlocks")
all_elements_of_category = ElementsOfCategory(categories)
RunMe = Input(RunMe : bool = false)
toggle = Custom[Rhythm.Toggle](list=all_elements_of_category, boolean=RunMe)  # Toggle that offers two outputs. Created for Dynamo 0.8.1 because of changes to the "IF" node
code_block = CodeBlock { "Sheet Number"; 2; "-"; }
getParameterValueByName = Element.GetParameterValueByName(element=toggle.in, parameterName=code_block.out0)
characterAtIndex = Custom[String.CharacterAtIndex](Index=code_block.out1)  # Get's the character at a given index
map = List.Map(list=getParameterValueByName, f_x=characterAtIndex)
eq = map == code_block.out2
filterByBoolMask = List.FilterByBoolMask(list=toggle.in, mask=eq)
filterByBoolMask_2 = List.FilterByBoolMask(list=getParameterValueByName, mask=eq)
string_from_object = FromObject(filterByBoolMask_2.in)
code_block_2 = CodeBlock { 2; 1; }
remove = String.Remove(str=string_from_object, startIndex=code_block_2.out0, count=code_block_2.out1)
setParameterByName = Element.SetParameterByName(element=filterByBoolMask.in, parameterName=code_block.out0, value=remove)
Dashes_Removed = Output(setParameterByName)
