# Dynamo custom node Dimension.IsOverridden.dyf (Dynamo 1.3.2.2480)
# category: Rhythm.Revit.Elements.Dimension.Actions
# This will report if a dimension has been overridden.

dimension = Input()
code_block = CodeBlock(item=dimension) { DSCore.List.Flatten({item},-1); }
python_script = Python(IN[0]=code_block)
# ---------- python_script.python (16 lines) ----------
import clr
clr.AddReference('RevitAPI')
from Autodesk.Revit.DB import *

clr.AddReference("RevitNodes")
import Revit
clr.ImportExtensions(Revit.Elements)

items = UnwrapElement(IN[0])
elementlist = list()
for item in items:
	try:
		elementlist.append(item.ValueOverride)
	except:
		unmatched.append(item)
OUT = elementlist
# ----------------------------------------
boolean = BoolSelector(false)
code_block_2 = CodeBlock { ""; }
eq = _ == code_block_2  # unwired: arg0
replaceByCondition = Replace(python_script, boolean, eq)
isNull = Object.IsNull()  # unwired: arg0
replaceByCondition_2 = Replace(replaceByCondition, boolean, isNull)
boolean_2 = BoolSelector(true)
ne = _ != code_block_2  # unwired: arg0
replaceByCondition_3 = Replace(replaceByCondition_2, boolean_2, ne)
mask = Output(replaceByCondition_3)
