# Dynamo custom node Dimension.MultiSegmentMembers.dyf (Dynamo 1.0.0.1180)
# category: Rhythm.Revit.Elements.Dimension
# This will output all of the members of a multi-segment dimension.

multiSegmentDimension = Input()
code_block = CodeBlock(item=multiSegmentDimension) { Flatten({item}); }
python_script = Python(IN[0]=code_block)
# ---------- python_script.python (16 lines) ----------
import clr
clr.AddReference('RevitAPI')
from Autodesk.Revit.DB import *

clr.AddReference("RevitNodes")
import Revit
clr.ImportExtensions(Revit.Elements)

items = UnwrapElement(IN[0])
elementlist = list()
for item in items:
	try:
		elementlist.append(item.Segments)
	except:
		unmatched.append(item)
OUT = elementlist
# ----------------------------------------
dimensionSegments = Output(python_script)
