# Dynamo custom node Dimension.NumberOfSegments.dyf (Dynamo 1.0.0.1180)
# category: Rhythm.Revit.Elements.Dimension
# This will return the number of segments a dimension has. If it is a single dimension, this will return zero.

dimension = Input()
code_block = CodeBlock(item=dimension) { Flatten({item}); }
python_script = Python(IN[0]=code_block)
# ---------- python_script.python (25 lines) ----------
import clr
clr.AddReference('RevitAPI')
from Autodesk.Revit.DB import *

clr.AddReference("RevitNodes")
import Revit
clr.ImportExtensions(Revit.GeometryConversion)

clr.AddReference("RevitServices")
import RevitServices
from RevitServices.Persistence import DocumentManager
from RevitServices.Transactions import TransactionManager

doc = DocumentManager.Instance.CurrentDBDocument

items = UnwrapElement(IN[0])
elementlist = list()
TransactionManager.Instance.EnsureInTransaction(doc)
for item in items:
	try:
		elementlist.append(item.NumberOfSegments)
	except:
		elementlist.append(list())
TransactionManager.Instance.TransactionTaskDone()
OUT = elementlist
# ----------------------------------------
numberOfSegments = Output(python_script)
