# Dynamo custom node Dimension.SetPrefix.dyf (Dynamo 1.1.0.2065)
# category: Rhythm.Revit.Elements.Dimension
# Sets the prefix value of the dimensions.

dimension = Input()
code_block = CodeBlock(item=dimension) { Flatten({item}); }
prefix = Input()
code_block_2 = CodeBlock(item=prefix) { Flatten({item}); }
code_block_3 = CodeBlock(seq1=code_block, seq2=code_block_2)
# ---------- code_block_3.designscript (4 lines) ----------
num = List.Count(seq1);
cond = List.Count(seq2) < 2 && num > 1;
repseq = List.OfRepeatedItem(seq2[0],num);
cond ? repseq : seq2;
# ----------------------------------------
python_script = Python(IN[0]=code_block, IN[1]=code_block_3.out3)
# ---------- python_script.python (31 lines) ----------
import clr
clr.AddReference('RevitAPI')
from Autodesk.Revit.DB import *

clr.AddReference("RevitNodes")
import Revit
clr.ImportExtensions(Revit.Elements)

clr.AddReference("RevitServices")
import RevitServices
from RevitServices.Persistence import DocumentManager
from RevitServices.Transactions import TransactionManager

doc = DocumentManager.Instance.CurrentDBDocument
items = UnwrapElement(IN[0])
names = IN[1]
goodlist = list()
badlist = list()
counter = 0

TransactionManager.Instance.EnsureInTransaction(doc)
while counter < len(items):
	try:
		items[counter].Prefix = names[counter]
		goodlist.append(items[counter])
	except:
		badlist.append(items[counter])
	counter += 1
TransactionManager.Instance.TransactionTaskDone()

OUT = (goodlist,badlist)
# ----------------------------------------
code_block_4 = CodeBlock(x=python_script) { x[0]; x[1]; }
code_block_5 = CodeBlock(set=code_block_4.out0) { set; }
code_block_6 = CodeBlock(notSet=code_block_4.out1) { notSet; }
