# Dynamo custom node Dimension.UsesProjectSettings.dyf (Dynamo 1.3.0.875)
# category: Rhythm.Revit.Elements.Dimension
# This will determine if a dimension uses project settings.

dimension = Input()
code_block = CodeBlock(item=dimension) { Flatten({item}); }
type = Custom[Element.Type](element=code_block)  # This retrieves the element type of the given elements. (if available) Similar to others available but no python here.
python_script = Python(IN[0]=type)
# ---------- python_script.python (67 lines) ----------
#Copyright(c) 2017, john pierson
# @60secondrevit, http://sixtysecondrevit.com
import clr
clr.AddReference('ProtoGeometry')
from Autodesk.DesignScript.Geometry import *

# Import ToDSType(bool) extension method
clr.AddReference("RevitNodes")
import Revit
clr.ImportExtensions(Revit.Elements)

# Import DocumentManager and TransactionManager
clr.AddReference("RevitServices")
import RevitServices
from RevitServices.Persistence import DocumentManager
from RevitServices.Transactions import TransactionManager

from System.Collections.Generic import *

# Import RevitAPI
clr.AddReference("RevitAPI")
import Autodesk
#Custom flatten definition to manage lists in here
def flatten(*args):
    for x in args:
        if hasattr(x, '__iter__'):
            for y in flatten(*x):
                yield y
        else:
            yield x
            

doc = DocumentManager.Instance.CurrentDBDocument
uiapp = DocumentManager.Instance.CurrentUIApplication
app = uiapp.Application

#The inputs to this node will be stored as a list in the IN variable.
dataEnteringNode = IN

#unwrap all elements to use with API
dims = UnwrapElement(IN[0])
TransactionManager.Instance.EnsureInTransaction(doc)
#apply lineweight override to elements in an input list
formatOptions = list()
valueList = list()
colorList = list()
for i in dims:
	try:
		formatOptions.append(i.GetUnitsFormatOptions())		
	except:
		formatOptions.append(list())


for i in formatOptions:
	
	try:
		i.DisplayUnits
		valueList.append(True)
	except:
		valueList.append(False)


# "End" the transaction
TransactionManager.Instance.TransactionTaskDone()

#Assign your output to the OUT variable
OUT = valueList
# ----------------------------------------
filterByBoolMask = List.FilterByBoolMask(list=code_block, mask=python_script)
usesProjectSettings = Output(filterByBoolMask.out)
overriddenSettings = Output(filterByBoolMask.in)
