# Dynamo custom node Dimension.Value.dyf (Dynamo 1.0.0.1180)
# category: Rhythm.Revit.Elements.Dimension
# This will return the dimension value.

dimension = Input()
code_block = CodeBlock(item=dimension) { Flatten({item}); }
python_script = Python(IN[0]=code_block)
# ---------- python_script.python (25 lines) ----------
import clr
clr.AddReference('RevitAPI')
from Autodesk.Revit.DB import *

clr.AddReference("RevitNodes")
import Revit
clr.ImportExtensions(Revit.GeometryConversion)

clr.AddReference("RevitServices")
import RevitServices
from RevitServices.Persistence import DocumentManager
from RevitServices.Transactions import TransactionManager

doc = DocumentManager.Instance.CurrentDBDocument

items = UnwrapElement(IN[0])
elementlist = list()
TransactionManager.Instance.EnsureInTransaction(doc)
for item in items:
	try:
		elementlist.append(item.Value)
	except:
		elementlist.append(list())
TransactionManager.Instance.TransactionTaskDone()
OUT = elementlist
# ----------------------------------------
value = Output(python_script)
