# Dynamo custom node Document.Close.dyf (Dynamo 1.2.1.3083)
# category: Rhythm.Revit.Application.Document
# This will close the input Revit document. Offers a boolean toggle to save.

string = StringInput("[] File(s) Closed")
string_2 = StringInput("[]")
document = Input()
code_block = CodeBlock(item=document) { Flatten({item}); }
save = Input(save : bool = false)  # If you want to save the files, use true. By default they will not save.
close_files = Python(IN[0]=code_block, IN[1]=save)
# ---------- close_files.python (39 lines) ----------
#Copyright(c) 2017, john pierson
# @60secondrevit, http://sixtysecondrevit.com
import clr
clr.AddReference('ProtoGeometry')
from Autodesk.DesignScript.Geometry import *

# Import Element wrapper extension methods
clr.AddReference("RevitNodes")
import Revit
clr.ImportExtensions(Revit.Elements)

# Import geometry conversion extension methods
clr.ImportExtensions(Revit.GeometryConversion)

# Import DocumentManager and TransactionManager
clr.AddReference("RevitServices")
import RevitServices
from RevitServices.Persistence import DocumentManager
from RevitServices.Transactions import TransactionManager

doc = DocumentManager.Instance.CurrentDBDocument
uiapp = DocumentManager.Instance.CurrentUIApplication
app = uiapp.Application

# Import RevitAPI
clr.AddReference("RevitAPI")
import Autodesk
from Autodesk.Revit.DB import *

items = IN[0]

typelist = list()
for i in items:
	try:
		typelist.append(i.Close(IN[1]))
	except:
		typelist.append(list())
		
OUT = typelist
# ----------------------------------------
countTrue = CountTrue(close_files)
string_from_object = FromObject(countTrue)
replace = String.Replace(str=string, searchFor=string_2, replaceWith=string_from_object)
closed = Output(replace)
