# Dynamo custom node Document.SetStartingView.dyf (Dynamo 1.2.1.3083)
# category: Rhythm.Revit.Application.Document
# This will set the starting view for a given document. ONLY WORKS IN ONE DOCUMENT AT A TIME

document = Input()
firstItem = List.FirstItem(document)
view = Input()
code_block = CodeBlock(item=view) { Flatten({item}); }
python_script = Python(IN[0]=code_block)
# ---------- python_script.python (21 lines) ----------
#Copyright(c) 2017, john pierson
# @60secondrevit, http://sixtysecondrevit.com
import clr
clr.AddReference('ProtoGeometry')
from Autodesk.DesignScript.Geometry import *
# Import RevitAPI
clr.AddReference('RevitAPI')
import Autodesk
#The inputs to this node will be stored as a list in the IN variable.
dataEnteringNode = IN

elements = []
for i in IN[0]:
    elements.append(UnwrapElement(i))

elementId = []
for i in elements:
    elementId.append(i.Id)
    
#Assign your output to the OUT variable
OUT = elementId
# ----------------------------------------
code_block_2 = CodeBlock(x=python_script) { x[0]; }
python_script_2 = Python(IN[0]=firstItem, IN[1]=code_block_2)
# ---------- python_script_2.python (20 lines) ----------
#Copyright(c) 2017, john pierson
# @60secondrevit, http://sixtysecondrevit.com
import clr
clr.AddReference('RevitAPI')
from Autodesk.Revit.DB import *

clr.AddReference("RevitNodes")
import Revit
clr.ImportExtensions(Revit.Elements)

clr.AddReference("RevitServices")
import RevitServices
from RevitServices.Persistence import DocumentManager
from RevitServices.Transactions import TransactionManager

doc = IN[0]
view = IN[1]
TransactionManager.Instance.EnsureInTransaction(doc)
OUT = (StartingViewSettings.GetStartingViewSettings(doc).ViewId) = view
TransactionManager.Instance.TransactionTaskDone()
# ----------------------------------------
viewId = Output(python_script_2)
