# Dynamo custom node DraftingView.CreateInDocument.dyf (Dynamo 1.2.1.3083)
# category: Rhythm.Revit.Views.DraftingView
# This will create a new drafting view in the given document. ONLY WORKS FOR ONE DOCUMENT AT A TIME

document = Input()
firstItem = List.FirstItem(document)
python_script = Python(IN[0]=firstItem)
# ---------- python_script.python (38 lines) ----------
#created for Dynamo by john pierson. based on nodes from the great Dimitar Venkov and Andreas Dieckmann
import clr
clr.AddReference('ProtoGeometry')
from Autodesk.DesignScript.Geometry import *

# Import RevitAPI
clr.AddReference("RevitAPI")
import Autodesk
from Autodesk.Revit.DB import *
from Autodesk.Revit.DB.Analysis import *

# Import DocumentManager and TransactionManager
clr.AddReference("RevitServices")
import RevitServices
from RevitServices.Persistence import DocumentManager
from RevitServices.Transactions import TransactionManager

clr.AddReference("RevitNodes")
import Revit
clr.ImportExtensions(Revit.Elements)
clr.ImportExtensions(Revit.GeometryConversion)

doc = IN[0]
viewFamilyType = FilteredElementCollector(doc).OfClass((ViewFamilyType))

#The inputs to this node will be stored as a list in the IN variables.
dataEnteringNode = IN

typelist = list()
for v in viewFamilyType:
	try:
		typelist.append(v.ViewFamily)
	except:
		typelist.append(list())


#Assign your output to the OUT variable.
OUT = viewFamilyType,typelist
# ----------------------------------------
flatten = Flatten(python_script)
code_block = CodeBlock(x=python_script) { x[1]; }
string_from_object = FromObject(code_block)
code_block_2 = CodeBlock { "Drafting"; }
eq = string_from_object == code_block_2
filterByBoolMask = List.FilterByBoolMask(list=flatten, mask=eq)
python_script_2 = Python(IN[0]=filterByBoolMask.in)
# ---------- python_script_2.python (19 lines) ----------
import clr
clr.AddReference('ProtoGeometry')
from Autodesk.DesignScript.Geometry import *
# Import RevitAPI
clr.AddReference('RevitAPI')
import Autodesk
#The inputs to this node will be stored as a list in the IN variable.
dataEnteringNode = IN

elements = []
for i in IN[0]:
    elements.append(UnwrapElement(i))

elementId = []
for i in elements:
    elementId.append(i.Id)
    
#Assign your output to the OUT variable
OUT = elementId
# ----------------------------------------
firstItem_2 = List.FirstItem(python_script_2)
python_script_3 = Python(IN[0]=firstItem, IN[1]=firstItem_2)
# ---------- python_script_3.python (30 lines) ----------
#created for Dynamo by john pierson. based on nodes from the great Dimitar Venkov and Andreas Dieckmann
import clr
clr.AddReference('ProtoGeometry')
from Autodesk.DesignScript.Geometry import *

# Import RevitAPI
clr.AddReference("RevitAPI")
import Autodesk
from Autodesk.Revit.DB import *
from Autodesk.Revit.DB.Analysis import *

# Import DocumentManager and TransactionManager
clr.AddReference("RevitServices")
import RevitServices
from RevitServices.Persistence import DocumentManager
from RevitServices.Transactions import TransactionManager

clr.AddReference("RevitNodes")
import Revit
clr.ImportExtensions(Revit.Elements)
clr.ImportExtensions(Revit.GeometryConversion)

doc = IN[0]
viewFamilyType = IN[1]


#Assign your output to the OUT variable.
TransactionManager.Instance.EnsureInTransaction(doc)
OUT = ViewDrafting.Create(doc,viewFamilyType)
TransactionManager.Instance.TransactionTaskDone()
# ----------------------------------------
draftingView = Output(python_script_3)
