# Dynamo custom node Element.AreaLocation.dyf (Dynamo 0.9.1.4062)
# category: Rhythm.Revit.Elements.Element
# This node will determine what area (area plans) an element is located within. Made possible thanks to clockwork. :)

categories = Categories("Areas")
all_elements_of_category = ElementsOfCategory(categories)
RunMe = Input(RunMe : bool = false)  # This is a toggle. Use a boolean to make this node run.
toggle = Custom[Rhythm.Toggle](list=all_elements_of_category, boolean=RunMe)  # Toggle that offers two outputs. Created for Dynamo 0.8.1 because of changes to the "IF" node

# group: Room.Boundaries from Clockwork. All credit goes to Andreas Dieckmann.
code_block = CodeBlock(item=toggle.in) { Flatten({item}); }
python_script = Python(IN[0]=code_block)
# ---------- python_script.python (42 lines) ----------
import clr
clr.AddReference('RevitAPI')
from Autodesk.Revit.DB import *
import Autodesk

clr.AddReference("RevitNodes")
import Revit
clr.ImportExtensions(Revit.GeometryConversion)

items = UnwrapElement(IN[0])
elementlist = list()
curvelist = list()

for item in items:
	doc = item.Document
	calculator = SpatialElementGeometryCalculator(doc)
	options = Autodesk.Revit.DB.SpatialElementBoundaryOptions()
	# get boundary location from area computation settings
	boundloc = Autodesk.Revit.DB.AreaVolumeSettings.GetAreaVolumeSettings(doc).GetSpatialElementBoundaryLocation(SpatialElementType.Room)
	options.SpatialElementBoundaryLocation = boundloc
	#method #1 - get boundary segments
	blist = list()
	clist = list()
	try:
		for boundarylist in item.GetBoundarySegments(options):
			for boundary in boundarylist:
				blist.append(boundary.Element)
				clist.append(boundary.Curve.ToProtoType())
	except:
		pass
	#method #2 - spatial element geometry calculator
	try:
		results = calculator.CalculateSpatialElementGeometry(item)
		for face in results.GetGeometry().Faces:
			for bface in results.GetBoundaryFaceInfo(face):
				blist.append(doc.GetElement(bface.SpatialBoundaryElement.HostElementId))
	except:
		pass	
	# write results to list
	elementlist.append(blist)
	curvelist.append(clist)
OUT = (elementlist,curvelist)
# ----------------------------------------
code_block_2 = CodeBlock(boundaries=python_script) { boundaries[1]; }

byJoinedCurves = PolyCurve.ByJoinedCurves(code_block_2)
code_block_3 = CodeBlock { 0..1..#100; }
pointAtParameter = Curve.PointAtParameter(curve=byJoinedCurves, param=code_block_3, lacing=CrossProduct)
byPoints = Polygon.ByPoints(pointAtParameter)
element = Input()

# group: Element.Location from Clockwork. All credit goes to Andreas Dieckmann
code_block_4 = CodeBlock(item=element) { Flatten({item}); }
python_script_2 = Python(IN[0]=code_block_4)
# ---------- python_script_2.python (58 lines) ----------
import clr
clr.AddReference('RevitAPI')
from Autodesk.Revit.DB import *

clr.AddReference("RevitNodes")
import Revit
clr.ImportExtensions(Revit.GeometryConversion)

items = UnwrapElement(IN[0])
pointlist = list()
curvepointlist = list()
ispoint = list()
iscurve = list()
curves = list()
haslocation = list()

for item in items:
	try:
		# points and text notes
		pointlist.append(item.Coord.ToPoint())
		ispoint.append(True)
		iscurve.append(False)
		haslocation.append(True)
	except:
		try:
			loc = item.Location
			if loc.ToString() == 'Autodesk.Revit.DB.LocationCurve':
				# line-based elements (e.g. walls)
				curvepoints = (loc.Curve.GetEndPoint(0).ToPoint(),loc.Curve.GetEndPoint(1).ToPoint())
				curvepointlist.append(curvepoints)
				curves.append(loc.Curve.ToProtoType())
				ispoint.append(False)
				iscurve.append(True)
				haslocation.append(True)
			elif loc.ToString() == 'Autodesk.Revit.DB.LocationPoint':
				# point-based elements
				pointlist.append(loc.Point.ToPoint())
				ispoint.append(True)
				iscurve.append(False)
				haslocation.append(True)
			else:
				ispoint.append(False)
				iscurve.append(False)
				haslocation.append(False)
		except:
			try:
				# curves
				curvepoints = (item.GetEndPoint(0).ToPoint(),item.GetEndPoint(1).ToPoint())
				curvepointlist.append(curvepoints)
				curves.append(item.ToProtoType())
				ispoint.append(False)
				iscurve.append(True)
				haslocation.append(True)
			except:
				ispoint.append(False)
				iscurve.append(False)
				haslocation.append(False)
OUT = (pointlist,curvepointlist,curves,ispoint,iscurve,haslocation)
# ----------------------------------------
code_block_5 = CodeBlock(point=python_script_2) { point[0]; }

containmentTest = Polygon.ContainmentTest(byPoints, code_block_5, lacing=Longest)
filterByBoolMask = List.FilterByBoolMask(list=toggle.in, mask=containmentTest)
area_location = Output(filterByBoolMask.in)
