# Dynamo custom node Element.AreaWithTotal.dyf (Dynamo 0.8.2.2392)
# category: Rhythm.Revit.Elements.Element.Query
# This will get the area of an element if the parameter exists. Will total as well if needed.

element = Input()
flatten = Flatten(element)
code_block = CodeBlock { "Area"; }
getParameterValueByName = Element.GetParameterValueByName(element=flatten, parameterName=code_block)
sum = Math.Sum(getParameterValueByName)
result = Output(sum)
