# Dynamo custom node Element.Category.dyf (Dynamo 0.9.0.3067)
# category: Rhythm.Revit.Elements.Element.Query
# This node will get the input element(s)' categories

element = Input(element : Element)
parameters = Element.Parameters(element)
string_from_object = FromObject(parameters)
code_block = CodeBlock { "Category :"; }
contains = String.Contains(str=string_from_object, searchFor=code_block)
filterByBoolMask = List.FilterByBoolMask(list=string_from_object, mask=contains)
code_block_2 = CodeBlock { 0; }
getItemAtIndex = List.GetItemAtIndex(index=code_block_2)
map = List.Map(list=filterByBoolMask.in, f_x=getItemAtIndex)
code_block_3 = CodeBlock { " : "; }
split = String.Split(map, code_block_3)
code_block_4 = CodeBlock { 1; }
getItemAtIndex_2 = List.GetItemAtIndex(index=code_block_4)
map_2 = List.Map(list=split, f_x=getItemAtIndex_2)
trimWhitespace = String.TrimWhitespace(map_2)
uniqueItems = List.UniqueItems(trimWhitespace)
clean = Custom[Output.Clean](input=uniqueItems)  # This will return a single value or list from one input.
str = Output(clean)
