# Dynamo custom node Element.CopyFromDocument.dyf (Dynamo 1.2.0.2690)
# category: Rhythm.Revit.Elements.Element
# This node allows you to copy elements from a specific document to your current document.

elements = Input()  # The elements to be copied
code_block = CodeBlock(item=elements) { Flatten({item}); }
python_script = Python(IN[0]=code_block)
# ---------- python_script.python (17 lines) ----------
import clr
clr.AddReference('RevitAPI')
from Autodesk.Revit.DB import *

clr.AddReference("RevitNodes")
import Revit
clr.ImportExtensions(Revit.Elements)

items = UnwrapElement(IN[0])
elementlist = list()
booleans = list()
for item in items:
	try:
		elementlist.append(item.Id)
	except:
		elementlist.append(None)
OUT = elementlist
# ----------------------------------------
document = Input()  # The document you are copying from.
python_script_2 = Python(IN[0]=python_script, IN[1]=document)
# ---------- python_script_2.python (33 lines) ----------
#Based on a node originally from Dimitar Venkov
import clr

clr.AddReference("RevitServices")
import RevitServices
from RevitServices.Persistence import DocumentManager
from RevitServices.Transactions import TransactionManager
doc = DocumentManager.Instance.CurrentDBDocument
doc1 = DocumentManager.Instance.CurrentDBDocument

clr.AddReference("RevitNodes")
import Revit
clr.ImportExtensions(Revit.Elements)
clr.ImportExtensions(Revit.GeometryConversion)

clr.AddReference("RevitAPI")
from Autodesk.Revit.DB import *

from System.Collections.Generic import*


ele = List[ElementId](IN[0])
link1 = IN[1]

try:
	TransactionManager.Instance.EnsureInTransaction(doc)
	newId = ElementTransformUtils.CopyElements(link1, ele, doc1, None, CopyPasteOptions() )
	TransactionManager.Instance.TransactionTaskDone()
	res1 = [doc.GetElement(newId[i]).ToDSType(False) for i in xrange(len(newId) )]
except: 	
	res1 = 'The process failed. If you are copying from more than one document, change the lacing to longest.'

OUT = res1
# ----------------------------------------
copied = Output(python_script_2)
