# Dynamo custom node Element.CopyFromViewToView.dyf (Dynamo 1.2.1.3083)
# category: Rhythm.Revit.Elements.Element
# This will copy elements from view to view.

elements = Input()  # provide your elements from the source view
code_block = CodeBlock(item=elements) { DSCore.List.Flatten({item},-1); }
python_script = Python(IN[0]=code_block)
# ---------- python_script.python (17 lines) ----------
import clr
clr.AddReference('RevitAPI')
from Autodesk.Revit.DB import *

clr.AddReference("RevitNodes")
import Revit
clr.ImportExtensions(Revit.Elements)

items = UnwrapElement(IN[0])
elementlist = list()
booleans = list()
for item in items:
	try:
		elementlist.append(item.Id)
	except:
		elementlist.append(None)
OUT = elementlist
# ----------------------------------------
sourceView = Input()
destinationView = Input()
code_block_2 = CodeBlock(sourceView=sourceView, destView=destinationView)
# ---------- code_block_2.designscript (4 lines) ----------
//The view you are copying from.
sourceView;
//View you are cpying to
destView;
# ----------------------------------------
python_script_2 = Python(IN[0]=python_script, IN[1]=code_block_2.sourceView, IN[2]=code_block_2.destView)
# ---------- python_script_2.python (37 lines) ----------
#Based on a node originally from Dimitar Venkov
import clr

clr.AddReference("RevitServices")
import RevitServices
from RevitServices.Persistence import DocumentManager
from RevitServices.Transactions import TransactionManager
doc = DocumentManager.Instance.CurrentDBDocument
doc1 = DocumentManager.Instance.CurrentDBDocument

clr.AddReference("RevitNodes")
import Revit
clr.ImportExtensions(Revit.Elements)
clr.ImportExtensions(Revit.GeometryConversion)

clr.AddReference("RevitAPI")
from Autodesk.Revit.DB import *

from System.Collections.Generic import*


ele = List[ElementId](IN[0])
sourceView = UnwrapElement(IN[1])
destView = UnwrapElement(IN[2])

try:

	newId = ElementTransformUtils.CopyElements(sourceView, ele, destView, None, CopyPasteOptions() )

	res1 = [doc.GetElement(newId[i]).ToDSType(False) for i in xrange(len(newId) )]
except: 	
	TransactionManager.Instance.EnsureInTransaction(doc)
	newId = ElementTransformUtils.CopyElements(sourceView, ele, destView, None, CopyPasteOptions() )

	res1 = [doc.GetElement(newId[i]).ToDSType(False) for i in xrange(len(newId) )]

OUT = res1
# ----------------------------------------
elements_2 = Output(python_script_2)  # "elements"
