# Dynamo custom node Element.GetLevelNameAsString.dyf (Dynamo 0.8.1.1823)
# category: Rhythm.Revit.Elements.Element.Actions
# This retrieves the level name of the input elements as a string. This is in response to a known issue with the get value node.

element_s = Input()  # "element(s)"
code_block = CodeBlock { "Level"; }
getParameterValueByNameAsString = Custom[GetParameterValueByNameAsString](Element_s=element_s, Parameter_Name=code_block)  # Returns paramter value as string. Same effect as lunchbox node, without python.
code_block_2 = CodeBlock { "="; true; }
removePriorToCharacter = Custom[String.RemovePriorToCharacter](str=getParameterValueByNameAsString, Character=code_block_2.out0, ignoreCase=code_block_2.out1)  # This will remove all characters prior to the input character. Accepts strings.
code_block_3 = CodeBlock { ","; true; }
removeAfterGivenCharacter = Custom[String.RemoveAfterGivenCharacter](str=removePriorToCharacter, Character=code_block_3.out0, ignoreCase=code_block_3.out1)  # This will move all characters at and after the given character.
code_block_4 = CodeBlock { null; }
containsItem = List.ContainsItem(list=removeAfterGivenCharacter, item=code_block_4)
code_block_5 = CodeBlock { "ToBeReplaced"; }
isNull = Object.IsNull()
replaceByCondition = Replace(removeAfterGivenCharacter, code_block_5, isNull)
code_block_6 = CodeBlock { null; }
getItemIndices = Custom[List.GetItemIndices](List=removeAfterGivenCharacter, Item=code_block_6)  # This node searches the input list for the given string or number.
getItemAtIndex = List.GetItemAtIndex(list=removePriorToCharacter, index=getItemIndices)
replace = String.Replace(str=replaceByCondition, searchFor=code_block_5, replaceWith=getItemAtIndex, lacing=Longest)
if_ = If(test=containsItem, true=replace, false=removeAfterGivenCharacter)
Level_Name = Output(if_)
