# Dynamo custom node Element.GetMultipleParameterValuesByName.dyf (Dynamo 1.0.0.1180)
# category: Rhythm.Revit.Elements.Element.Actions
# Get the value of multiple parameters from elements. (Seperate parameters with comma)

parameterNames = Input(parameterNames : string)  # parameter names (comma separated)
code_block = CodeBlock { ","; }
split = String.Split(parameterNames, code_block)
parameterNames_2 = Output(split)  # "parameterNames"
element = Input(element : Element)  # Element's to pull parameter value from
flatten = Flatten(split)
code_block_2 = CodeBlock(in1=element, in2=flatten) { in1<1>.GetParameterValueByName(in2<2>); }
var = Output(code_block_2)  # "var[]..[]"
