# Dynamo custom node Element.GetParameterValueByName(CaSe iNSeNSiTive).dyf (Dynamo 1.0.0.1180)
# category: Rhythm.Revit.Elements.Element
# Get the value of one of the element's parameters. (CaSe iNSeNSiTiVe)

# group: The comment has come up regarding the get parameter value by name node requiring a case sensitive search. If you see below we have had all of the nodes to fix this all along!
element = Input(element : Element)
parameterName = Input(parameterName : string)  # the name of the parameter whose value you want to obtain

# group: This retireves all of the elements parameters.
parameters = Element.Parameters(element)
name = Parameter.Name(parameters)

# group: This matches your input parameter to the queried values
toLower = String.ToLower(name)
toLower_2 = String.ToLower(parameterName)
eq = toLower == toLower_2
filterByBoolMask = List.FilterByBoolMask(list=name, mask=eq)
uniqueItems = List.UniqueItems(filterByBoolMask.in)
getParameterValueByName = Element.GetParameterValueByName(element=element, parameterName=uniqueItems)

clean = Custom[Output.Clean](input=getParameterValueByName)  # This will return a single value or list from one input.

# group (continued): The comment has come up regarding the get parameter value by name node requiring a case sensitive search. If you see below we have had all of the nodes to fix this all along!
Element = Output(clean)
