# Dynamo custom node Element.IsPhaseCreatedValid.dyf (Dynamo 1.2.1.3083)
# category: Rhythm.Revit.Elements.Element
# This will determine if the input phase is the correct one for the input elements

elements = Input()
code_block = CodeBlock(item=elements) { Flatten({item}); }
phase = Input()
python_script = Python(IN[0]=code_block, IN[1]=phase)
# ---------- python_script.python (47 lines) ----------
#Created by DPS Design, dpsdesign.org
import clr
clr.AddReference('ProtoGeometry')
from Autodesk.DesignScript.Geometry import *

# Import ToDSType(bool) extension method
clr.AddReference("RevitNodes")
import Revit
clr.ImportExtensions(Revit.Elements)

# Import DocumentManager and TransactionManager
clr.AddReference("RevitServices")
import RevitServices
from RevitServices.Persistence import DocumentManager
from RevitServices.Transactions import TransactionManager

from System.Collections.Generic import *

# Import RevitAPI
clr.AddReference("RevitAPI")
import Autodesk

doc = DocumentManager.Instance.CurrentDBDocument
uiapp = DocumentManager.Instance.CurrentUIApplication
app = uiapp.Application

#The inputs to this node will be stored as a list in the IN variable.
dataEnteringNode = IN

#unwrap all elements to use with API
items = UnwrapElement(IN[0])
phase = UnwrapElement(IN[1])
TransactionManager.Instance.EnsureInTransaction(doc)
#apply lineweight override to elements in an input list
typelist = list()
for i in items:
	try:
		typelist.append(i.IsPhaseCreatedValid(phase.Id))
	except:
		typelist.append(i.IsPhaseCreatedValid())


# "End" the transaction
TransactionManager.Instance.TransactionTaskDone()

#Assign your output to the OUT variable
OUT = typelist
# ----------------------------------------
bool = Output(python_script)
