# Dynamo custom node Element.OverrideCutLineweight.dyf (Dynamo 1.2.1.3083)
# category: Rhythm.Revit.Elements.Element.Actions
# Overrides the cut lines of the elements

element = Input()
code_block = CodeBlock(item=element) { DSCore.List.Flatten({item},-1); }
number = Input(number : int)
python_script = Python(IN[0]=code_block, IN[1]=number)
# ---------- python_script.python (54 lines) ----------
#Copyright(c) 2017, john pierson
# @60secondrevit, http://sixtysecondrevit.com
import clr
clr.AddReference('ProtoGeometry')
from Autodesk.DesignScript.Geometry import *

# Import ToDSType(bool) extension method
clr.AddReference("RevitNodes")
import Revit
clr.ImportExtensions(Revit.Elements)

# Import DocumentManager and TransactionManager
clr.AddReference("RevitServices")
import RevitServices
from RevitServices.Persistence import DocumentManager
from RevitServices.Transactions import TransactionManager

from System.Collections.Generic import *

# Import RevitAPI
clr.AddReference("RevitAPI")
import Autodesk

doc = DocumentManager.Instance.CurrentDBDocument
uiapp = DocumentManager.Instance.CurrentUIApplication
app = uiapp.Application

#The inputs to this node will be stored as a list in the IN variable.
dataEnteringNode = IN

#unwrap all elements to use with API
elements = []
for i in IN[0]:
	elements.append(UnwrapElement(i))

#create graphic overrides properties
gSettings = Autodesk.Revit.DB.OverrideGraphicSettings()

#set Projection Line weight
gSettings.SetCutLineWeight(IN[1])

# "Start" the transaction
TransactionManager.Instance.EnsureInTransaction(doc)

#apply lineweight override to elements in an input list
for i in elements:
	id = i.Id
	doc.ActiveView.SetElementOverrides(id, gSettings)

# "End" the transaction
TransactionManager.Instance.TransactionTaskDone()

#Assign your output to the OUT variable
OUT = IN[0]
# ----------------------------------------
Element = Output(python_script)
