# Dynamo custom node Element.OverrideProjectionLineColor.dyf (Dynamo 1.3.2.2480)
# category: Rhythm.Revit.Elements.Element.Actions
# This node overrides the projection line color with the input color value. Useful for annotation.

element = Input()
code_block = CodeBlock(item=element) { DSCore.List.Flatten({item},-1); }
color = Input()
code_block_2 = CodeBlock(color=color) { color[0]; }
python_script = Python(IN[0]=code_block, IN[1]=code_block_2)
# ---------- python_script.python (59 lines) ----------
#Copyright(c) 2017, john pierson
# @60secondrevit, http://sixtysecondrevit.com
import clr
clr.AddReference('ProtoGeometry')
from Autodesk.DesignScript.Geometry import *

# Import ToDSType(bool) extension method
clr.AddReference("RevitNodes")
import Revit
clr.ImportExtensions(Revit.Elements)

# Import DocumentManager and TransactionManager
clr.AddReference("RevitServices")
import RevitServices
from RevitServices.Persistence import DocumentManager
from RevitServices.Transactions import TransactionManager

from System.Collections.Generic import *

# Import RevitAPI
clr.AddReference("RevitAPI")
import Autodesk

doc = DocumentManager.Instance.CurrentDBDocument
uiapp = DocumentManager.Instance.CurrentUIApplication
app = uiapp.Application

#The inputs to this node will be stored as a list in the IN variable.
dataEnteringNode = IN

#unwrap all elements to use with API
elements = []
for i in IN[0]:
	elements.append(UnwrapElement(i))

#create graphic overrides properties
gSettings = Autodesk.Revit.DB.OverrideGraphicSettings()
#deconstruct DS Color Object and convert to RevitAPI color
dsColor = IN[1]
colRed = dsColor.Red
colGreen = dsColor.Green
colBlue = dsColor.Blue
color = Autodesk.Revit.DB.Color(colRed, colGreen, colBlue)
#set Projection Line color
gSettings.SetProjectionLineColor(color)

# "Start" the transaction
TransactionManager.Instance.EnsureInTransaction(doc)

#apply color override to elements in an input list
for i in elements:
	id = i.Id
	doc.ActiveView.SetElementOverrides(id, gSettings)

# "End" the transaction
TransactionManager.Instance.TransactionTaskDone()

#Assign your output to the OUT variable
OUT = IN[0]
# ----------------------------------------
element_2 = Output(python_script)  # "element"
