# Dynamo custom node Element.OverrideProjectionLineweightInView.dyf (Dynamo 1.2.3.573)
# category: Rhythm.Revit.Elements.Element
# This will override a projection lineweight of an element in a given view.

element = Input()
lineweight = Input()
view = Input()
python_script = Python(IN[0]=element, IN[1]=lineweight, IN[2]=view)
# ---------- python_script.python (53 lines) ----------
#Copyright(c) 2016, John Pierson
# @60secondrevit, sixtysecondrevit@gmail.com
import clr
# Import ToDSType(bool) extension method
clr.AddReference("RevitNodes")
import Revit
clr.ImportExtensions(Revit.Elements)
# Import DocumentManager and TransactionManager
clr.AddReference("RevitServices")
import RevitServices
from RevitServices.Persistence import DocumentManager
from RevitServices.Transactions import TransactionManager

from System.Collections.Generic import *

# Import RevitAPI
clr.AddReference("RevitAPI")
import Autodesk

doc = DocumentManager.Instance.CurrentDBDocument
uiapp = DocumentManager.Instance.CurrentUIApplication
app = uiapp.Application

#The inputs to this node will be stored as a list in the IN variable.
dataEnteringNode = IN

#unwrap all elements to use with API
elements = []
for i in IN[0]:
	elements.append(UnwrapElement(i))

#create graphic overrides properties
gSettings = Autodesk.Revit.DB.OverrideGraphicSettings()

#set Projection Line weight
gSettings.SetProjectionLineWeight(IN[1])

views = UnwrapElement(IN[2])

# "Start" the transaction
TransactionManager.Instance.EnsureInTransaction(doc)

#apply lineweight override to elements in an input list
for i in elements:
	id = i.Id
	for j in views:
		j.SetElementOverrides(id, gSettings)

# "End" the transaction
TransactionManager.Instance.TransactionTaskDone()

#Assign your output to the OUT variable
OUT = IN[0]
# ----------------------------------------
element_2 = Output(python_script)  # "element"
