# Dynamo custom node Element.Room.dyf (Dynamo 1.2.1.3083)
# category: Rhythm.Revit.Elements.Element.Query
# This node takes the input of all elements of category and reports back the associated room per element. Currently tested with casework, furniture and plumbing fixtures.

element = Input()
code_block = CodeBlock(item=element) { Flatten({item}); }
python_script = Python(IN[0]=code_block)
# ---------- python_script.python (47 lines) ----------
#Copyright(c) 2017, john pierson
# @60secondrevit, http://sixtysecondrevit.com
import clr
# Import RevitAPI
clr.AddReference("RevitAPI")
import Autodesk
from Autodesk.Revit.DB import *

# Import DocumentManager and TransactionManager
clr.AddReference("RevitServices")
import RevitServices
from RevitServices.Persistence import DocumentManager
from RevitServices.Transactions import TransactionManager

# Import ToDSType(bool) extension method
clr.AddReference("RevitNodes")
import Revit
clr.ImportExtensions(Revit.Elements)

# Start Transaction
doc = DocumentManager.Instance.CurrentDBDocument
TransactionManager.Instance.EnsureInTransaction(doc)

#Declare list variables
Room = []
elements = []

#unwrap inputs
for i in IN[0]:
	elements.append(UnwrapElement(i))

#List the "Room" for all phases
for i in elements:
	for phase in doc.Phases:
		if i.CreatedPhaseId == phase.Id:
			try:
				room = i.Room[phase]
				Room.append(room)
			except:
				Room.append(None)
				continue			

# End Transaction
TransactionManager.Instance.TransactionTaskDone()

#Assign your output to the OUT variable
OUT = Room
# ----------------------------------------
room = Output(python_script)
