# Dynamo custom node Element.SetMultipleParametersByName.dyf (Dynamo 0.8.1.1823)
# category: Rhythm.Revit.Elements.Element
# Set multiple (comma seperated) parameters by name.

element = Input(element : var[]..[])
parameterName = Input(parameterName : string)
code_block = CodeBlock { ","; }
split = String.Split(parameterName, code_block)
value = Input(value : var[]..[])
code_block_2 = CodeBlock(el1=element, n1=split, val1=value) { el1<1>.SetParameterByName({n1}<2>,val1<1><2>); }
flatten = Flatten(code_block_2)
Output = Output(flatten)  # ""
