# Dynamo custom node Element.SetParameterByName(CaSe iNSeNSiTiVe).dyf (Dynamo 1.2.1.3083)
# category: Rhythm.Revit.Elements.Element
# Set one of the element's parameters. (CaSe iNSeNSiTiVe)

# group: The comment has come up regarding the get parameter value by name node requiring a case sensitive search. If you see below we have had all of the nodes to fix this all along!
case_insensitive = CodeBlock()  # //in around 10 nodes                                                          //

element = Input()

# group: This retireves all of the elements parameters.
parameters = Element.Parameters(element)
name = Parameter.Name(parameters)

parameterName = Input(parameterName : string)
code_block = CodeBlock { 0; }
value = Input(value : var)

# group: This matches your input parameter to the queried values
toLower = String.ToLower(name)
toLower_2 = String.ToLower(parameterName)
eq = toLower == toLower_2
filterByBoolMask = List.FilterByBoolMask(list=name, mask=eq)

getItemAtIndex = List.GetItemAtIndex(list=filterByBoolMask.in, index=code_block, lacing=Longest)

# group (continued): This matches your input parameter to the queried values
setParameterByName = Element.SetParameterByName(element=element, parameterName=getItemAtIndex, value=value)

clean = Custom[Output.Clean](input=setParameterByName)  # This will return a single value or list from one input.
Element = Output(clean)
