# Dynamo custom node Element.SetPinnedStatus.dyf (Dynamo 0.9.0.3067)
# category: Rhythm.Revit.Element.Elements.Actions
# Will set the element to either pinned or not pinned. True is pinned, false is unpinned. For multiple elements use List.Map

Element = Input()
Bool = Input(Bool : bool=false)
python_script = Python(IN[0]=Element, IN[1]=Bool)
# ---------- python_script.python (40 lines) ----------
#Created by DPS Design, dpsdesign.org
import clr
clr.AddReference('ProtoGeometry')
from Autodesk.DesignScript.Geometry import *

# Import ToDSType(bool) extension method
clr.AddReference("RevitNodes")
import Revit
clr.ImportExtensions(Revit.Elements)

# Import DocumentManager and TransactionManager
clr.AddReference("RevitServices")
import RevitServices
from RevitServices.Persistence import DocumentManager
from RevitServices.Transactions import TransactionManager

from System.Collections.Generic import *

# Import RevitAPI
clr.AddReference("RevitAPI")
import Autodesk

doc = DocumentManager.Instance.CurrentDBDocument
uiapp = DocumentManager.Instance.CurrentUIApplication
app = uiapp.Application

#The inputs to this node will be stored as a list in the IN variable.
dataEnteringNode = IN

#unwrap all elements to use with API
i = UnwrapElement(IN[0])
TransactionManager.Instance.EnsureInTransaction(doc)
#apply lineweight override to elements in an input list
i.Pinned = IN[1]

# "End" the transaction
TransactionManager.Instance.TransactionTaskDone()

#Assign your output to the OUT variable
OUT = []
# ----------------------------------------
OUT = Output(python_script)
