# Dynamo custom node Element.Type.dyf (Dynamo 0.8.2.2392)
# category: Rhythm.Revit.Elements.Element.Query
# This retrieves the element type of the given elements. (if available) Similar to others available but no python here.

element_s = Input()  # "element(s)"
code_block = CodeBlock { "Type"; }
getParameterValueByName = Element.GetParameterValueByName(element=element_s, parameterName=code_block)
clean = Custom[Output.Clean](input=getParameterValueByName)  # This will return a single value or list from one input.
elementType_s = Output(clean)  # "elementType(s)"
