# Dynamo custom node Geometry.SpaceEvenlyWithBuffer.dyf (Dynamo 1.2.1.3083)
# category: Rhythm.Geometry.Geometry.Actions
# This will take input geometry and space it out in the Y direction with a buffer between

geometry = Input()
code_block = CodeBlock(geometry=geometry) { geometry.Width; }
code_block_2 = CodeBlock(areas=code_block) { areas; }
getKeys = GetKeys(code_block_2)
restOfItems = List.RestOfItems(getKeys)
returnItemsPreviousToIndex = Custom[List.ReturnItemsPreviousToIndex](list=code_block_2, index=restOfItems)  # This will take an index (or indices) and return the items previous to it. Useful for sums of all items previous.

# group: Sums the previous items in the list for the initial spacing
sum = Math.Sum(returnItemsPreviousToIndex)
code_block_3 = CodeBlock(x=sum) { Flatten({0,x}); }

buffer = Input(buffer : int = 0)

# group: This applies the spacing between rectangles
getKeys_2 = GetKeys(code_block_3)
mul = getKeys_2 * buffer
add = code_block_3 + mul

translate = Geometry.Translate(geometry=geometry, yTranslation=add)
Geometry = Output(translate)
