# Dynamo custom node Geometry.ToRevitType.dyf (Dynamo 0.9.0.3067)
# category: Rhythm.Geometry.Geometry
# This will convert designscript geometyr into Revit.DB types. Currently tested with curves, nurbs curves and solids.

var = Input()  # "var[]..[]"
code_block = CodeBlock(item=var) { DSCore.List.Flatten({item},-1); }
python_script = Python(IN[0]=code_block)
# ---------- python_script.python (23 lines) ----------
import clr
clr.AddReference('RevitAPI')
from Autodesk.Revit.DB import *

clr.AddReference("RevitNodes")
import Revit
clr.ImportExtensions(Revit.GeometryConversion)

clr.AddReference("RevitServices")
import RevitServices
from RevitServices.Persistence import DocumentManager
from RevitServices.Transactions import TransactionManager

doc = DocumentManager.Instance.CurrentDBDocument
curves = UnwrapElement(IN[0])
elementlist = []

TransactionManager.Instance.EnsureInTransaction(doc)
for curve in curves:
	revitCurves = curve.ToRevitType()
	elementlist.append(revitCurves)
TransactionManager.Instance.TransactionTaskDone()
OUT = elementlist
# ----------------------------------------
flatten = Flatten(python_script)
RevitType = Output(flatten)
