# Dynamo custom node GetParameterValueByNameAsString.dyf (Dynamo 0.7.5.3566)
# category: Rhythm.Revit.Elements.Element.Actions
# Returns paramter value as string. Same effect as lunchbox node, without python.

Element_s = Input()  # "Element(s)"
Parameter_Name = Input()
getParameterValueByName = Element.GetParameterValueByName(arg1=Parameter_Name)
map = List.Map(Element_s, getParameterValueByName)
string_from_object = FromObject(map)
Value = Output(string_from_object)
