# Dynamo custom node Gmail.ComposeEmail.dyf (Dynamo 1.0.0.1180)
# category: Rhythm.Core.Email
# This node will compose a new email. Useful for notifications regarding a graph concluding. Uses pythons built-in SMTP Library.

username = Input(username : string)  # provide Gmail username with @gmail.com extension
password = Input(password : string)  # purely to send the email with the python SMTP library. I don't want your info, python does (to login).
message = Input(message : string= "placeholder message")
recipient = Input(recipient : string)
python_script = Python(IN[0]=username, IN[1]=password, IN[2]=message, IN[3]=recipient)
# ---------- python_script.python (20 lines) ----------
#created for Dynamo by john pierson
#based on http://naelshiab.com/tutorial-send-email-python/
import clr
import sys
pyt_path = r'C:\Program Files (x86)\IronPython 2.7\Lib'
sys.path.append(pyt_path)
# Import smtplib for the actual sending function
import smtplib
username = IN[0]
password = IN[1]

recipient = IN[3]

server = smtplib.SMTP('smtp.gmail.com', 587)
server.starttls()
server.login(username, password)
 
msg = IN[2]
server.sendmail(username, recipient, msg)
server.quit()
# ----------------------------------------
