# Dynamo custom node Gmail.ComposeEmailDetailed.dyf (Dynamo 1.0.0.1180)
# category: Rhythm.Core.Email
# This will compose a detailed email with subject and message.

username = Input(username : string)  # provide Gmail username with @gmail.com extension
recipient = Input(recipient : string)
subject = Input(subject : string= "placeholder subject")
message = Input(message : string= "placeholder message")
password = Input(password : string)  # purely to send the email with the python SMTP library. I don't want your info, python does (to login).
python_script = Python(IN[0]=username, IN[1]=recipient, IN[2]=subject, IN[3]=message, IN[4]=password)
# ---------- python_script.python (33 lines) ----------
#created for Dynamo by john pierson
#based on http://naelshiab.com/tutorial-send-email-python/
import clr
import sys
pyt_path = r'C:\Program Files (x86)\IronPython 2.7\Lib'
sys.path.append(pyt_path)
# Import smtplib for the actual sending function
import smtplib
from email.MIMEMultipart import MIMEMultipart
from email.MIMEText import MIMEText
 
username = IN[0]
recipient = IN[1]
subject = IN[2]
message = IN[3]
password = IN[4]
 
fromaddr = username
toaddr = recipient
msg = MIMEMultipart()
msg['From'] = fromaddr
msg['To'] = toaddr
msg['Subject'] = subject
 
body = message
msg.attach(MIMEText(body, 'plain'))
 
server = smtplib.SMTP('smtp.gmail.com', 587)
server.starttls()
server.login(fromaddr, password)
text = msg.as_string()
server.sendmail(fromaddr, toaddr, text)
server.quit()
# ----------------------------------------
