# Dynamo custom node Inspiration.BuffettNode.dyf (Dynamo 0.8.1.1823)
# category: Rhythm.Core.Inspiration
# This is a result of "what if?" thinking. The output is a random Warren Buffett quote from brainyquotes.com

# group: Here we get the website and split at the quote
code_block = CodeBlock { "http://www.brainyquote.com/quotes/authors/w/warren_buffett.html"; }
web_request = WebRequest(code_block)
code_block_2 = CodeBlock { "'/quotes/quotes/w/warrenbuff"; }
split = String.Split(web_request, code_block_2)
code_block_3 = CodeBlock { 1; }
dropItems = List.DropItems(list=split, amount=code_block_3)
code_block_4 = CodeBlock { ">"; false; "<"; }
removePriorToCharacter = Custom[String.RemovePriorToCharacter](str=dropItems, Character=code_block_4.out0, ignoreCase=code_block_4.out1)  # This will remove all characters prior to the input character. Accepts strings.
removeAfterGivenCharacter = Custom[String.RemoveAfterGivenCharacter](str=removePriorToCharacter, Character=code_block_4.out2, ignoreCase=code_block_4.out1)  # This will move all characters at and after the given character.

code_block_5 = CodeBlock { " "; }

# group: Here we get the actual quotes and replace the missing '
contains = String.Contains(str=removeAfterGivenCharacter, searchFor=code_block_5)
filterByBoolMask = List.FilterByBoolMask(list=removeAfterGivenCharacter, mask=contains)
string = StringInput("&#39;")
string_2 = StringInput("'")
replace = String.Replace(str=filterByBoolMask.in, searchFor=string, replaceWith=string_2)

# group: Here we simply get a random quote at an index
code_block_6 = CodeBlock { 0; }
count = List.Count(replace)
random = Math.Random(code_block_6, count)
ceiling = Math.Ceiling(random)
getItemAtIndex = List.GetItemAtIndex(list=replace, index=ceiling)

watch = Watch(getItemAtIndex)
Warren_Buffet = Output(getItemAtIndex)  # "-Warren Buffet"
