# Dynamo custom node Inspiration.SearchQuoteNode.dyf (Dynamo 0.8.1.1823)
# category: Rhythm.Core.Inspiration
# This is a result of "what if?" thinking. The output is a random quote based on the search criteria from brainyquotes.com. (As long as it is on the site)

getQuoteFrom = Input()

# group: This enables us to search for any person's quotes on brainy quote.com (If available)
code_block = CodeBlock { "http://www.brainyquote.com/quotes/authors/*/?.html"; }
code_block_2 = CodeBlock { "*"; "?"; }
toLower = String.ToLower(getQuoteFrom)
code_block_3 = CodeBlock { " "; ""; }
replace = String.Replace(str=toLower, searchFor=code_block_3.out0, replaceWith=code_block_3.out1)
code_block_4 = CodeBlock { 0; }
characterAtIndex = Custom[String.CharacterAtIndex](List=replace, Index=code_block_4)  # Get's the character at a given index
replace_2 = String.Replace(str=code_block, searchFor=code_block_2.out0, replaceWith=characterAtIndex)
code_block_5 = CodeBlock { " "; "_"; }
replace_3 = String.Replace(str=toLower, searchFor=code_block_5.out0, replaceWith=code_block_5.out1)
replace_4 = String.Replace(str=replace_2, searchFor=code_block_2.out1, replaceWith=replace_3)
code_block_6 = CodeBlock { "'/quotes/quotes/*/?"; }
replace_5 = String.Replace(str=code_block_6, searchFor=code_block_2.out0, replaceWith=characterAtIndex)

web_request = WebRequest(replace_4)
code_block_7 = CodeBlock { 3; }
length = String.Length(replace)
code_block_8 = CodeBlock(a=length, b=code_block_7) { a-b; }
remove = String.Remove(str=replace, startIndex=code_block_7, count=code_block_8)

# group (continued): This enables us to search for any person's quotes on brainy quote.com (If available)
replace_6 = String.Replace(str=replace_5, searchFor=code_block_2.out1, replaceWith=remove)

split = String.Split(web_request, replace_6)
code_block_9 = CodeBlock { 1; }
dropItems = List.DropItems(list=split, amount=code_block_9)
code_block_10 = CodeBlock { ">"; false; "<"; }
removePriorToCharacter = Custom[String.RemovePriorToCharacter](str=dropItems, Character=code_block_10.out0, ignoreCase=code_block_10.out1)  # This will remove all characters prior to the input character. Accepts strings.
removeAfterGivenCharacter = Custom[String.RemoveAfterGivenCharacter](str=removePriorToCharacter, Character=code_block_10.out2, ignoreCase=code_block_10.out1)  # This will move all characters at and after the given character.
code_block_11 = CodeBlock { " "; }

# group: Here we get the actual quotes and replace the missing '
contains = String.Contains(str=removeAfterGivenCharacter, searchFor=code_block_11)
filterByBoolMask = List.FilterByBoolMask(list=removeAfterGivenCharacter, mask=contains)
string = StringInput("&#39;")
string_2 = StringInput("'")
replace_7 = String.Replace(str=filterByBoolMask.in, searchFor=string, replaceWith=string_2)

# group: Here we simply get a random quote at an index
code_block_12 = CodeBlock { 0; }
count = List.Count(replace_7)
random = Math.Random(code_block_12, count)
ceiling = Math.Ceiling(random)
getItemAtIndex = List.GetItemAtIndex(list=replace_7, index=ceiling)

watch = Watch(getItemAtIndex)
isNull = Object.IsNull(getItemAtIndex)
code_block_13 = CodeBlock { "I wish I had quotes on brainyquotes.com"; }
if_ = If(test=isNull, true=code_block_13, false=getItemAtIndex)
Quote = Output(if_)
code_block_14 = CodeBlock(input1=getQuoteFrom) { "-"+input1; }
Author = Output(code_block_14)
