# Dynamo custom node InteriorElevation.GetCropRegion.dyf (Dynamo 1.2.3.573)
# category: Rhythm.Revit.Views.InteriorElevation
# This will obtain the crop region from an Interior Elevation View Type.

interiorElevations = Input()
code_block = CodeBlock(items=interiorElevations) { Flatten({items}); }
python_script = Python(IN[0]=code_block)
# ---------- python_script.python (46 lines) ----------
#Copyright(c) 2017, john pierson
# @60secondrevit, http://sixtysecondrevit.com
import clr
clr.AddReference('ProtoGeometry')
from Autodesk.DesignScript.Geometry import *

# Import ToDSType(bool) extension method
clr.AddReference("RevitNodes")
import Revit
clr.ImportExtensions(Revit.Elements)

# Import DocumentManager and TransactionManager
clr.AddReference("RevitServices")
import RevitServices
from RevitServices.Persistence import DocumentManager
from RevitServices.Transactions import TransactionManager

from System.Collections.Generic import *

# Import RevitAPI
clr.AddReference("RevitAPI")
from Autodesk.Revit.DB import *

doc = DocumentManager.Instance.CurrentDBDocument
uiapp = DocumentManager.Instance.CurrentUIApplication
app = uiapp.Application

#The inputs to this node will be stored as a list in the IN variable.
dataEnteringNode = IN

#unwrap all elements to use with API
items = UnwrapElement(IN[0])
TransactionManager.Instance.EnsureInTransaction(doc)
#get the associated view id with the viewport and select the thing
typelist = list()
for i in items:
	try:
		typelist.append(doc.GetElement(ElementId(int(str(i.Id))-1)))
	except:
		typelist.append(doc.GetElement(ElementId(int(str(i.Id))-1)))

# "End" the transaction
TransactionManager.Instance.TransactionTaskDone()

#Assign your output to the OUT variable
OUT = typelist
# ----------------------------------------
cropRegions = Output(python_script)
