# Dynamo custom node Isolated Pick Model Elements(ordered).dyf (Dynamo 1.3.2.2480)
# category: Rhythm.Revit.Selection.Selection
# Pick model elements in desired order of a desired category.

refresh = Input(refresh : bool = false)  # toggle to reset selection
Category = Input()
string_from_object = FromObject(Category)
python_script = Python(IN[0]=refresh, IN[1]=string_from_object)
# ---------- python_script.python (45 lines) ----------
#Copyright(c) 2017, john pierson
# @60secondrevit, http://sixtysecondrevit.com
#Thanks to Dimitar and Troy Gates for Guidance
#and this blog http://pythoncvc.net/?p=116
import clr
import msvcrt

clr.AddReference("RevitAPIUI")
from  Autodesk.Revit.UI import *

clr.AddReference("RevitServices")
import RevitServices
from RevitServices.Persistence import DocumentManager
doc = DocumentManager.Instance.CurrentDBDocument
uidoc=DocumentManager.Instance.CurrentUIApplication.ActiveUIDocument

clr.AddReference("RevitNodes")
import Revit
clr.ImportExtensions(Revit.Elements)
TaskDialog.Show('Isolated Selection','Pick ' + (IN[1].lower()) + ' in desired order, then press ESC to finish')
sel1 = uidoc.Selection
obt1 = Selection.ObjectType.Element

class CustomISelectionFilter(Selection.ISelectionFilter):
	def __init__(self, nom_categorie):
		self.nom_categorie = nom_categorie
	def AllowElement(self, e):
		if e.Category.Name == self.nom_categorie:
			return True
		else:
			return False
	def AllowReference(self, ref, point):
		return true
msg1 = 'Pick '+ IN[1] +' in desired order then press ESC to finish.'
out1 = []
flag = True

while flag:
	try:
		el1 = doc.GetElement(sel1.PickObject(obt1,CustomISelectionFilter(IN[1]), msg1).ElementId)
		out1.append(el1.ToDSType(True))
	except:
		flag = False
		
		OUT = out1
# ----------------------------------------
elements = Output(python_script)
