# Dynamo custom node Level Element Collector.dyf (Dynamo 1.2.0.2831)
# category: Rhythm.Tools
# This collects data for all of the Level elements in the model. Similar to the node on Lunchbox, but this one uses all O.O.B. nodes.

element_types = ElementTypes("Level")
all_elements_of_type = ElementsOfType(element_types)
RunMe = Input(RunMe : bool = false)
toggle = Custom[Rhythm.Toggle](list=all_elements_of_type, boolean=RunMe)  # Toggle that offers two outputs. Created for Dynamo 0.8.1 because of changes to the "IF" node
Element = Output(toggle.in)
name = Element.Name(toggle.in)
Name = Output(name)
elevation = Level.Elevation(toggle.in)
Elevation = Output(elevation)
id = Element.Id(toggle.in)
Element_ID = Output(id)
uniqueId = Element.UniqueId(toggle.in)
Unique_ID = Output(uniqueId)
