# Dynamo custom node List.ArchitecturalAlphabeticalSequence.dyf (Dynamo 0.9.0.3067)
# category: Rhythm.Core.List.Actions
# This creates a list of characters. What's different is we typically exclude I's and O's from our characters so there is a toggle for this.

skipIO = Input(skipIO : bool = true)
amount = Input(amount : int)
boolean = BoolSelector(true)

# group: Builds an alphabetical list that excludes the i's and o's. Currently supports signle letters all the way up to double (600 total)
code_block = CodeBlock { "abcdefghjklmnpqrstuvwxyz"; "abcdefghijklmnopqrstuvwxyz"; ""; }

thisOrThat = Custom[Ayuda.ThisOrThat](Toggle=skipIO, Item1=code_block.out0, Item2=code_block.out1)  # This node is a toggle between two inputs.

# group (continued): Builds an alphabetical list that excludes the i's and o's. Currently supports signle letters all the way up to double (600 total)
split = String.Split(thisOrThat, code_block.out2)
add = _ + split
map = List.Map(list=split, f_x=add)
create = List.Create(split, map)
flatten = Flatten(create)
takeItems = List.TakeItems(list=flatten, amount=amount)
changeCase = String.ChangeCase(takeItems, boolean)

clean = Custom[Output.Clean](input=changeCase)  # This will return a single value or list from one input.
seq = Output(clean)
