# Dynamo custom node List.Contains.dyf (Dynamo 0.9.0.3067)
# category: Rhythm.Core.List.Actions
# Determines if the given list contains the item or items.

list = Input()
item = Input()
eq = item == _
map = List.Map(list=list, f_x=eq)
code_block = CodeBlock { true; }
containsItem = List.ContainsItem(list=map, item=code_block, lacing=Longest)
flatten = Flatten(containsItem)
mask = Output(flatten)
