# Dynamo custom node List.RestoreList.dyf (Dynamo 1.2.3.573)
# category: Rhythm.Core.List
# This will restore the list to it's original indentation.

flattenedList = Input()
originalList = Input()
count = Count(originalList, lacing=Longest)
chop = List.Chop(list=flattenedList, lengths=count)
restoredList = Output(chop)
