# Dynamo custom node List.ReturnItemsPreviousToIndex.dyf (Dynamo 0.9.0.3067)
# category: Rhythm.Core.List.Actions
# This will take an index (or indices) and return the items previous to it. Useful for sums of all items previous.

list = Input()
index = Input()
code_block = CodeBlock(index=index) { 0..index-1..1; }
getItemAtIndex = List.GetItemAtIndex(list=list, index=code_block)
item = Output(getItemAtIndex)
