# Dynamo custom node Mullion.SortByDirection.dyf (Dynamo 0.9.0.3067)
# category: Rhythm.Revit.Elements.Mullion.Query
# This will sort mullions of a host curtain wall by direction they are facing.

hostingElement = Input(hostingElement : Element)
byElement = CurtainPanel.ByElement(hostingElement)
supportingMullions = CurtainPanel.SupportingMullions(byElement)
flatten = Flatten(supportingMullions)
locationCurve = Mullion.LocationCurve(supportingMullions)
startPoint = Curve.StartPoint(locationCurve)
Z = Point.Z(startPoint)
endPoint = Curve.EndPoint(locationCurve)
Z_2 = Point.Z(endPoint)
eq = Z == Z_2
flatten_2 = Flatten(eq)
filterByBoolMask = List.FilterByBoolMask(list=flatten, mask=flatten_2)
Horizontal = Output(filterByBoolMask.in)
Vertical = Output(filterByBoolMask.out)
