# Dynamo custom node OS.CurrentUser.dyf (Dynamo 0.8.1.1823)
# category: Rhythm.Core.OS
# This node retrieves the current user logged in.

python_script = Python()
# ---------- python_script.python (8 lines) ----------
import clr
import sys

pyt_path = r'C:\Program Files (x86)\IronPython 2.7\Lib'
sys.path.append(pyt_path)

import os
OUT = os.environ.get( "USERNAME" )
# ----------------------------------------
OUT = Output(python_script)
