# Dynamo custom node OS.CurrentUserAppData.dyf (Dynamo 0.8.1.1823)
# category: Rhythm.Core.OS
# This retrieves the current user's appdata location

python_script = Python()
# ---------- python_script.python (8 lines) ----------
import clr
import sys

pyt_path = r'C:\Program Files (x86)\IronPython 2.7\Lib'
sys.path.append(pyt_path)

import os
OUT = os.getenv('APPDATA')
# ----------------------------------------
OUT = Output(python_script)
