# Dynamo custom node Output.Clean.dyf (Dynamo 0.8.1.1823)
# category: Rhythm.Core.List.Actions
# This will return a single value or list from one input.

input = Input()
count = List.Count(input)
code_block = CodeBlock(input=count) { input>1; }
firstItem = List.FirstItem(input)

# group: Special thanks to Mark Thorley for this definition
code_block_2 = CodeBlock(test=code_block, iftrue=input, iffalse=firstItem) { oldif(test,iftrue,iffalse); }
code_block_3 = CodeBlock()
# ---------- code_block_3.designscript (15 lines) ----------
def oldif(test,iftrue:var[]..[],
iffalse:var[]..[])
{
return = [Imperative]
{
if (test)
{
return = iftrue;
}
else
{
return = iffalse;
}
}
};
# ----------------------------------------

result = Output(code_block_2)
