# Dynamo custom node Parametric Graphic Scale.dyf (Dynamo 0.8.1.1823)
# category: Rhythm.Tools
# This node automates the graphic scale assigned per viewport. The input required is all instances of viewport category. It also requires shared parameters. Visit sixtysecondrevit.blogspot.com for details.

categories = Categories("Viewports")
# note: This tool requires ou to add some shared project parameters to your file. VIsit sixtysecondrevit.blogspot.com for details
# note: As a precaution, use this tool while no one else is in the model. In a workshared environment, you will take ownership of all views to set the scales.
all_elements_of_category = ElementsOfCategory(categories)
RunMe = Input()
toggle = Custom[Rhythm.Toggle](list=all_elements_of_category, boolean=RunMe)  # Toggle that offers two outputs. Created for Dynamo 0.8.1 because of changes to the "IF" node
name = Element.Name(toggle.in)
code_block = CodeBlock { "Graphic"; true; }
contains = String.Contains(str=name, searchFor=code_block.out0, ignoreCase=code_block.out1)
filterByBoolMask = List.FilterByBoolMask(list=toggle.in, mask=contains)
code_block_2 = CodeBlock { "Scale Value    1:"; 8; }
getParameterValueByName = Element.GetParameterValueByName(element=filterByBoolMask.in, parameterName=code_block_2.out0)
code_block_3 = CodeBlock { ""; }
eq = getParameterValueByName == code_block_3
filterByBoolMask_2 = List.FilterByBoolMask(list=filterByBoolMask.in, mask=eq)
getParameterValueByName_2 = Element.GetParameterValueByName(element=filterByBoolMask_2.out, parameterName=code_block_2.out0)
le = getParameterValueByName_2 <= code_block_2.out1
filterByBoolMask_3 = List.FilterByBoolMask(list=filterByBoolMask_2.out, mask=le)
code_block_4 = CodeBlock { "Graphic Scale 1"; "Graphic Scale 2"; "Graphic Scale 3"; }
code_block_5 = CodeBlock { "Scale Value    1:"; }
getParameterValueByName_3 = Element.GetParameterValueByName(element=filterByBoolMask_3.out, parameterName=code_block_5)
calculates_the_number_to_display = CodeBlock(in1=getParameterValueByName_3) { ((in1 * 3/4)/12); ((in1 * 1.5)/12); ((in1 * 2.25)/12); }
setParameterByName = Element.SetParameterByName(element=filterByBoolMask_3.out, parameterName=code_block_4.out1, value=calculates_the_number_to_display.out1)
code_block_6 = CodeBlock { "Graphic Scale 1"; "Graphic Scale 2"; "Graphic Scale 3"; }
getParameterValueByName_4 = Element.GetParameterValueByName(element=filterByBoolMask_3.in, parameterName=code_block_5)
calculates_the_number_to_display_2 = CodeBlock(in1=getParameterValueByName_4) { (in1 * 3/4); (in1 * 1.5); (in1 * 2.25); }
setParameterByName_2 = Element.SetParameterByName(element=filterByBoolMask_3.in, parameterName=code_block_6.out2, value=calculates_the_number_to_display_2.out2)
setParameterByName_3 = Element.SetParameterByName(element=filterByBoolMask_3.in, parameterName=code_block_6.out1, value=calculates_the_number_to_display_2.out1)
code_block_7 = CodeBlock { "Graphic Scale 4"; }
string = StringInput("\"")
setParameterByName_4 = Element.SetParameterByName(element=filterByBoolMask_3.in, parameterName=code_block_7, value=string)
setParameterByName_5 = Element.SetParameterByName(element=filterByBoolMask_3.out, parameterName=code_block_4.out2, value=calculates_the_number_to_display.out2)
code_block_8 = CodeBlock { "Graphic Scale 4"; }
string_2 = StringInput("'")
setParameterByName_6 = Element.SetParameterByName(element=filterByBoolMask_3.out, parameterName=code_block_8, value=string_2)
note = CodeBlock()  # // This part seperates the views into feet and inch display
note_2 = CodeBlock()  # // Be sure to name your viewports with Graphic Scale to contain the word Graphic
setParameterByName_7 = Element.SetParameterByName(element=filterByBoolMask_3.in, parameterName=code_block_6.out0, value=calculates_the_number_to_display_2.out0)
setParameterByName_8 = Element.SetParameterByName(element=filterByBoolMask_3.out, parameterName=code_block_4.out0, value=calculates_the_number_to_display.out0)
create = List.Create(setParameterByName_7, setParameterByName_8)
flatten = Flatten(create)
string_3 = StringInput("Rotation on Sheet")
code_block_9 = CodeBlock { 1; }
setParameterByName_9 = Element.SetParameterByName(element=flatten, parameterName=string_3, value=code_block_9)
code_block_10 = CodeBlock { 0; }
setParameterByName_10 = Element.SetParameterByName(element=setParameterByName_9, parameterName=string_3, value=code_block_10)
Modified_Viewports = Output(setParameterByName_10)
