# Dynamo custom node Pick Model Elements.dyf (Dynamo 1.2.1.3083)
# category: Rhythm.Revit.Selection
# This node offers a pick method for selecting elements in Revit.

refresh = Input(refresh:bool = true)  # Use boolean to reset
python_script = Python(IN[0]=refresh)
# ---------- python_script.python (33 lines) ----------
#Copyright(c) 2017, john pierson
# @60secondrevit, http://sixtysecondrevit.com
#Based on a node from Dimitar Venkov
#adapted by john pierson for rhythm
import clr

clr.AddReference("RevitAPIUI")
from  Autodesk.Revit.UI import *

clr.AddReference("RevitServices")
import RevitServices
from RevitServices.Persistence import DocumentManager
doc = DocumentManager.Instance.CurrentDBDocument
uidoc=DocumentManager.Instance.CurrentUIApplication.ActiveUIDocument

clr.AddReference("RevitNodes")
import Revit
clr.ImportExtensions(Revit.Elements)

sel1 = uidoc.Selection
ot1 = Selection.ObjectType.Element
el_ref = sel1.PickObjects(ot1, "Select model elements")
typelist = list()
idlist = list()
for i in el_ref:
	
	try:
		typelist.append(doc.GetElement(i.ElementId))
	except:
		typelist.append(list())
		

OUT = typelist
# ----------------------------------------
clean = Custom[Output.Clean](input=python_script)  # This will return a single value or list from one input.
element = Output(clean)
