# Dynamo custom node PipeInsulation.Create.dyf (Dynamo 1.2.1.3083)
# category: Rhythm.Revit.Elements.Piping
# This will add insulation to the input pipes. Can only handle one type of insulation and size for now.

pipesOrContent = Input()
code_block = CodeBlock(item=pipesOrContent) { Flatten({item}); }
python_script = Python(IN[0]=code_block)
# ---------- python_script.python (17 lines) ----------
import clr
clr.AddReference('RevitAPI')
from Autodesk.Revit.DB import *

clr.AddReference("RevitNodes")
import Revit
clr.ImportExtensions(Revit.Elements)

items = UnwrapElement(IN[0])
elementlist = list()
booleans = list()
for item in items:
	try:
		elementlist.append(item.Id)
	except:
		elementlist.append(None)
OUT = elementlist
# ----------------------------------------
pipeInsulationType = Input()
code_block_2 = CodeBlock(item=pipeInsulationType) { Flatten({item}); }
python_script_2 = Python(IN[0]=code_block_2)
# ---------- python_script_2.python (19 lines) ----------
#Copyright(c) 2017, john pierson
# @60secondrevit, http://sixtysecondrevit.com
import clr
clr.AddReference('RevitAPI')
from Autodesk.Revit.DB import *

clr.AddReference("RevitNodes")
import Revit
clr.ImportExtensions(Revit.Elements)

items = UnwrapElement(IN[0])
elementlist = list()
booleans = list()
for item in items:
	try:
		elementlist.append(item.Id)
	except:
		elementlist.append(None)
OUT = elementlist
# ----------------------------------------
code_block_3 = CodeBlock(insulation=python_script_2) { insulation[0]; }
insulationThickness = Input(insulationThickness : double = 1/12)
code_block_4 = CodeBlock(item=insulationThickness) { Flatten({item}); }
code_block_5 = CodeBlock(thickness=code_block_4) { thickness[0]; }
python_script_3 = Python(IN[0]=python_script, IN[1]=code_block_3, IN[2]=code_block_5)
# ---------- python_script_3.python (49 lines) ----------
#Created by DPS Design, dpsdesign.org
import clr
clr.AddReference('ProtoGeometry')
from Autodesk.DesignScript.Geometry import *

# Import ToDSType(bool) extension method
clr.AddReference("RevitNodes")
import Revit
clr.ImportExtensions(Revit.Elements)

# Import DocumentManager and TransactionManager
clr.AddReference("RevitServices")
import RevitServices
from RevitServices.Persistence import DocumentManager
from RevitServices.Transactions import TransactionManager

from System.Collections.Generic import *

# Import RevitAPI
clr.AddReference("RevitAPI")
import Autodesk
from Autodesk.Revit.DB.Plumbing import *

doc = DocumentManager.Instance.CurrentDBDocument
uiapp = DocumentManager.Instance.CurrentUIApplication
app = uiapp.Application

#The inputs to this node will be stored as a list in the IN variable.
dataEnteringNode = IN

#unwrap all elements to use with API
pipes = UnwrapElement(IN[0])
insulationId = IN[1]
thickness = IN[2]
TransactionManager.Instance.EnsureInTransaction(doc)
#apply lineweight override to elements in an input list
typelist = list()
for i in pipes:
	try:
		typelist.append(PipeInsulation.Create(doc,i,insulationId,thickness))
	except:
		typelist.append(list())


# "End" the transaction
TransactionManager.Instance.TransactionTaskDone()

#Assign your output to the OUT variable
OUT = typelist
# ----------------------------------------
pipeInsulation = Output(python_script_3)
