# Dynamo custom node PostableCommand.Default3DView.dyf (Dynamo 1.2.1.3083)
# category: Rhythm.Revit.Application.PostableCommand
# This will set the active view as the default (little house) 3D view.

RunIt = Input(RunIt : bool = false)
python_script = Python(IN[0]=RunIt)
# ---------- python_script.python (28 lines) ----------
import clr

clr.AddReference("RevitServices")
import RevitServices
from RevitServices.Persistence import DocumentManager
from RevitServices.Transactions import TransactionManager
doc =  DocumentManager.Instance.CurrentDBDocument
uidoc = DocumentManager.Instance.CurrentUIDocument
app = DocumentManager.Instance.CurrentUIApplication.Application
uiapp = DocumentManager.Instance.CurrentUIApplication

clr.AddReference("RevitNodes")
import Revit
clr.ImportExtensions(Revit.Elements)
clr.ImportExtensions(Revit.GeometryConversion)

clr.AddReference("RevitAPI")
from Autodesk.Revit.DB import *
clr.AddReference("RevitAPIUI")
from Autodesk.Revit.UI import *
output = []
pCmd = RevitCommandId.LookupPostableCommandId(PostableCommand.Default3DView)
if IN[0] == True:
	uiapp.PostCommand(pCmd)
	output = True
else :
	output = 'set runit to true'
OUT = output
# ----------------------------------------
toggle = Output(python_script)
