# Dynamo custom node PostableCommand.ReplicateWindow.dyf (Dynamo 1.2.1.3083)
# category: Rhythm.Revit.Application.PostableCommand
# Does what is says. Creates another instance of the same window you have open.

refresh = Input(refresh : bool = false)
python_script = Python(IN[0]=refresh)
# ---------- python_script.python (23 lines) ----------
import clr

clr.AddReference("RevitServices")
import RevitServices
from RevitServices.Persistence import DocumentManager
from RevitServices.Transactions import TransactionManager
doc =  DocumentManager.Instance.CurrentDBDocument
uidoc = DocumentManager.Instance.CurrentUIDocument
app = DocumentManager.Instance.CurrentUIApplication.Application
uiapp = DocumentManager.Instance.CurrentUIApplication

clr.AddReference("RevitNodes")
import Revit
clr.ImportExtensions(Revit.Elements)
clr.ImportExtensions(Revit.GeometryConversion)

clr.AddReference("RevitAPI")
from Autodesk.Revit.DB import *
clr.AddReference("RevitAPIUI")
from Autodesk.Revit.UI import *

pCmd = RevitCommandId.LookupPostableCommandId(PostableCommand.ReplicateWindow)
OUT = uiapp.PostCommand(pCmd)
# ----------------------------------------
output = Output(python_script)  # "[]"
