# Dynamo custom node Railing.BalusterCount.dyf (Dynamo 0.9.1.4062)
# category: Rhythm.Revit.Elements.Railing.Query
# This node will count the amout of balusters in a rail element. Only works for single element for now.

hostingElement = Input(hostingElement : Element)  # Select a single railing in Revit.
geometry = Element.Geometry(hostingElement)
explode = Geometry.Explode(geometry)
code_block = CodeBlock { 0; }
getItemAtIndex = List.GetItemAtIndex(index=code_block)
map = List.Map(list=explode, f_x=getItemAtIndex)
pointAtParameter = Surface.PointAtParameter(surface=map)
normalAtPoint = Surface.NormalAtPoint(surface=map, point=pointAtParameter)
X = Vector.X(normalAtPoint)
code_block_2 = CodeBlock { 0; }
eq = X == code_block_2
filterByBoolMask = List.FilterByBoolMask(list=pointAtParameter, mask=eq)
count = Count(filterByBoolMask.in, lacing=Longest)
balusterCount = Output(count)
