# Dynamo custom node ReferencePlane.ByStartPointEndPointActiveViewVector.dyf (Dynamo 1.2.1.3083)
# category: Rhythm.Revit.Elements.ReferencePlane
# This will create a reference plane by the given start point, end point and active view vector. If you want to use multiple points as input you need to use List@Level with level 1 for both inputs.

startPoint = Input()
code_block = CodeBlock(item=startPoint) { Flatten({item}); }
endPoint = Input()
code_block_2 = CodeBlock(item=endPoint) { Flatten({item}); }
code_block_3 = CodeBlock(startPoint=code_block, endPoint=code_block_2) { startPoint[0]; endPoint[0]; }
python_script = Python()
# ---------- python_script.python (31 lines) ----------
import clr
clr.AddReference('ProtoGeometry')
from Autodesk.DesignScript.Geometry import *

# Import Element wrapper extension methods
clr.AddReference("RevitNodes")
import Revit
clr.ImportExtensions(Revit.Elements)

# Import geometry conversion extension methods
clr.ImportExtensions(Revit.GeometryConversion)

# Import DocumentManager and TransactionManager
clr.AddReference("RevitServices")
import RevitServices
from RevitServices.Persistence import DocumentManager
from RevitServices.Transactions import TransactionManager

doc = DocumentManager.Instance.CurrentDBDocument
uiapp = DocumentManager.Instance.CurrentUIApplication
app = uiapp.Application

# Import RevitAPI
clr.AddReference("RevitAPI")
import Autodesk
from Autodesk.Revit.DB import *

items = UnwrapElement(doc.ActiveView.ToDSType(True))


OUT = items.Origin.ToPoint(),items.ViewDirection.ToVector()
# ----------------------------------------
code_block_4 = CodeBlock(seq=python_script) { Plane.ByOriginNormal(seq[0],seq[1]); }
normal = Plane.Normal(code_block_4)
python_script_2 = Python(IN[0]=code_block_3.out0, IN[1]=code_block_3.out1, IN[2]=normal)
# ---------- python_script_2.python (52 lines) ----------
#Copyright(c) 2017, john pierson
# @60secondrevit, http://sixtysecondrevit.com
import clr
clr.AddReference('ProtoGeometry')
from Autodesk.DesignScript.Geometry import *

# Import Element wrapper extension methods
clr.AddReference("RevitNodes")
import Revit
clr.ImportExtensions(Revit.Elements)

# Import geometry conversion extension methods
clr.ImportExtensions(Revit.GeometryConversion)

# Import DocumentManager and TransactionManager
clr.AddReference("RevitServices")
import RevitServices
from RevitServices.Persistence import DocumentManager
from RevitServices.Transactions import TransactionManager

doc = DocumentManager.Instance.CurrentDBDocument
uiapp = DocumentManager.Instance.CurrentUIApplication
app = uiapp.Application

# Import RevitAPI
clr.AddReference("RevitAPI")
import Autodesk
from Autodesk.Revit.DB import *

doc = DocumentManager.Instance.CurrentDBDocument
uiapp = DocumentManager.Instance.CurrentUIApplication
app = uiapp.Application

#The inputs to this node will be stored as a list in the IN variable.
dataEnteringNode = IN

#unwrap all elements to use with API
bubbleEnd = UnwrapElement(IN[0]).ToRevitType()
freeEnd = UnwrapElement(IN[1]).ToRevitType()
cutVector = UnwrapElement(IN[2]).ToRevitType()
pView = UnwrapElement(doc.ActiveView.ToDSType(True))

TransactionManager.Instance.EnsureInTransaction(doc)
#apply lineweight override to elements in an input list
typelist = list()

rPlane = doc.Create.NewReferencePlane(bubbleEnd,freeEnd,cutVector,pView)
# "End" the transaction
TransactionManager.Instance.TransactionTaskDone()

#Assign your output to the OUT variable
OUT = rPlane
# ----------------------------------------
ReferencePlane = Output(python_script_2)
