# Dynamo custom node RemoveListFromList.dyf (Dynamo 0.7.5.3566)
# category: Rhythm.Core.List.Actions
# This node essentially "subtracts" the contents of List B from List A to produce a new list with the unique items.

List_A = Input()
List_B = Input()
python_script = Python(IN[0]=List_A, IN[1]=List_B)
# ---------- python_script.python (8 lines) ----------
import clr
clr.AddReference('ProtoGeometry')
from Autodesk.DesignScript.Geometry import *
#The inputs to this node will be stored as a list in the IN variable.
dataEnteringNode = IN

#Assign your output to the OUT variable
OUT = set(IN[0]) - set(IN[1])
# ----------------------------------------
List = Output(python_script)
