# Dynamo custom node Rhythm.3DRoomTags.dyf (Dynamo 0.9.1.4062)
# category: Rhythm.Tools
# This node will generate 3D room tags for all rooms in the model. (RFA in extra folder in Dynamo download)

ThreeDRoomTag = Input(ThreeDRoomTag : FamilyType)
categories = Categories("Rooms")
RunMe = Input(RunMe : bool=false)
toggle = Custom[Rhythm.Toggle](list=categories, boolean=RunMe)  # Toggle that offers two outputs. Created for Dynamo 0.8.1 because of changes to the "IF" node

# group: This filters out unplaced rooms
all_elements_of_category = ElementsOfCategory(toggle.in)
code_block = CodeBlock { "Area"; ""; }

flatten = Flatten(all_elements_of_category)

# group (continued): This filters out unplaced rooms
getParameterValueByName = Element.GetParameterValueByName(element=flatten, parameterName=code_block.out0)
ne = getParameterValueByName != code_block.out1
filterByBoolMask = List.FilterByBoolMask(list=flatten, mask=ne)

Phase = Input(Phase : string = "New Construction")

# group: This area filters for user selected phase
code_block_2 = CodeBlock { "Phase"; }
getParameterValueByName_2 = Element.GetParameterValueByName(element=filterByBoolMask.in, parameterName=code_block_2)

name = Element.Name(getParameterValueByName_2)

# group (continued): This area filters for user selected phase
eq = name == Phase
filterByBoolMask_2 = List.FilterByBoolMask(list=filterByBoolMask.in, mask=eq)

# group: Gets parameters and locations
python_script = Python(IN[0]=filterByBoolMask_2.in)
# ---------- python_script.python (58 lines) ----------
import clr
clr.AddReference('RevitAPI')
from Autodesk.Revit.DB import *

clr.AddReference("RevitNodes")
import Revit
clr.ImportExtensions(Revit.GeometryConversion)

items = UnwrapElement(IN[0])
pointlist = list()
curvepointlist = list()
ispoint = list()
iscurve = list()
curves = list()
haslocation = list()

for item in items:
	try:
		# points and text notes
		pointlist.append(item.Coord.ToPoint())
		ispoint.append(True)
		iscurve.append(False)
		haslocation.append(True)
	except:
		try:
			loc = item.Location
			if loc.ToString() == 'Autodesk.Revit.DB.LocationCurve':
				# line-based elements (e.g. walls)
				curvepoints = (loc.Curve.GetEndPoint(0).ToPoint(),loc.Curve.GetEndPoint(1).ToPoint())
				curvepointlist.append(curvepoints)
				curves.append(loc.Curve.ToProtoType())
				ispoint.append(False)
				iscurve.append(True)
				haslocation.append(True)
			elif loc.ToString() == 'Autodesk.Revit.DB.LocationPoint':
				# point-based elements
				pointlist.append(loc.Point.ToPoint())
				ispoint.append(True)
				iscurve.append(False)
				haslocation.append(True)
			else:
				ispoint.append(False)
				iscurve.append(False)
				haslocation.append(False)
		except:
			try:
				# curves
				curvepoints = (item.GetEndPoint(0).ToPoint(),item.GetEndPoint(1).ToPoint())
				curvepointlist.append(curvepoints)
				curves.append(item.ToProtoType())
				ispoint.append(False)
				iscurve.append(True)
				haslocation.append(True)
			except:
				ispoint.append(False)
				iscurve.append(False)
				haslocation.append(False)
OUT = (pointlist,curvepointlist,curves,ispoint,iscurve,haslocation)
# ----------------------------------------
code_block_3 = CodeBlock(x=python_script) { x[0]; }
code_block_4 = CodeBlock { "Name"; "Number"; }
getParameterValueByName_3 = Element.GetParameterValueByName(element=filterByBoolMask_2.in, parameterName=code_block_4.out0)
getParameterValueByName_4 = Element.GetParameterValueByName(element=filterByBoolMask_2.in, parameterName=code_block_4.out1)

# group: Creates tag and sets parameters.
byPoint = FamilyInstance.ByPoint(familyType=ThreeDRoomTag, point=code_block_3)
code_block_5 = CodeBlock { "Name"; "Number"; }
setParameterByName = Element.SetParameterByName(element=byPoint, parameterName=code_block_5.out0, value=getParameterValueByName_3)
setParameterByName_2 = Element.SetParameterByName(element=byPoint, parameterName=code_block_5.out1, value=getParameterValueByName_4)

clean = Custom[Output.Clean](input=setParameterByName)  # This will return a single value or list from one input.
ThreeDRoomTags = Output(clean)
