# Dynamo custom node Rhythm.BackupRFADeleter.dyf (Dynamo 0.8.2.2392)
# category: Rhythm.Tools
# This node will scan the contents of a driectory and delete backup RFA files that appear with a four digit backup number before the file extension. (eg. Family1.0001.rfa) This is deleting files so please use with caution!

string = StringInput(" File(s) Deleted")
code_block = CodeBlock { 0; }
directoryPath = Input()
fromPath = DirectoryObject(directoryPath)  # "Directory.FromPath"
contents = Directory.Contents(fromPath)
RunMe = Input()
toggle = Custom[Rhythm.Toggle](list=contents, boolean=RunMe)  # Toggle that offers two outputs. Created for Dynamo 0.8.1 because of changes to the "IF" node
code_block_2 = CodeBlock { -9; "."; 1; }
characterAtIndex = Custom[String.CharacterAtIndex](List=toggle.in, Index=code_block_2.out0)  # Get's the character at a given index
eq = characterAtIndex == code_block_2.out1
filterByBoolMask = List.FilterByBoolMask(list=toggle.in, mask=eq)
split = String.Split(filterByBoolMask.in, code_block_2.out1)
getItemAtIndex = List.GetItemAtIndex(index=code_block_2.out2)
map = List.Map(list=split, f_x=getItemAtIndex)
toNumber = String.ToNumber(map)
isNull = Object.IsNull()
ne = toNumber != isNull
filterByBoolMask_2 = List.FilterByBoolMask(list=filterByBoolMask.in, mask=ne)
delete = File.Delete(filterByBoolMask_2.in)
count = Count(delete)
code_block_3 = CodeBlock { 1; 0; }
le = count <= code_block_3.out0
thisOrThat = Custom[Ayuda.ThisOrThat](Toggle=le, Item1=code_block_3.out1, Item2=count)  # This node is a toggle between two inputs.
string_from_object = FromObject(thisOrThat)
insert = String.Insert(str=string, index=code_block, toInsert=string_from_object)
out = Output(insert)
