# Dynamo custom node Rhythm.DatePicker.dyf (Dynamo 1.2.1.3083)
# category: Rhythm.Core.Input
# This provides a popup date selector for the user.

refresh = Input(refresh : bool = false)
python_script = Python(IN[0]=refresh)
# ---------- python_script.python (43 lines) ----------
#Based on the code generously provided at http://zetcode.com/tutorials/ironpythontutorial/controlsII/
#Made for Dynamo by John Pierson
import clr
clr.AddReference("System.Windows.Forms")
clr.AddReference("System.Drawing")

from System.Windows.Forms import Application, Form
from System.Windows.Forms import Label, MonthCalendar
from System.Drawing import Size, Point


class IForm(Form):

    def __init__(self):
        self.Text = 'MonthCalendar'
        self.Size = Size(300, 240)
        self.Output1 = []
        
        calendar = MonthCalendar()
        calendar.Parent = self
        calendar.Location = Point(20, 20)
        calendar.DateSelected += self.OnSelected

        self.date = Label()
        self.date.Location = Point(30, 180)
        self.date.Parent = self
        dt = calendar.SelectionStart
        self.date.Text = str(dt.Month) + "/" + str(dt.Day) + "/" + str(dt.Year)
        
        self.CenterToScreen()
    

    def OnSelected(self, sender, event): 
        dt = sender.SelectionStart
        self.date.Text = str(dt.Month) + "/" + str(dt.Day) + "/" + str(dt.Year)
        self.Output1.append(self.date.Text)
        self.Close()
    

form = IForm()
Application.Run(form)

OUT = form.Output1
# ----------------------------------------
string = Output(python_script)
fromString = DateTime.FromString(python_script)
dateTime = Output(fromString)
