# Dynamo custom node Rhythm.Detail Number by View Name .dyf "Rhythm.Detail Number by View Name" (Dynamo 0.8.1.1823)
# category: Rhythm.Tools
# Automatically numbers your detail number based on the first two characters of your view name. i.e. A4/... (Requires slash to be present)

RunMe = Input(RunMe : bool=false)
viewports = Custom[Collector.Viewports](RunMe=RunMe)  # This collects all of the viewports in the model and outputs the name, title on sheet, scale and viewport type.
code_block = CodeBlock { "/"; }
contains = String.Contains(str=viewports.ViewNames, searchFor=code_block)
filterByBoolMask = List.FilterByBoolMask(list=viewports.Elements, mask=contains)
code_block_2 = CodeBlock { "Detail Number"; }
filterByBoolMask_2 = List.FilterByBoolMask(list=viewports.ViewNames, mask=contains)
code_block_3 = CodeBlock { "/"; }
removeAfterGivenCharacter = Custom[String.RemoveAfterGivenCharacter](str=filterByBoolMask_2.in, Character=code_block_3)  # This will move all characters at and after the given character.
element_setparameterbyname_case = Custom[Element.SetParameterByName(CaSe iNSeNSiTiVe)](element=filterByBoolMask.in, parameterName=code_block_2, value=removeAfterGivenCharacter)  # Set one of the element's parameters. (CaSe iNSeNSiTiVe)
var = Output(element_setparameterbyname_case)  # "var[]..[]"
