# Dynamo custom node Rhythm.MassOSMData.dyf (Dynamo 1.2.0.2690)
# category: Rhythm.Core.Geometry
# This node will mass the OSM data based upon the know heights. If the building doesn't have a height, it will just output the polygon.

OSMpoints = Input()
OSMkeys = Input()
code_block = CodeBlock { "height"; }
contains = String.Contains(str=OSMkeys, searchFor=code_block)
code_block_2 = CodeBlock { true; }
containsItem = List.ContainsItem(list=contains, item=code_block_2, lacing=Longest)
filterByBoolMask = List.FilterByBoolMask(list=OSMpoints, mask=containsItem)
byPoints = Polygon.ByPoints(filterByBoolMask.in)
code_block_3 = CodeBlock { false; }
clean = List.Clean(list=byPoints, preserveIndices=code_block_3)
ZAxis = Vector.ZAxis()
filterByBoolMask_2 = List.FilterByBoolMask(list=OSMkeys, mask=containsItem)
contains_2 = String.Contains(str=filterByBoolMask_2.in, searchFor=code_block, ignoreCase=code_block_2)
indexOf = IndexOf(contains_2, code_block_2, lacing=Longest)
getItemAtIndex = List.GetItemAtIndex(list=filterByBoolMask_2.in, index=indexOf, lacing=Longest)
code_block_4 = CodeBlock { ":"; " m"; }
split = String.Split(getItemAtIndex, code_block_4.out0, code_block_4.out1)
lastItem = List.LastItem(split, lacing=Longest)
flatten = Flatten(lastItem)
toNumber = String.ToNumber(flatten)
convert_between_units = DynamoConvert(toNumber, conversionMetric=Length, conversionFrom=Meters, conversionTo=Feet)
extrudeAsSolid = Curve.ExtrudeAsSolid(curve=clean, direction=ZAxis, distance=convert_between_units)
flatten_2 = Flatten(extrudeAsSolid)
byUnion = Solid.ByUnion(flatten_2)
mass_knownHeights = Output(byUnion)  # "mass(knownHeights)"
byPoints_2 = Polygon.ByPoints(filterByBoolMask.out)
clean_2 = List.Clean(list=byPoints_2, preserveIndices=code_block_3)
polygons_unknownHeights = Output(clean_2)  # "polygons(unknownHeights)"
