# Dynamo custom node Rhythm.OverrideInteriorCrop.dyf (Dynamo 0.9.2.4472)
# category: Rhythm.Tools
# This node will override the lineweight of the crop region on interior elevations. This node would not be possible without the power of the Dynamo community. Specifically Danny Jones with Clark Patterson Lee

# group: Credit
# note: This node will override the lineweight of the crop region on interior elevations. This node would not be possible without the power of the Dynamo community. Specifically Danny Jones with Clark Patterson Lee

ElevationViews = Input()
RunMe = Input(RunMe : bool=false)
toggle = Custom[Rhythm.Toggle](list=ElevationViews, boolean=RunMe)  # Toggle that offers two outputs. Created for Dynamo 0.8.1 because of changes to the "IF" node
type = Custom[Element.Type](element_s=toggle.in)  # This retrieves the element type of the given elements. (if available) Similar to others available but no python here.
code_block = CodeBlock { "Interior Elevation"; }
boolean = BoolSelector(true)
contains = String.Contains(str=type, searchFor=code_block, ignoreCase=boolean)
filterByBoolMask = List.FilterByBoolMask(list=toggle.in, mask=contains)
end = Revit.Transaction.Transaction.End(filterByBoolMask.in)

# group: Collector.ElementsInView
# note: Credit for this script goes to Dimitar Venkov. Download Springnodes for more
python_script = Python(IN[0]=end)
# ---------- python_script.python (34 lines) ----------
#Copyright(c) 2015, Dimitar Venkov
# @5devene, dimitar.ven@gmail.com

import clr

clr.AddReference("RevitServices")
import RevitServices
from RevitServices.Persistence import DocumentManager

clr.AddReference("RevitAPI")
from Autodesk.Revit.DB import FilteredElementCollector

doc = DocumentManager.Instance.CurrentDBDocument

clr.AddReference("RevitNodes")
import Revit
clr.ImportExtensions(Revit.Elements)

def tolist(obj1):
	if hasattr(obj1,"__iter__"):
		return obj1
	else:
		return [obj1]

elements = []
views = UnwrapElement(tolist(IN[0]))
for v in views:
	view_el = FilteredElementCollector(doc, v.Id).WhereElementIsNotElementType().ToElements()
	view_el = [e.ToDSType(True) for e in view_el]
	elements.append(view_el)
if len(elements) == 1:
	OUT = view_el
else:
	OUT = elements
# ----------------------------------------
flatten = Flatten(python_script)

# group: Replaces blanks
type_2 = Custom[Element.Type](element_s=flatten)
firstItem = List.FirstItem(type_2)
code_block_2 = CodeBlock { ""; }
eq = _ == code_block_2

code_block_3 = CodeBlock(x=type_2) { x[1]; }
replaceByCondition = Replace(firstItem, code_block_3, eq)

# group (continued): Replaces blanks
replaceByCondition_2 = Replace(type_2, replaceByCondition, eq)

# group: Gets the crop region
name = Element.Name(replaceByCondition_2)
contains_2 = String.Contains(str=name, searchFor=code_block, ignoreCase=boolean)
code_block_4 = CodeBlock { false; }
isNull = Object.IsNull()
replaceByCondition_3 = Replace(contains_2, code_block_4, isNull)

filterByBoolMask_2 = List.FilterByBoolMask(list=flatten, mask=replaceByCondition_3)
Lineweight = Input(Lineweight : int=5)
python_script_2 = Python(IN[0]=filterByBoolMask_2.in, IN[1]=Lineweight, IN[2]=end)
# ---------- python_script_2.python (55 lines) ----------
#Created by DPS Design, dpsdesign.org
import clr
clr.AddReference('ProtoGeometry')
from Autodesk.DesignScript.Geometry import *

# Import ToDSType(bool) extension method
clr.AddReference("RevitNodes")
import Revit
clr.ImportExtensions(Revit.Elements)

# Import DocumentManager and TransactionManager
clr.AddReference("RevitServices")
import RevitServices
from RevitServices.Persistence import DocumentManager
from RevitServices.Transactions import TransactionManager

from System.Collections.Generic import *

# Import RevitAPI
clr.AddReference("RevitAPI")
import Autodesk

doc = DocumentManager.Instance.CurrentDBDocument
uiapp = DocumentManager.Instance.CurrentUIApplication
app = uiapp.Application

#The inputs to this node will be stored as a list in the IN variable.
dataEnteringNode = IN

#unwrap all elements to use with API
elements = []
views = UnwrapElement(IN[2])
for i in IN[0]:
	elements.append(UnwrapElement(i))

#create graphic overrides properties
gSettings = Autodesk.Revit.DB.OverrideGraphicSettings()

#set Projection Line weight
gSettings.SetProjectionLineWeight(IN[1])

# "Start" the transaction
TransactionManager.Instance.EnsureInTransaction(doc)

#apply lineweight override to elements in an input list
for i, j in zip(elements, views):
#for i in elements:
	id = i.Id
	j.SetElementOverrides(id, gSettings)

# "End" the transaction
TransactionManager.Instance.TransactionTaskDone()

#Assign your output to the OUT variable
OUT = IN[0]
# ----------------------------------------
Modified = Output(python_script_2)

# group: Toggle Crop
# note: Credit for this script goes to Julian Benoit. Download steamnodes for more!
python_script_3 = Python(IN[0]=filterByBoolMask.in)
# ---------- python_script_3.python (41 lines) ----------
#python nodes in dynamo 0.7
#proposed by Julien Benoit @jbenoit44 
#http://aecuandme.wordpress.com/
import clr
clr.AddReference('ProtoGeometry')
from Autodesk.DesignScript.Geometry import *
# Import ToDSType(bool) extension method
clr.AddReference("RevitNodes")
import Revit
clr.ImportExtensions(Revit.Elements)
# Import geometry conversion extension methods
clr.ImportExtensions(Revit.GeometryConversion)
# Import DocumentManager and TransactionManager
clr.AddReference("RevitServices")
import RevitServices
from RevitServices.Persistence import DocumentManager
from RevitServices.Transactions import TransactionManager
from System.Collections.Generic import *
# Import RevitAPI
clr.AddReference("RevitAPI")
import Autodesk
from Autodesk.Revit.DB import *

doc = DocumentManager.Instance.CurrentDBDocument
uiapp = DocumentManager.Instance.CurrentUIApplication
app = uiapp.Application
uidoc=DocumentManager.Instance.CurrentUIApplication.ActiveUIDocument

elt = []
for i in IN[0]:
	elt.append(UnwrapElement(i))
#view = UnwrapElement(IN[0])
cropviews=[]
TransactionManager.Instance.EnsureInTransaction(doc)
for i in elt:
	i.CropBoxActive = True
	i.CropBoxVisible = True
	cropviews.append(i.ToDSType(False))
TransactionManager.Instance.TransactionTaskDone()

OUT = cropviews
# ----------------------------------------

string = StringInput("http://dynamobim.com/forums/topic/override-projection-lines-color/")
