# Dynamo custom node Rhythm.PercentGlazingByOrientation.dyf (Dynamo 0.8.1.1823)
# category: Rhythm.Tools
# This node was show at RTCNA2015 to optimize your workflows. It reports the window to wall % by direction the wall faces.

# note: This graph has dependencies on Clockwork and Rhythm. Please download these packages before running.
# note: Collects all placed walls in model
# note: DPS Total Percentage Glazing Calculator for Schematic Design
categories = Categories("Walls")
all_elements_of_category = ElementsOfCategory(categories)
name = Element.Name(all_elements_of_category)
byName = WallType.ByName(name)
code_block = CodeBlock { "Function"; 1; }
getParameterValueByName = Element.GetParameterValueByName(element=byName, parameterName=code_block.out0)
eq = getParameterValueByName == code_block.out1
# note: Filters for exterior walls
filterByBoolMask = List.FilterByBoolMask(list=all_elements_of_category, mask=eq)
code_block_2 = CodeBlock { "Angle"; ""; }
getParameterValueByName_2 = Element.GetParameterValueByName(element=filterByBoolMask.in, parameterName=code_block_2.out0)
string_from_object = FromObject(getParameterValueByName_2)
ne = string_from_object != code_block_2.out1
# note: Filters out curtain walls
filterByBoolMask_2 = List.FilterByBoolMask(list=filterByBoolMask.in, mask=ne)
code_block_3 = CodeBlock { "Area"; }
# note: Collects area of walls and sums it up.
getParameterValueByName_3 = Element.GetParameterValueByName(element=filterByBoolMask_2.out, parameterName=code_block_3)
sum = Math.Sum(getParameterValueByName_3)

# group: Credit for python script to Andreas Deckmann
# note: *based on node from clockwork package
# note: This collects the embedded walls (windows) per each wall.
get_embedded_curtainwalls = Python(IN[0]=filterByBoolMask_2.out)
# ---------- get_embedded_curtainwalls.python (29 lines) ----------
import clr
clr.AddReference('RevitAPI')
from Autodesk.Revit.DB import *

clr.AddReference("RevitNodes")
import Revit
clr.ImportExtensions(Revit.Elements)

clr.AddReference("RevitServices")
import RevitServices
from RevitServices.Persistence import DocumentManager

doc = DocumentManager.Instance.CurrentDBDocument
items = UnwrapElement(IN[0])
incopenings = 0
incshadows = 0
incwalls = 1
incshared = 0
elementlist = list()

for item in items:
	itemlist = list()
	try:
		for insert in item.FindInserts(incopenings,incshadows,incwalls,incshared):
			itemlist.append(doc.GetElement(insert).ToDSType(True))
	except:
		donothing = 1
	elementlist.append(itemlist)
OUT = elementlist
# ----------------------------------------

flatten = Flatten(get_embedded_curtainwalls)
# note: Collects area of curtain walls and sums it up.
getParameterValueByName_4 = Element.GetParameterValueByName(element=flatten, parameterName=code_block_3)
sum_2 = Math.Sum(getParameterValueByName_4)
code_block_4 = CodeBlock(a=sum, b=sum_2) { c=a+b; percentGlazing=b/c*100; }
watch = Watch(code_block_4.percentGlazing)
DataAsStrings = Input(DataAsStrings : bool = true)

# group: Credit for python script to Andreas Deckmann
# note: *based on node from clockwork package
# note: This is where we begin to get the wall facings
orientation = Python(IN[0]=filterByBoolMask_2.out)  # "Wall.Orientation"
# ---------- orientation.python (17 lines) ----------
import clr
clr.AddReference('RevitAPI')
from Autodesk.Revit.DB import *

clr.AddReference("RevitNodes")
import Revit
clr.ImportExtensions(Revit.Elements)
clr.ImportExtensions(Revit.GeometryConversion)

wallinstances = UnwrapElement(IN[0])
vectorlist = list()
for item in wallinstances:
	try:
		vectorlist.append(item.Orientation.ToVector())
	except:
		vectorlist.append(list())
OUT = vectorlist
# ----------------------------------------

northSouthEastWest = Custom[Wall.NorthSouthEastWest](Wall=filterByBoolMask_2.out, Normals=orientation)  # This node determines which direction a wall is facing and groups them by the direction or direction they are closest to.

# group: Gathers wall area
code_block_5 = CodeBlock { "Area"; }
getParameterValueByName_5 = Element.GetParameterValueByName(element=northSouthEastWest.North, parameterName=code_block_5)
sum_3 = Math.Sum(getParameterValueByName_5)
getParameterValueByName_6 = Element.GetParameterValueByName(element=northSouthEastWest.East, parameterName=code_block_5)
sum_4 = Math.Sum(getParameterValueByName_6)
getParameterValueByName_7 = Element.GetParameterValueByName(element=northSouthEastWest.West, parameterName=code_block_5)
sum_5 = Math.Sum(getParameterValueByName_7)
getParameterValueByName_8 = Element.GetParameterValueByName(element=northSouthEastWest.North, parameterName=code_block_5)
sum_6 = Math.Sum(getParameterValueByName_8)

# group: Gathers window area
get_embedded_curtainwalls_2 = Python(IN[0]=northSouthEastWest.North)  # same code as get_embedded_curtainwalls
flatten_2 = Flatten(get_embedded_curtainwalls_2)
code_block_6 = CodeBlock { "Area"; }
getParameterValueByName_9 = Element.GetParameterValueByName(element=flatten_2, parameterName=code_block_6)
sum_7 = Math.Sum(getParameterValueByName_9)
get_embedded_curtainwalls_3 = Python(IN[0]=northSouthEastWest.East)  # same code as get_embedded_curtainwalls
flatten_3 = Flatten(get_embedded_curtainwalls_3)
getParameterValueByName_10 = Element.GetParameterValueByName(element=flatten_3, parameterName=code_block_6)
sum_8 = Math.Sum(getParameterValueByName_10)
get_embedded_curtainwalls_4 = Python(IN[0]=northSouthEastWest.West)  # same code as get_embedded_curtainwalls
flatten_4 = Flatten(get_embedded_curtainwalls_4)
getParameterValueByName_11 = Element.GetParameterValueByName(element=flatten_4, parameterName=code_block_6)
sum_9 = Math.Sum(getParameterValueByName_11)
get_embedded_curtainwalls_5 = Python(IN[0]=northSouthEastWest.South)  # same code as get_embedded_curtainwalls
flatten_5 = Flatten(get_embedded_curtainwalls_5)
getParameterValueByName_12 = Element.GetParameterValueByName(element=flatten_5, parameterName=code_block_6)
sum_10 = Math.Sum(getParameterValueByName_12)

# group: This calcualtes the percent of glazing vs. the total wall area
code_block_7 = CodeBlock(a=sum_3, b=sum_7) { c=a+b; percentGlazing=b/c*100; t3 = Math.Ceiling(percentGlazing); }
string_from_object_2 = FromObject(code_block_7.t3)
code_block_8 = CodeBlock(t3=string_from_object_2) { t2 = String.Length(t3); t4 = String.Insert(t3,t2, "%"); }
code_block_9 = CodeBlock(a=sum_4, b=sum_8) { c=a+b; percentGlazing=b/c*100; t3 = Math.Ceiling(percentGlazing); }
string_from_object_3 = FromObject(code_block_9.t3)
code_block_10 = CodeBlock(t3=string_from_object_3) { t2 = String.Length(t3); t4 = String.Insert(t3,t2, "%"); }
code_block_11 = CodeBlock(a=sum_5, b=sum_9) { c=a+b; percentGlazing=b/c*100; t3 = Math.Ceiling(percentGlazing); }
string_from_object_4 = FromObject(code_block_11.t3)
code_block_12 = CodeBlock(t3=string_from_object_4) { t2 = String.Length(t3); t4 = String.Insert(t3,t2, "%"); }
code_block_13 = CodeBlock(a=sum_6, b=sum_10) { c=a+b; percentGlazing=b/c*100; t3 = Math.Ceiling(percentGlazing); }
string_from_object_5 = FromObject(code_block_13.t3)
code_block_14 = CodeBlock(t3=string_from_object_5) { t2 = String.Length(t3); t4 = String.Insert(t3,t2, "%"); }

RunMe = Input(RunMe : bool = false)
toggle = Custom[Rhythm.Toggle](list=code_block_8.t4, boolean=RunMe)  # Toggle that offers two outputs. Created for Dynamo 0.8.1 because of changes to the "IF" node
toggle_2 = Custom[Rhythm.Toggle](list=code_block_7.t3, boolean=RunMe)
thisOrThat = Custom[Ayuda.ThisOrThat](Toggle=DataAsStrings, Item1=toggle.in, Item2=toggle_2.in)  # This node is a toggle between two inputs.
North = Output(thisOrThat)
toggle_3 = Custom[Rhythm.Toggle](list=code_block_10.t4, boolean=RunMe)
toggle_4 = Custom[Rhythm.Toggle](list=code_block_9.t3, boolean=RunMe)
thisOrThat_2 = Custom[Ayuda.ThisOrThat](Toggle=DataAsStrings, Item1=toggle_3.in, Item2=toggle_4.in)
East = Output(thisOrThat_2)
toggle_5 = Custom[Rhythm.Toggle](list=code_block_12.t4, boolean=RunMe)
toggle_6 = Custom[Rhythm.Toggle](list=code_block_11.t3, boolean=RunMe)
thisOrThat_3 = Custom[Ayuda.ThisOrThat](Toggle=DataAsStrings, Item1=toggle_5.in, Item2=toggle_6.in)
West = Output(thisOrThat_3)
toggle_7 = Custom[Rhythm.Toggle](list=code_block_14.t4, boolean=RunMe)
toggle_8 = Custom[Rhythm.Toggle](list=code_block_13.t3, boolean=RunMe)
thisOrThat_4 = Custom[Ayuda.ThisOrThat](Toggle=DataAsStrings, Item1=toggle_7.in, Item2=toggle_8.in)
South = Output(thisOrThat_4)
now = DateTime.Now()
string_from_object_6 = FromObject(now)
toggle_9 = Custom[Rhythm.Toggle](list=string_from_object_6, boolean=RunMe)
CurrentRunTIme = Output(toggle_9.in)
