# Dynamo custom node Rhythm.RenumberGridsByCurve.dyf (Dynamo 0.9.0.3067)
# category: Rhythm.Tools
# This node will renumber grids in order of curve drawn through them. Select either letters or numbers. (Alphanumeric coming soon)

ModelCurve = Input()
RunMe = Input(RunMe : bool = false)

# group: Selects your grids by model line
categories = Categories("Grids")
select_elements_by_curve = Custom[Select Elements By Curve](ModelCurve=ModelCurve, Category=categories, RunMe=RunMe)  # This will select model elements in order that a curve is drawn through them.

count = Count(select_elements_by_curve)

# group: Sets the grids to a temporary unused number
code_block = CodeBlock(x=count) { "Name"; y=900+(x-1); 900..y..1; }
string_from_object = FromObject(code_block.out2)
setParameterByName = Element.SetParameterByName(element=select_elements_by_curve, parameterName=code_block.out0, value=string_from_object)

TrueForLettersFalseForNumbers = Input(TrueForLettersFalseForNumbers : bool = true)
boolean = BoolSelector(false)
architecturalAlphabeticalSequence = Custom[List.ArchitecturalAlphabeticalSequence](amount=count, skipIO=boolean)  # This creates a list of characters. What's different is we typically exclude I's and O's from our characters.
StartNumber = Input(StartNumber : int = 1)

# group: if you want numbers this does it
code_block_2 = CodeBlock(startnumber=StartNumber, x=count) { "Name"; y=startnumber+(x-1); startnumber..y..1; }
string_from_object_2 = FromObject(code_block_2.out2)

thisOrThat = Custom[Ayuda.ThisOrThat](Toggle=TrueForLettersFalseForNumbers, Item1=architecturalAlphabeticalSequence, Item2=string_from_object_2)  # This node is a toggle between two inputs.
setParameterByName_2 = Element.SetParameterByName(element=setParameterByName, parameterName=code_block.out0, value=thisOrThat)
clean = Custom[Output.Clean](input=setParameterByName_2)  # This will return a single value or list from one input.
