# Dynamo custom node Rhythm.RenumberRoomsByCurve.dyf (Dynamo 1.2.1.3083)
# category: Rhythm.Tools
# This node will renumber rooms along a curve path. This was developed through the guidance of WIlliam Wong at case. Considering WeWork bought Case I wanted this node to live somewhere.

SelectModelCurve = Input()
RunMe = Input(RunMe : bool = false)
toggle = Custom[Rhythm.Toggle](list=SelectModelCurve, boolean=RunMe)  # Toggle that offers two outputs. Created for Dynamo 0.8.1 because of changes to the "IF" node

# group: Model curve drawn through rooms
curve = CurveElement.Curve(toggle.in)
code_block = CodeBlock { 0..1..#400; }

pointAtParameter = Curve.PointAtParameter(curve=curve, param=code_block, lacing=CrossProduct)
splitByPoints = Curve.SplitByPoints(curve=curve, points=pointAtParameter)

# group (continued): Model curve drawn through rooms
endPoint = Curve.EndPoint(splitByPoints)

flatten = Flatten(endPoint)

# group: Getting rooms bounding box
categories = Categories("Rooms")
all_elements_of_category = ElementsOfCategory(categories)

toggle_2 = Custom[Rhythm.Toggle](list=all_elements_of_category, boolean=RunMe)

# group (continued): Getting rooms bounding box
boundingBox = Geometry.BoundingBox(toggle_2.in)
contains = BoundingBox.Contains(boundingBox)  # unwired: arg1

map = List.Map(list=flatten, f_x=contains)
filterByBoolMask = List.FilterByBoolMask(list=all_elements_of_category)  # unwired: mask
map_2 = List.Map(list=map, f_x=filterByBoolMask.in)
flatten_2 = Flatten(map_2)
uniqueItems = List.UniqueItems(flatten_2)
code_block_2 = CodeBlock { "Number"; }
StartNumber = Input(StartNumber : int = 100)
count = Count(uniqueItems)
code_block_3 = CodeBlock(a=StartNumber, x=count) { a..#x..1; }
string_from_object = FromObject(code_block_3)
setParameterByName = Element.SetParameterByName(element=uniqueItems, parameterName=code_block_2, value=string_from_object)
isNull = Object.IsNull(setParameterByName)
code_block_4 = CodeBlock { "Run me set to false"; }
thisOrThat = Custom[Ayuda.ThisOrThat](Toggle=isNull, Item1=code_block_4, Item2=setParameterByName)  # This node is a toggle between two inputs.
