# Dynamo custom node Rhythm.TextBoxInput.dyf (Dynamo 1.3.0.875)
# category: Rhythm.Core.Input
# Provides a text box input for users. Allows for multiple strings if needed.

python_script = Python()
# ---------- python_script.python (8 lines) ----------
import clr
import sys

pyt_path = r'C:\Program Files (x86)\IronPython 2.7\Lib'
sys.path.append(pyt_path)

import os
OUT = os.getenv('APPDATA')
# ----------------------------------------
string = StringInput("\Dynamo\Dynamo Revit\")
python_script_2 = Python()  # unwired: IN[0]
# ---------- python_script_2.python (3 lines) ----------
from System.Reflection import Assembly
dynamo = Assembly.Load('DynamoCore')
OUT = dynamo.GetName().Version
# ----------------------------------------
string_from_object = FromObject(python_script_2)
length = String.Length(string_from_object)
code_block = CodeBlock(len=length) { 3; len-3; }
remove = String.Remove(str=string_from_object, startIndex=code_block.out0, count=code_block.out1)
string_2 = StringInput("\packages\Rhythm\extra\rhythm-logo-smaller.png")
concat = String.Concat(python_script, string, remove, string_2)
reset = Input(reset : bool = false)
python_script_3 = Python(IN[0]=concat, IN[1]=reset)
# ---------- python_script_3.python (67 lines) ----------
#Based on the code generously provided at http://zetcode.com/tutorials/ironpythontutorial/controlsII/
#Made for Dynamo by John Pierson
import clr
clr.AddReference("System.Windows.Forms")
clr.AddReference("System.Drawing")

from System.Windows.Forms import Application, Form, StatusBar
from System.Windows.Forms import RadioButton, GroupBox, Label, Button, AnchorStyles, DockStyle, PictureBox, PictureBoxSizeMode, TextBox
from System.Windows.Forms import TrackBar, TickStyle
from System.Drawing import Size, Point, Font, Color, Image

pathToFile = IN[0]

class IForm(Form):

	def __init__(self):

		self.Text = IN[0]

		image = Image.FromFile(pathToFile)
		pictureBox = PictureBox()
		pictureBox.Size = Size(250,110)
		pictureBox.Location = Point(25,0)
		pictureBox.Image = image
		#pictureBox.Dock = DockStyle.Top
        
		self.output1 = []
		self.Font = Font("Arial",12)
		self.BackColor = Color.White

		self.label = Label()
		self.label.Text = "enter your value below"
		self.label.Location = Point(25, 125)
		self.label.Height = 25
		self.label.Width = 175
		self.label.Font = Font("OpenSans",12)

		self.textbox = TextBox()
		self.textbox.Text = ""
		self.textbox.Location = Point(25, 150)
		self.textbox.Width = 250
		self.textbox.Font = Font("OpenSans",10)

		self.button1 = Button()
		self.button1.Text = 'apply and close'
		self.button1.Location = Point(25, 200)
		self.button1.Click += self.update
		self.button1.Width = 250

		self.AcceptButton = self.button1

		self.Controls.Add(self.label)
		self.Controls.Add(self.textbox)
		self.Controls.Add(self.button1)
		self.Controls.Add(pictureBox)
		self.CenterToScreen()
		self.AutoSize = True

	def update(self, sender, event):
		self.label.Text = self.textbox.Text
		self.output1.append(self.textbox.Text)
		self.Close()


form = IForm()
Application.Run(form)
OUT = form.output1
# ----------------------------------------
clean = Custom[Output.Clean](input=python_script_3)  # This will return a single value or list from one input.
string_3 = Output(clean)  # "string"
