# Dynamo custom node Rhythm.Toggle.dyf (Dynamo 0.8.0.950)
# category: Rhythm.Tools
# Toggle that offers two outputs. Created for Dynamo 0.8.1 because of changes to the "IF" node

list = Input(list : var[]..[])
boolean = Input(boolean : bool)
count = Count(list)
cycle = List.Cycle(list=boolean, amount=count)
filterByBoolMask = List.FilterByBoolMask(list=list, mask=cycle)
in_ = Output(filterByBoolMask.in)  # "in"
out = Output(filterByBoolMask.out)
