# Dynamo custom node Rhythm.WhatTheNode.dyf (Dynamo 1.0.0.1180)
# category: Rhythm.Tools
# This node will let you search dynamonodes.com for the most likely package a node is from. Helps fix "red" nodes when users do not have package installed.

string = StringInput("https://dynamonodes.com/?s=")
nodeInQuestion = Input(nodeInQuestion : string)
code_block = CodeBlock { " "; "+"; }
replace = String.Replace(str=nodeInQuestion, searchFor=code_block.out0, replaceWith=code_block.out1)
concat = String.Concat(string, replace)
web_request = WebRequest(concat)
string_2 = StringInput("<h1 class=\"page-title\">Search Results for: <span>theNewSearch</span></h1>")
code_block_2 = CodeBlock { "theNewSearch"; }
replace_2 = String.Replace(str=string_2, searchFor=code_block_2, replaceWith=nodeInQuestion)
indexOf = String.IndexOf(string=web_request, searchFor=replace_2)
code_block_3 = CodeBlock(n=indexOf) { 0; n-1; }
remove = String.Remove(str=web_request, startIndex=code_block_3.out0, count=code_block_3.out1)
string_3 = StringInput("node-index/\" rel=\"bookmark\">")
string_4 = StringInput("</a></h1>")
split = String.Split(remove, string_3, string_4)
code_block_4 = CodeBlock { "Index"; }
contains = String.Contains(str=split, searchFor=code_block_4)
filterByBoolMask = List.FilterByBoolMask(list=split, mask=contains)
firstItem = List.FirstItem(filterByBoolMask.in)
code_block_5 = CodeBlock { "Node"; }
lastIndexOf = String.LastIndexOf(firstItem, code_block_5)
length = String.Length(firstItem)
code_block_6 = CodeBlock(length=length, index=lastIndexOf) { length-index; }
remove_2 = String.Remove(str=firstItem, startIndex=lastIndexOf, count=code_block_6)
likelyPackage = Output(remove_2)
