# Dynamo custom node Rhythm.YesNoToggle.dyf (Dynamo 1.2.1.3083)
# category: Rhythm.Core.Input
# This provides a toggle to use for graphs with dynamo player. The user chooses if they would like to run the graph.

functionToPass = Input()
title = Input(title : string = "title")
instructions = Input(instructions : string = "instructions go here")

# group: End buffer
length = String.Length(instructions)
string = StringInput("""

                                                         

                                  

nothing to see here   ¯\_(ツ)_/¯""")
insert = String.Insert(str=instructions, index=length, toInsert=string)

currentUserAppData = Custom[OS.CurrentUserAppData]()  # This retrieves the current user's appdata location
string_2 = StringInput("\Dynamo\Dynamo Revit\1.2\packages\Rhythm\extra\rhythm-logo-smaller.png")
add = currentUserAppData + string_2
refresh = Input(refresh : bool = false)
python_script = Python(IN[0]=title, IN[1]=insert, IN[2]=add, IN[3]=refresh)
# ---------- python_script.python (86 lines) ----------
#Based on the code generously provided at http://zetcode.com/tutorials/ironpythontutorial/controlsII/
#Made for Dynamo by John Pierson
import clr
clr.AddReference("System.Windows.Forms")
clr.AddReference("System.Drawing")

from System.Windows.Forms import Application, Form, StatusBar
from System.Windows.Forms import RadioButton, GroupBox, Label, Button, AnchorStyles, DockStyle, PictureBox, PictureBoxSizeMode
from System.Windows.Forms import TrackBar, TickStyle
from System.Drawing import Size, Point, Font, Color, Image

pathToFile = IN[2]

class IForm(Form):

	def __init__(self):

		self.Text = IN[0]

		image = Image.FromFile(pathToFile)
		pictureBox = PictureBox()
		pictureBox.Size = Size(250,110)
		pictureBox.Location = Point(25,0)
		pictureBox.Image = image
		#pictureBox.Dock = DockStyle.Top
        
		self.Output1 = []
		self.Font = Font("Arial",12)
		self.BackColor = Color.White

		self.label0 = Label()
		self.label0.Text = IN[0]
		self.label0.Location = Point(25, 125)
		self.label0.AutoSize = True
		self.label0.MaximumSize= Size(400,0)
		self.label0.Font = Font("Arial",18)
		self.label0.ForeColor = Color.RoyalBlue
		
		self.label1 = Label()
		self.label1.Text = IN[1]
		self.label1.Location = Point(25, 170)
		self.label1.AutoSize = True
		self.label1.MaximumSize= Size(400,0)
		self.label1.Font = Font("Arial",12)
		
		gb = GroupBox()
		gb.Font = Font("Arial",11)
		gb.Text = "Continue?"
		gb.Size = Size(240, 70)

		gb.Parent = self
		gb.Dock = DockStyle.Bottom
		
		yes = RadioButton()
		yes.Font = Font("Arial",11)
		yes.Text = "Yes"
		yes.Parent = gb
		yes.Location = Point(10, 30)
		yes.CheckedChanged += self.OnChanged
		
		no = RadioButton()
		no.Font = Font("Arial",11)
		no.Text = "No"
		no.Parent = gb
		no.Location = Point(120, 30)
		no.CheckedChanged += self.OnChanged
		
		self.statusbar = StatusBar()
		self.statusbar.Parent = self
		
		self.Controls.Add(pictureBox)
		self.Controls.Add(self.label1)
		self.Controls.Add(self.label0)
		self.CenterToScreen()
		self.AutoSize = True

	def OnChanged(self, sender, event):
		if sender.Checked:
			self.statusbar.Text = sender.Text
			self.Output1.append(sender.Text)
			self.Close()

form = IForm()
Application.Run(form)

OUT = form.Output1
# ----------------------------------------
code_block = CodeBlock { "Yes"; }
eq = python_script == code_block
firstItem = List.FirstItem(eq)
filterByBoolMask = List.FilterByBoolMask(list=functionToPass, mask=firstItem)
firstItem_2 = List.FirstItem(filterByBoolMask.in)
var = Output(firstItem_2)
