# Dynamo custom node Room Element Collector.dyf (Dynamo 0.8.2.2392)
# category: Rhythm.Tools
# THis will collect data regarding rooms in the active model. Similar to Lunchbox node, but this one does not use python.

categories = Categories("Rooms")
all_elements_of_category = ElementsOfCategory(categories)
RunMe = Input(RunMe : bool = false)
toggle = Custom[Rhythm.Toggle](list=all_elements_of_category, boolean=RunMe)  # Toggle that offers two outputs. Created for Dynamo 0.8.1 because of changes to the "IF" node
code_block = CodeBlock { "Name"; "Number"; "Area"; }
getParameterValueByName = Element.GetParameterValueByName(element=toggle.in, parameterName=code_block.out0)
Name = Output(getParameterValueByName)
getParameterValueByName_2 = Element.GetParameterValueByName(element=toggle.in, parameterName=code_block.out1)
Number = Output(getParameterValueByName_2)
getParameterValueByName_3 = Element.GetParameterValueByName(element=toggle.in, parameterName=code_block.out2)
Area = Output(getParameterValueByName_3)
getLevelNameAsString = Custom[Element.GetLevelNameAsString](element_s=toggle.in)  # This retrieves the level name of the input elements as a string. This is in response to a known issue with the get value node.
Level_Name = Output(getLevelNameAsString)
solids = Element.Solids(toggle.in)
code_block_2 = CodeBlock { 0; }
code_block_3 = CodeBlock { true; }
level_element_collector = Custom[Level Element Collector](RunMe=code_block_3)  # This collects data for all of the Level elements in the model. Similar to the node on Lunchbox, but this one uses all O.O.B. nodes.
contains = Custom[List.Contains](list=getLevelNameAsString, item=level_element_collector.Name)  # Determines if the given list contains the item or items.
filterByBoolMask = List.FilterByBoolMask(list=level_element_collector.Elevation, mask=contains)
byCoordinates = Point.ByCoordinates(x=code_block_2, y=code_block_2, z=filterByBoolMask.in)
XY = Plane.XY()
normal = Plane.Normal(XY)
byOriginNormal = Plane.ByOriginNormal(origin=byCoordinates, normal=normal)
intersectAll = Geometry.IntersectAll(geometry=solids, others=byOriginNormal, lacing=CrossProduct)
flatten = Flatten(intersectAll)
perimeterCurves = Surface.PerimeterCurves(flatten)
Boundaries = Output(perimeterCurves)
id = Element.Id(toggle.in)
Element_ID = Output(id)
uniqueId = Element.UniqueId(toggle.in)
Unique_ID = Output(uniqueId)
Elements = Output(toggle.in)
