# Dynamo custom node Select Grids By Curve.dyf (Dynamo 1.3.2.2480)
# category: Rhythm.Revit.Selection.Selection
# This will select Revit grids by the input Revit curve,

modelCurve = Input()
geometry = Element.Geometry(modelCurve)
categories = Categories("Grids")
all_elements_of_category = ElementsOfCategory(categories)
curve = Grid.Curve(all_elements_of_category)
code_block = CodeBlock(curve=curve) { curve[0]; }
startPoint = Curve.StartPoint(code_block)
byOriginNormal = Plane.ByOriginNormal(origin=startPoint)
pullOntoPlane = Curve.PullOntoPlane(curve=geometry, plane=byOriginNormal, lacing=Longest)
intersectAll = Geometry.IntersectAll(geometry=pullOntoPlane, others=curve, lacing=Longest)
flatten = Flatten(intersectAll)
code_block_2 = CodeBlock { false; }
clean = List.Clean(list=flatten, preserveIndices=code_block_2)
splitByPoints = Curve.SplitByPoints(curve=pullOntoPlane, points=clean)
endPoint = Curve.EndPoint(splitByPoints)
flatten_2 = Flatten(endPoint)
doesIntersect = Geometry.DoesIntersect(other=curve)  # unwired: geometry
map = List.Map(list=flatten_2, f_x=doesIntersect)
filterByBoolMask = List.FilterByBoolMask(list=all_elements_of_category)  # unwired: mask
map_2 = List.Map(list=map, f_x=filterByBoolMask.in)
flatten_3 = Flatten(map_2)
uniqueItems = List.UniqueItems(flatten_3)
grids = Output(uniqueItems)
