# Dynamo custom node SetParameterByName(TypeOrInstance).dyf (Dynamo 0.8.2.2392)
# category: Rhythm.Revit.Elements.Element.Actions
# Set one of the element's parameters regardless of parameter type or instance.

element = Input()

# group: Element.Type from Andreas' Dieckmann's Clockwork Package
empty = List.Empty()
addItemToFront = List.AddItemToFront(item=element, list=empty)
flatten = Flatten(addItemToFront)
python_script = Python(IN[0]=flatten)
# ---------- python_script.python (17 lines) ----------
import clr
clr.AddReference('RevitAPI')
from Autodesk.Revit.DB import *

clr.AddReference("RevitServices")
import RevitServices
from RevitServices.Persistence import DocumentManager

doc = DocumentManager.Instance.CurrentDBDocument
items = UnwrapElement(IN[0])
typelist = list()
for item in items:
	try: 
		typelist.append(doc.GetElement(item.GetTypeId()))
	except:
		typelist.append(list())
OUT = typelist
# ----------------------------------------

parameters = Element.Parameters(python_script)
flatten_2 = Flatten(parameters)
string_from_object = FromObject(parameters)
flatten_3 = Flatten(string_from_object)
code_block = CodeBlock { ":"; 1; }
indexOf = String.IndexOf(string=flatten_3, searchFor=code_block.out0)
sub = indexOf - code_block.out1
length = String.Length(flatten_3)
sub_2 = length - sub
remove = String.Remove(str=flatten_3, startIndex=sub, count=sub_2)
parameterName = Input()
contains = Custom[List.Contains](list=remove, item=parameterName)  # Determines if the given list contains the item or items.
filterByBoolMask = List.FilterByBoolMask(list=flatten_2, mask=contains)
isEmpty = List.IsEmpty(filterByBoolMask.in)
value = Input()
setParameterByName = Element.SetParameterByName(element=element, parameterName=parameterName, value=value)
setParameterByName_2 = Element.SetParameterByName(element=python_script, parameterName=parameterName, value=value)
if_ = If(test=isEmpty, true=setParameterByName, false=setParameterByName_2)
clean = Custom[Output.Clean](input=if_)  # This will return a single value or list from one input.
Element = Output(clean)
