# Dynamo custom node Space.IsPointInside.dyf (Dynamo 1.0.0.1180)
# category: Rhythm.Revit.Elements.Space.Query
# This will test if a point falls within a space.

space = Input()
point = Input(point : Autodesk.Point)  # point to test
code_block = CodeBlock(item1=space, item2=point) { Flatten({item1}); Flatten({item2}); }
python_script = Python(IN[0]=code_block.out0, IN[1]=code_block.out1)
# ---------- python_script.python (23 lines) ----------
import clr
clr.AddReference('RevitAPI')
from Autodesk.Revit.DB import *

clr.AddReference("RevitNodes")
import Revit
clr.ImportExtensions(Revit.GeometryConversion)

rooms = UnwrapElement(IN[0])
points = [x.ToXyz() for x in IN[1]]
roomlist = list()
for point in points:
	booleans = list()
	for room in rooms:
		try:
			if room.IsPointInSpace(point):
				booleans.append(True)
			else:
				booleans.append(False)
		except:
			booleans.append(False)
	roomlist.append(booleans)
OUT = roomlist
# ----------------------------------------
flatten = Flatten(python_script)
clean = Custom[Output.Clean](input=flatten)  # This will return a single value or list from one input.
mask = Output(clean)
