# Dynamo custom node SpaceType.All.dyf (Dynamo 1.0.0.1180)
# category: Rhythm.Revit.Elements.SpaceType
# This node will output ALL space types.

python_script = Python()
# ---------- python_script.python (20 lines) ----------
import clr
clr.AddReference('ProtoGeometry')
from Autodesk.DesignScript.Geometry import *

# Import DocumentManager and TransactionManager
clr.AddReference("RevitServices")
import RevitServices
from RevitServices.Persistence import DocumentManager
from RevitServices.Transactions import TransactionManager

doc = DocumentManager.Instance.CurrentDBDocument

# Import RevitAPI
clr.AddReference("RevitAPI")
import Autodesk
from Autodesk.Revit.DB.Mechanical import *
import System

#Assign your output to the OUT variable
OUT = SpaceType().kActiveStorage,SpaceType().kActiveStorageHospitalOrHealthcare,SpaceType().kAirOrTrainOrBusBaggageArea,SpaceType().kAirportConcourse,SpaceType().kAtriumEachAdditionalFloor,SpaceType().kAtriumFirstThreeFloors,SpaceType().kAudienceOrSeatingAreaPenitentiary,SpaceType().kAudienceOrSeatingAreaExerciseCenter,SpaceType().kAudienceOrSeatingAreaGymnasium,SpaceType().kAudienceOrSeatingAreaSportsArena,SpaceType().kAudienceOrSeatingAreaConventionCenter,SpaceType().kAudienceOrSeatingAreaMotionPictureTheatre,SpaceType().kAudienceOrSeatingAreaPerformingArtsTheatre,SpaceType().kAudienceOrSeatingAreaReligious,SpaceType().kAudienceOrSeatingAreaPoliceOrFireStations,SpaceType().kAudienceOrSeatingAreaCourtHouse,SpaceType().kAudienceOrSeatingAreaAuditorium,SpaceType().kBankCustomerArea,SpaceType().kBankingActivityAreaOffice,SpaceType().kBarberAndBeautyParlor,SpaceType().kCardFileAndCataloguingLibrary,SpaceType().kClassroomOrLectureOrTrainingPenitentiary,SpaceType().kClassroomOrLectureOrTraining,SpaceType().kComfinementCellsPenitentiary,SpaceType().kComfinementCellsCourtHouse,SpaceType().kConferenceMeetingOrMultipurpose,SpaceType().kCorridorOrTransition,SpaceType().kCorridorOrTransitionManufacturingFacility,SpaceType().kCorridorsWithPatientWaitingExamHospitalOrHealthcare,SpaceType().kCourtSportsAreaSportsArena,SpaceType().kCourtroomCourtHouse,SpaceType().kDepartmentStoreSalesAreaRetail,SpaceType().kDetailedManufacturingFacility,SpaceType().kDiningArea,SpaceType().kDiningAreaHotel,SpaceType().kDiningAreaFamilyDining,SpaceType().kDiningAreaLoungeOrLeisureDining,SpaceType().kDiningAreaMotel,SpaceType().kDiningAreaTransportation,SpaceType().kDiningAreaPenitentiary,SpaceType().kDiningAreaCivilServices,SpaceType().kDormitoryBedroom,SpaceType().kDormitoryStudyHall,SpaceType().kDressingOrLockerOrFittingRoomGymnasium,SpaceType().kDressingOrLockerOrFittingRoomCourtHouse,SpaceType().kDressingOrLockerOrFittingRoomPerformingArtsTheatre,SpaceType().kDressingOrLockerOrFittingRoomAuditorium,SpaceType().kDressingOrLockerOrFittingRoomExerciseCenter,SpaceType().kElectricalOrMechanical,SpaceType().kElevatorLobbies,SpaceType().kEmergencyHospitalOrHealthcare,SpaceType().kEquipmentRoomManufacturingFacility,SpaceType().kExamOrTreatmentHospitalOrHealthcare,SpaceType().kExerciseAreaExerciseCenter,SpaceType().kExerciseAreaGymnasium,SpaceType().kExhibitSpaceConventionCenter,SpaceType().kFellowshipHallReligiousBuildings,SpaceType().kFineMaterialWarehouse,SpaceType().kFineMerchandiseSalesAreaRetail,SpaceType().kFireStationEngineRoomPoliceOrFireStation,SpaceType().kFoodPreparation,SpaceType().kGarageServiceOrRepairAutomotiveFacility,SpaceType().kGeneralHighBayManufacturingFacility,SpaceType().kGeneralLowBayManufacturingFacility,SpaceType().kGeneralExhibitionMuseum,SpaceType().kHospitalNurseryHospitalOrHealthcare,SpaceType().kHospitalOrMedicalSuppliesHospitalOrHealthcare,SpaceType().kHospitalOrRadiologyHospitalOrHealthcare,SpaceType().kHotelOrConferenceCenterConferenceOrMeeting,SpaceType().kInactiveStorage,SpaceType().kJudgesChambersCourtHouse,SpaceType().kLaboratoryOffice,SpaceType().kLaundryIroningAndSorting,SpaceType().kLaundryWashingHospitalOrHealthcare,SpaceType().kLibraryAudioVisualLibraryAudioVisual,SpaceType().kLivingQuartersDormitory,SpaceType().kLivingQuartersMotel,SpaceType().kLivingQuartersHotel,SpaceType().kLobby,SpaceType().kLobbyReligiousBuildings,SpaceType().kLobbyMotionPictureTheatre,SpaceType().kLobbyAuditorium,SpaceType().kLobbyPerformingArtsTheatre,SpaceType().kLobbyPostOffice,SpaceType().kLobbyHotel,SpaceType().kLoungeOrRecreation,SpaceType().kMallConcourseSalesAreaRetail,SpaceType().kMassMerchandisingSalesAreaRetail,SpaceType().kMediumOrBulkyMaterialWarehouse,SpaceType().kMerchandisingSalesAreaRetail,SpaceType().kMuseumAndGalleryStorage,SpaceType().kNurseStationHospitalOrHealthcare,SpaceType().kOfficeEnclosed,SpaceType().kOfficeOpenPlan,SpaceType().kOfficeCommonActivityAreasInactiveStorage,SpaceType().kOperatingRoomHospitalOrHealthcare,SpaceType().kOtherTelevisedPlayingAreaSportsArena,SpaceType().kParkingAreaAttendantOnlyParkingGarage,SpaceType().kParkingAreaPedestrianParkingGarage,SpaceType().kPatientRoomHospitalOrHealthcare,SpaceType().kPersonalServicesSalesAreaRetail,SpaceType().kPharmacyHospitalOrHealthcare,SpaceType().kPhysicalTherapyHospitalOrHealthcare,SpaceType().kPlayingAreaGymnasium,SpaceType().kPlenum,SpaceType().kPoliceStationLaboratoryPoliceOrFireStations,SpaceType().kPublicAndStaffLoungeHospitalOrHealthcare,SpaceType().kReadingAreaLibrary,SpaceType().kReceptionOrWaitingTransportation,SpaceType().kReceptionOrWaitingMotel,SpaceType().kReceptionOrWaitingHotel,SpaceType().kRecoveryHospitalOrHealthcare,SpaceType().kRestorationMuseum,SpaceType().kRestrooms,SpaceType().kRingSportsAreaSportsArena,SpaceType().kSleepingQuartersPoliceOrFireStation,SpaceType().kSortingAreaPostOffice,SpaceType().kSpecialtyStoreSalesAreaRetail,SpaceType().kStacksLibrary,SpaceType().kStairsInactive,SpaceType().kStairway,SpaceType().kSupermarketSalesAreaRetail,SpaceType().kTerminalTicketCounterTransportation,SpaceType().kWorkshopWorkshop,SpaceType().kWorshipPulpitChoirReligious,SpaceType().kNoOfSpaceTypes
# ----------------------------------------
spaceTypes = Output(python_script)
