# Dynamo custom node SpaceType.ByName.dyf (Dynamo 1.0.0.1180)
# category: Rhythm.Revit.Elements.SpaceType
# This will output a MEP space type based on name search.

all = Custom[SpaceType.All]()  # This node will output ALL space types.
string_from_object = FromObject(all)
spaceTypeName = Input(spaceTypeName : string = "")  # search info for space type name not case sensitive and non-specific
code_block = CodeBlock { " "; ""; }
replace = String.Replace(str=spaceTypeName, searchFor=code_block.out0, replaceWith=code_block.out1)
code_block_2 = CodeBlock { true; }
contains = String.Contains(str=string_from_object, searchFor=replace, ignoreCase=code_block_2)
filterByBoolMask = List.FilterByBoolMask(list=all, mask=contains)
deconstruct = List.Deconstruct(list=filterByBoolMask.in)
closestSpaceType = Output(deconstruct.first)
otherRelatedSpaceTypes = Output(deconstruct.rest)
