# Dynamo custom node SquareFeetDropper.dyf (Dynamo 0.9.0.3067)
# category: Rhythm.Core.List.Actions
# This node drops square feet from the pulled area

Values = Input()
length = String.Length(Values)
code_block = CodeBlock { -3; }
remove = String.Remove(str=Values, startIndex=length, count=code_block)
Cleaned = Output(remove)
