# Dynamo custom node String.CharacterAtIndex.dyf (Dynamo 0.8.0.950)
# category: Rhythm.Core.String.Actions
# Get's the character at a given index

code_block = CodeBlock()
# ---------- code_block.designscript (4 lines) ----------
def CharacterAtIndex (x,y)
{
return=x[y];
};
# ----------------------------------------
List = Input()
Index = Input()
code_block_2 = CodeBlock(x=List, y=Index) { CharacterAtIndex(x,y); }
Character = Output(code_block_2)
