# Dynamo custom node String.ElementsModified.dyf (Dynamo 0.9.0.3067)
# category: Rhythm.Core.String.Query
# THis custom node reports the amount of elements in a list as a phrase.

list = Input()

# group: This provides feedback on the amount of elements modified
string = StringInput("[] Element(s) Modifed")
string_2 = StringInput("[]")
count = Count(list)
string_from_object = FromObject(count)
replace = String.Replace(str=string, searchFor=string_2, replaceWith=string_from_object)
str = Output(replace)
