# Dynamo custom node String.FlipReverse.dyf (Dynamo 0.8.0.950)
# category: Rhythm.Core.String.Actions
# This node flips the string and reverses it. (April Fools '15) Works for 0.8.0 only, added unicode support

String = Input()
toLower = String.ToLower(String)
python_script = Python(IN[0]=toLower)
# ---------- python_script.python (31 lines) ----------
import clr
clr.AddReference('ProtoGeometry')
from Autodesk.DesignScript.Geometry import *
#The inputs to this node will be stored as a list in the IN variable.
dataEnteringNode = IN

# define our method
def replace_all(text, dic):
    for i, j in dic.iteritems():
        text = text.replace(i, j)
    return text
 
# our text the replacement will take place
my_text = IN[0]
 
# our dictionary with our key:values.
# we want to replace 'H' with '|-|'
# 'e' with '3' and 'o' with '0'
reps = {'a' : 'ɐ', 'b' : 'q', 'c' : 'ɔ', 'd' : 'p', 'e' : 'ǝ', 'f' : 'ɟ', 'g' : 'ƃ', 'h' : 'ɥ', 'i' : 'ı', 'j' : 'ɾ', 'k' : 'ʞ', 'l' : 'l', 'm' : 'ɯ', 'n' : 'u', 'o' : 'o', 'p' : 'd', 'q' : 'b', 'r' : 'ɹ', 's' : 's', 't' : 'ʇ', 'u' : 'n', 'v' : 'ʌ', 'w' : 'ʍ', 'x' : 'x', 'y' : 'ʎ', 'z' : 'z', "." : '˙', '!' : '¡', '?' : '¿'}

# bind the returned text of the method
# to a variable and print it
txt = replace_all(my_text, reps)
print txt    # it prints '|-|3ll0 3v3ryb0dy'
 
# of course we can print the result
# at once with:
# print replace_all(my_text, reps)

#Assign your output to the OUT variable
OUT = txt[::-1]
# ----------------------------------------
Modified = Output(python_script)
