# Dynamo custom node String.IndicesOfCharacter.dyf (Dynamo 0.8.1.1823)
# category: Rhythm.Core.String
# This node gets all the indices of a given character

str = Input(str : string)
code_block = CodeBlock { ""; }
split = String.Split(str, code_block)
character = Input(character : string)
ignoreCase = Input(ignoreCase : bool=false)
toggle = Custom[Rhythm.Toggle](list=character, boolean=ignoreCase)  # Toggle that offers two outputs. Created for Dynamo 0.8.1 because of changes to the "IF" node
allIndicesOf = Custom[List.AllIndicesOf](list=split, indices=toggle.out)  # Given an item, returns the zero-based indices of all its occurrences in the list. If the item cannot be found, an empty list is returned.
toLower = String.ToLower(toggle.in)
allIndicesOf_2 = Custom[List.AllIndicesOf](list=split, indices=toLower)
code_block_2 = CodeBlock(in1=allIndicesOf, in2=allIndicesOf_2) { Flatten({in1,in2}); }
int = Output(code_block_2)
