# Dynamo custom node String.RemoveAfterGivenCharacter.dyf (Dynamo 0.8.0.950)
# category: Rhythm.Core.String.Actions
# This will move all characters at and after the given character.

str = Input(str : string)
Character = Input()
ignoreCase = Input(ignoreCase : bool=false)
indexOf = String.IndexOf(string=str, searchFor=Character, ignoreCase=ignoreCase)
length = String.Length(str)
code_block = CodeBlock(in1=length, in2=indexOf) { out1=in1-in2; out1; }
remove = String.Remove(str=str, startIndex=indexOf, count=code_block.out1)
string = Output(remove)
