# Dynamo custom node String.RemovePriorToCharacter.dyf (Dynamo 1.2.0.2690)
# category: Rhythm.Core.String.Actions
# This will remove all characters prior to the input character. Accepts strings.

str = Input(str : string)
Character = Input()
ignoreCase = Input(ignoreCase : bool=false)
indexOf = String.IndexOf(string=str, searchFor=Character, ignoreCase=ignoreCase)
code_block = CodeBlock(in1=indexOf) { in2=in1; in2*-1-1; }
removeInitalCharacter = Input(removeInitalCharacter : bool=false)
code_block_2 = CodeBlock { 0; }
eq = code_block.in2 == code_block_2
if_ = If(test=eq, true=code_block_2, false=code_block.out1)
thisOrThat = Custom[Ayuda.ThisOrThat](Toggle=removeInitalCharacter, Item1=code_block.out1, Item2=if_)  # This node is a toggle between two inputs.
remove = String.Remove(str=str, startIndex=code_block.in2, count=thisOrThat)
Modifed = Output(remove)
