# Dynamo custom node String.SpecifyDecimalPlaces.dyf (Dynamo 0.8.1.1823)
# category: Rhythm.Core.String
# This node will take your inout string and number of decimal places to create a new simplified output.

str = Input()
code_block = CodeBlock { "."; }
split = String.Split(str, code_block)
count = List.Count(split)
code_block_2 = CodeBlock { 2; }
le = count <= code_block_2

# group: Special thanks to Mark Thorley for this definition. Check out Zebra package for more.
code_block_3 = CodeBlock()
# ---------- code_block_3.designscript (15 lines) ----------
def oldif(test,iftrue:var[]..[],
iffalse:var[]..[])
{
return = [Imperative]
{
if (test)
{
return = iftrue;
}
else
{
return = iffalse;
}
}
};
# ----------------------------------------
code_block_4 = CodeBlock(test=le, iftrue=split, iffalse=split) { oldif(test,iftrue,iffalse); }

code_block_5 = CodeBlock { 0; 1; }
getItemAtIndex = List.GetItemAtIndex(index=code_block_5.out0)
map = List.Map(list=code_block_4, f_x=getItemAtIndex)
getItemAtIndex_2 = List.GetItemAtIndex(index=code_block_5.out1)
map_2 = List.Map(list=code_block_4, f_x=getItemAtIndex_2)
numOfDecimalPlaces = Input(numOfDecimalPlaces : int = 2)

# group: Removes the extra zeros
length = String.Length(map_2)
sub = length - numOfDecimalPlaces
remove = String.Remove(str=map_2, startIndex=numOfDecimalPlaces, count=sub)
code_block_6 = CodeBlock { 0; "."; }
insert = String.Insert(str=remove, index=code_block_6.out0, toInsert=code_block_6.out1)

add = map + insert
isNull = Object.IsNull(add)
uniqueItems = List.UniqueItems(isNull)
code_block_7 = CodeBlock { 0; 1; }
getItemAtIndex_3 = List.GetItemAtIndex(list=code_block_4, index=code_block_7.out0)
getItemAtIndex_4 = List.GetItemAtIndex(list=code_block_4, index=code_block_7.out1)

# group: Removes the extra zeros
length_2 = String.Length(getItemAtIndex_4)
sub_2 = length_2 - numOfDecimalPlaces
remove_2 = String.Remove(str=getItemAtIndex_4, startIndex=numOfDecimalPlaces, count=sub_2)
code_block_8 = CodeBlock { 0; "."; }
insert_2 = String.Insert(str=remove_2, index=code_block_8.out0, toInsert=code_block_8.out1)

add_2 = getItemAtIndex_3 + insert_2
code_block_9 = CodeBlock(test=uniqueItems, iftrue=add_2, iffalse=add) { oldif(test,iftrue,iffalse); }
clean = Custom[Output.Clean](input=code_block_9)  # This will return a single value or list from one input.
