# Dynamo custom node String.ToSentenceCase.dyf (Dynamo 0.9.1.4062)
# category: Rhythm.Core.String
# This node will convert a single string of text to have capitalized sentences. If you need to use this over a list, use List.Map.

str = Input(str : string)  # String to be converted to Sentence Case.
python_script = Python(IN[0]=str)
# ---------- python_script.python (35 lines) ----------
#Created by DPS Design, dpsdesign.org
import clr
import re
clr.AddReference('ProtoGeometry')
from Autodesk.DesignScript.Geometry import *

# Import ToDSType(bool) extension method
clr.AddReference("RevitNodes")
import Revit
clr.ImportExtensions(Revit.Elements)

# Import DocumentManager and TransactionManager
clr.AddReference("RevitServices")
import RevitServices
from RevitServices.Persistence import DocumentManager
from RevitServices.Transactions import TransactionManager

from System.Collections.Generic import *

# Import RevitAPI
clr.AddReference("RevitAPI")
import Autodesk

doc = DocumentManager.Instance.CurrentDBDocument
uiapp = DocumentManager.Instance.CurrentUIApplication
app = uiapp.Application

#The inputs to this node will be stored as a list in the IN variable.
dataEnteringNode = IN

#unwrap all elements to use with API
sentence = IN[0]

#Assign your output to the OUT variable
OUT = '. '.join([s.strip().capitalize() for s in sentence.split('.')]).strip()
# ----------------------------------------
str_2 = Output(python_script)  # "str"
