# Dynamo custom node String.ToTitle.dyf (Dynamo 0.9.1.4062)
# category: Rhythm.Core.String.
# Converts the given string to Title Case.

str = Input(str : string)  # String to be converted to Title Case.
code_block = CodeBlock(item=str) { DSCore.List.Flatten({item},-1); }
python_script = Python(IN[0]=code_block)
# ---------- python_script.python (46 lines) ----------
#Created by DPS Design, dpsdesign.org
import clr
clr.AddReference('ProtoGeometry')
from Autodesk.DesignScript.Geometry import *

# Import ToDSType(bool) extension method
clr.AddReference("RevitNodes")
import Revit
clr.ImportExtensions(Revit.Elements)

# Import DocumentManager and TransactionManager
clr.AddReference("RevitServices")
import RevitServices
from RevitServices.Persistence import DocumentManager
from RevitServices.Transactions import TransactionManager

from System.Collections.Generic import *

# Import RevitAPI
clr.AddReference("RevitAPI")
import Autodesk

doc = DocumentManager.Instance.CurrentDBDocument
uiapp = DocumentManager.Instance.CurrentUIApplication
app = uiapp.Application

#The inputs to this node will be stored as a list in the IN variable.
dataEnteringNode = IN

#unwrap all elements to use with API
items = UnwrapElement(IN[0])
TransactionManager.Instance.EnsureInTransaction(doc)
#apply title case to strings
typelist = list()
for i in items:
	try:
		typelist.append(i.title())
	except:
		typelist.append(list())


# "End" the transaction
TransactionManager.Instance.TransactionTaskDone()

#Assign your output to the OUT variable
OUT = typelist
# ----------------------------------------
clean = Custom[Output.Clean](input=python_script)  # This will return a single value or list from one input.
str_2 = Output(clean)  # "str"
