# Dynamo custom node StructuralBeamSystem.Members.dyf (Dynamo 1.0.0.1180)
# category: Rhythm.Revit.Elements.StructuralBeamSystem
# Thist will collect the members of the ebeam system.

structuralBeamSystem = Input()
code_block = CodeBlock(item=structuralBeamSystem) { Flatten({item}); }
python_script = Python(IN[0]=code_block)
# ---------- python_script.python (19 lines) ----------
import clr
clr.AddReference('RevitAPI')
from Autodesk.Revit.DB import *

clr.AddReference("RevitNodes")
import Revit
clr.ImportExtensions(Revit.Elements)

groups = UnwrapElement(IN[0])
elementlist = list()
for item in groups:
	try:
		memberlist = list()
		for member in item.GetBeamIds():
			memberlist.append(item.Document.GetElement(member))
		elementlist.append(memberlist)
	except:
		elementlist.append(list())
OUT = elementlist
# ----------------------------------------
members = Output(python_script)
