# Dynamo custom node Unicode.LRE.dyf (Dynamo 0.7.5.3566)
# category: Rhythm.Core.Unicode
# Start of left-to-right embedding Unicode Character

start_of_left_to_right_embedding = Python()
# ---------- start_of_left_to_right_embedding.python (9 lines) ----------
#This script generates the Start of left-to-right embedding unicode character
import clr
clr.AddReference('ProtoGeometry')
from Autodesk.DesignScript.Geometry import *
#The inputs to this node will be stored as a list in the IN variable.
dataEnteringNode = IN

#Assign your output to the OUT variable
OUT = u"\u202B"
# ----------------------------------------
OUT = Output(start_of_left_to_right_embedding)
