# Dynamo custom node Unicode.LRM.dyf (Dynamo 0.7.5.3566)
# category: Rhythm.Core.Unicode
# Left-to-right mark unicode character

left_to_right_mark = Python()
# ---------- left_to_right_mark.python (9 lines) ----------
#This script generates the Left-to-right mark unicode character
import clr
clr.AddReference('ProtoGeometry')
from Autodesk.DesignScript.Geometry import *
#The inputs to this node will be stored as a list in the IN variable.
dataEnteringNode = IN

#Assign your output to the OUT variable
OUT = u"\u200E"
# ----------------------------------------
OUT = Output(left_to_right_mark)
