# Dynamo custom node Unicode.RLE.dyf (Dynamo 0.7.5.3566)
# category: Rhythm.Core.Unicode
# Start of right-to-left embedding Unicode Character

start_of_right_to_left_embedding = Python()
# ---------- start_of_right_to_left_embedding.python (9 lines) ----------
#This script generates the Start of right-to-left embedding unicode character
import clr
clr.AddReference('ProtoGeometry')
from Autodesk.DesignScript.Geometry import *
#The inputs to this node will be stored as a list in the IN variable.
dataEnteringNode = IN

#Assign your output to the OUT variable
OUT = u"\u202A"
# ----------------------------------------
OUT = Output(start_of_right_to_left_embedding)
