# Dynamo custom node Unicode.RLM.dyf (Dynamo 0.7.5.3566)
# category: Rhythm.Core.Unicode
# Right-to-left mark Unicode character

right_to_left_mark = Python()
# ---------- right_to_left_mark.python (9 lines) ----------
#This script generates the Right-to-left mark unicode character
import clr
clr.AddReference('ProtoGeometry')
from Autodesk.DesignScript.Geometry import *
#The inputs to this node will be stored as a list in the IN variable.
dataEnteringNode = IN

#Assign your output to the OUT variable
OUT = u"\u200F"
# ----------------------------------------
OUT = Output(right_to_left_mark)
