# Dynamo custom node Unicode.ZWJ.dyf (Dynamo 0.7.5.3566)
# category: Rhythm.Core.Unicode
# Zero width joiner Unicode Character

zero_width_joiner = Python()
# ---------- zero_width_joiner.python (9 lines) ----------
#This script generates the Zero width joiner mark unicode character
import clr
clr.AddReference('ProtoGeometry')
from Autodesk.DesignScript.Geometry import *
#The inputs to this node will be stored as a list in the IN variable.
dataEnteringNode = IN

#Assign your output to the OUT variable
OUT = u"\u200D"
# ----------------------------------------
OUT = Output(zero_width_joiner)
