# Dynamo custom node View.ConvertToIndependent.dyf (Dynamo 0.9.2.4472)
# category: Rhythm.Revit.Views.View.Action
# This will convert input dependent views to independent. Thanks to TheRevitKid for the idea!

view = Input()
code_block = CodeBlock(item=view) { Flatten({item}); }
python_script = Python(IN[0]=code_block)
# ---------- python_script.python (46 lines) ----------
#Created by DPS Design, dpsdesign.org
import clr
clr.AddReference('ProtoGeometry')
from Autodesk.DesignScript.Geometry import *

# Import ToDSType(bool) extension method
clr.AddReference("RevitNodes")
import Revit
clr.ImportExtensions(Revit.Elements)

# Import DocumentManager and TransactionManager
clr.AddReference("RevitServices")
import RevitServices
from RevitServices.Persistence import DocumentManager
from RevitServices.Transactions import TransactionManager

from System.Collections.Generic import *

# Import RevitAPI
clr.AddReference("RevitAPI")
import Autodesk

doc = DocumentManager.Instance.CurrentDBDocument
uiapp = DocumentManager.Instance.CurrentUIApplication
app = uiapp.Application

#The inputs to this node will be stored as a list in the IN variable.
dataEnteringNode = IN

#unwrap all elements to use with API
items = UnwrapElement(IN[0])
TransactionManager.Instance.EnsureInTransaction(doc)

typelist = list()
for i in items:
	try:
		typelist.append(i.ConvertToIndependent())
	except:
		typelist.append(list())


# "End" the transaction
TransactionManager.Instance.TransactionTaskDone()

#Assign your output to the OUT variable
OUT = items
# ----------------------------------------
independentView = Output(python_script)
