# Dynamo custom node View3D.SetSectionBox.dyf (Dynamo 1.2.1.3083)
# category: Rhythm.Revit.View3D
# This will set a views section box giving a bounding box.

view3D = Input()
code_block = CodeBlock(item=view3D) { Flatten({item}); }
boundingBox = Input()
toRevitType = Custom[Geometry.ToRevitType](var=boundingBox)  # This will convert designscript geometyr into Revit.DB types. Currently tested with curves, nurbs curves and solids.
code_block_2 = CodeBlock { 0; }
getItemAtIndex = List.GetItemAtIndex(list=toRevitType, index=code_block_2)
python_script = Python(IN[0]=code_block, IN[1]=getItemAtIndex)
# ---------- python_script.python (48 lines) ----------
#Copyright(c) 2017, john pierson
# @60secondrevit, http://sixtysecondrevit.com
import clr
clr.AddReference('ProtoGeometry')
from Autodesk.DesignScript.Geometry import *

# Import ToDSType(bool) extension method
clr.AddReference("RevitNodes")
import Revit
clr.ImportExtensions(Revit.Elements)

# Import DocumentManager and TransactionManager
clr.AddReference("RevitServices")
import RevitServices
from RevitServices.Persistence import DocumentManager
from RevitServices.Transactions import TransactionManager

from System.Collections.Generic import *

# Import RevitAPI
clr.AddReference("RevitAPI")
import Autodesk

doc = DocumentManager.Instance.CurrentDBDocument
uiapp = DocumentManager.Instance.CurrentUIApplication
app = uiapp.Application

#The inputs to this node will be stored as a list in the IN variable.
dataEnteringNode = IN

#unwrap all elements to use with API
items = UnwrapElement(IN[0])
box = IN[1]
TransactionManager.Instance.EnsureInTransaction(doc)
#apply lineweight override to elements in an input list
typelist = list()
for i in items:
	try:
		typelist.append(i.SetSectionBox(box))
	except:
		typelist.append(list())


# "End" the transaction
TransactionManager.Instance.TransactionTaskDone()

#Assign your output to the OUT variable
OUT = typelist
# ----------------------------------------
set = Output(python_script)
