# Dynamo custom node ViewFamilyType.ByName.dyf (Dynamo 1.0.0.1180)
# category: Rhythm.Revit.Elements.ViewFamilyType
# Select a view family type given it's name.

element_types = ElementTypes("ViewFamilyType")
all_elements_of_type = ElementsOfType(element_types)
name = Element.Name(all_elements_of_type)
name_2 = Input(name : string)
eq = name == name_2
filterByBoolMask = List.FilterByBoolMask(list=all_elements_of_type, mask=eq)
ViewFamilyType = Output(filterByBoolMask.in)
