# Dynamo custom node Viewport.GetBoxOutline.dyf (Dynamo 1.2.1.3083)
# category: Rhythm.Revit.Elements.Viewport
# This will retrieve the bounding box of  the viewport on a sheet. Not including the view title.

viewports = Input()
code_block = CodeBlock(item=viewports) { Flatten({item}); }
python_script = Python(IN[0]=code_block)
# ---------- python_script.python (47 lines) ----------
#Copyright(c) 2017, john pierson
# @60secondrevit, http://sixtysecondrevit.com
import clr
clr.AddReference('ProtoGeometry')
from Autodesk.DesignScript.Geometry import *

# Import ToDSType(bool) extension method
clr.AddReference("RevitNodes")
import Revit
clr.ImportExtensions(Revit.Elements)

# Import DocumentManager and TransactionManager
clr.AddReference("RevitServices")
import RevitServices
from RevitServices.Persistence import DocumentManager
from RevitServices.Transactions import TransactionManager

from System.Collections.Generic import *

# Import RevitAPI
clr.AddReference("RevitAPI")
import Autodesk

doc = DocumentManager.Instance.CurrentDBDocument
uiapp = DocumentManager.Instance.CurrentUIApplication
app = uiapp.Application

#The inputs to this node will be stored as a list in the IN variable.
dataEnteringNode = IN

#unwrap all elements to use with API
items = UnwrapElement(IN[0])
TransactionManager.Instance.EnsureInTransaction(doc)
#apply lineweight override to elements in an input list
typelist = list()
for i in items:
	try:
		typelist.append(i.GetBoxOutline())
	except:
		typelist.append(list())


# "End" the transaction
TransactionManager.Instance.TransactionTaskDone()

#Assign your output to the OUT variable
OUT = typelist
# ----------------------------------------
python_script_2 = Python(IN[0]=python_script)
# ---------- python_script_2.python (50 lines) ----------
#Copyright(c) 2017, john pierson
# @60secondrevit, http://sixtysecondrevit.com
import clr
clr.AddReference('ProtoGeometry')
from Autodesk.DesignScript.Geometry import *

# Import ToDSType(bool) extension method
clr.AddReference("RevitNodes")
import Revit
clr.ImportExtensions(Revit.Elements)

# Import DocumentManager and TransactionManager
clr.AddReference("RevitServices")
import RevitServices
from RevitServices.Persistence import DocumentManager
from RevitServices.Transactions import TransactionManager

from System.Collections.Generic import *

# Import RevitAPI
clr.AddReference("RevitAPI")
import Autodesk

clr.ImportExtensions(Revit.GeometryConversion)

doc = DocumentManager.Instance.CurrentDBDocument
uiapp = DocumentManager.Instance.CurrentUIApplication
app = uiapp.Application

#The inputs to this node will be stored as a list in the IN variable.
dataEnteringNode = IN

#unwrap all elements to use with API
items = UnwrapElement(IN[0])
TransactionManager.Instance.EnsureInTransaction(doc)
#apply lineweight override to elements in an input list
typelist = list()
for i in items:
	try:
		typelist.append(i.MaximumPoint.ToPoint())
		typelist.append(i.MinimumPoint.ToPoint())
	except:
		typelist.append(List())


# "End" the transaction
TransactionManager.Instance.TransactionTaskDone()

#Assign your output to the OUT variable
OUT = typelist
# ----------------------------------------
code_block_2 = CodeBlock(points=python_script_2, vPorts=python_script) { Count(points)/Count(vPorts); }
chop = List.Chop(list=python_script_2, lengths=code_block_2)
transpose = List.Transpose(chop)
code_block_3 = CodeBlock(min=transpose) { min[0]; min[1]; }
byCorners = BoundingBox.ByCorners(min=code_block_3.out0, max=code_block_3.out1)
BoundingBox = Output(byCorners)
toCuboid = BoundingBox.ToCuboid(byCorners)
byOriginNormal = Plane.ByOriginNormal()
intersect = Geometry.Intersect(geometry=toCuboid, other=byOriginNormal)
perimeterCurves = Surface.PerimeterCurves(intersect)
byJoinedCurves = PolyCurve.ByJoinedCurves(perimeterCurves)
flatten = Flatten(byJoinedCurves)
outlines = Output(flatten)
