# Dynamo custom node Viewport.ViewName.dyf (Dynamo 0.9.0.3067)
# category: Rhythm.Revit.Elements.Viewport.Query
# This node gets the view name of viewports. There is an issue when "title on sheet" is used, so this fixes that.

viewports = Input(viewports : var[]..[])
Elements = Output(viewports)
parameters = Element.Parameters(viewports)
string_from_object = FromObject(parameters)

# group: Here we begin to filter out the duplicated vie name parameter.
uniqueItems = List.UniqueItems()
map = List.Map(list=string_from_object, f_x=uniqueItems)
code_block = CodeBlock { "View Name"; }
contains = String.Contains(str=map, searchFor=code_block)
filterByBoolMask = List.FilterByBoolMask(list=map, mask=contains)
flatten = Flatten(filterByBoolMask.in)
code_block_2 = CodeBlock { ": "; false; }
removePriorToCharacter = Custom[String.RemovePriorToCharacter](str=flatten, Character=code_block_2.out0, ignoreCase=code_block_2.out1)  # This will remove all characters prior to the input character. Accepts strings.

# group: This gets title on sheet to help filter out in the future.
code_block_3 = CodeBlock { "Title on Sheet"; }
getParameterValueByName = Element.GetParameterValueByName(element=viewports, parameterName=code_block_3)
code_block_4 = CodeBlock { "test"; }
code_block_5 = CodeBlock { ""; }
eq = _ == code_block_5
replaceByCondition = Replace(getParameterValueByName, code_block_4, eq)
code_block_6 = CodeBlock { 2; }
cycle = List.Cycle(amount=code_block_6)
map_2 = List.Map(list=replaceByCondition, f_x=cycle)
flatten_2 = Flatten(map_2)
code_block_7 = CodeBlock { {"","test"}; }
count = List.Count(getParameterValueByName)
code_block_8 = CodeBlock(a=count) { a; }
cycle_2 = List.Cycle(list=code_block_7, amount=code_block_8)
eq_2 = flatten_2 == cycle_2
filterByBoolMask_2 = List.FilterByBoolMask(list=flatten_2, mask=eq_2)

# group: We finally have the actual view names of each view. Instead of a mixture of title on sheet/ view name
trimWhitespace = String.TrimWhitespace(removePriorToCharacter)
eq_3 = trimWhitespace == filterByBoolMask_2.out
filterByBoolMask_3 = List.FilterByBoolMask(list=trimWhitespace, mask=eq_3)

ViewNames = Output(filterByBoolMask_3.out)
