# Dynamo custom node Wall.NorthSouthEastWest.dyf (Dynamo 0.9.0.3067)
# category: Rhythm.Revit.Elements.Wall.Query
# This node determines which direction a wall is facing and groups them by the direction or direction they are closest to.

Wall = Input()
Normals = Input()
X = Point.X(Normals)
Y = Point.Y(Normals)
code_block = CodeBlock(x=X, y=Y) { x; y; x<=0.708&&x>=-0.707; y<=1&&y>=0.707; }
code_block_2 = CodeBlock(a=code_block.out2, b=code_block.out3) { a&&b; }
filterByBoolMask = List.FilterByBoolMask(list=Wall, mask=code_block_2)
North = Output(filterByBoolMask.in)
code_block_3 = CodeBlock(x=X, y=Y) { x; y; x<=1&&x>=0.708; y<=0.706&&y>=-0.707; }
code_block_4 = CodeBlock(a=code_block_3.out2, b=code_block_3.out3) { a&&b; }
filterByBoolMask_2 = List.FilterByBoolMask(list=Wall, mask=code_block_4)
East = Output(filterByBoolMask_2.in)
code_block_5 = CodeBlock(x=X, y=Y) { x; y; x<=-0.707&&x>=-1; y<=0.708&&y>=-0.706; }
code_block_6 = CodeBlock(a=code_block_5.out2, b=code_block_5.out3) { a&&b; }
filterByBoolMask_3 = List.FilterByBoolMask(list=Wall, mask=code_block_6)
West = Output(filterByBoolMask_3.in)
code_block_7 = CodeBlock(x=X, y=Y) { x; y; x<=0.708&&x>-0.708; y<=-0.707&&y>=-1; }
code_block_8 = CodeBlock(a=code_block_7.out2, b=code_block_7.out3) { a&&b; }
filterByBoolMask_4 = List.FilterByBoolMask(list=Wall, mask=code_block_8)
South = Output(filterByBoolMask_4.in)
