# Dynamo custom node Workset.Create.dyf (Dynamo 0.8.2.2392)
# category: Rhythm.Revit.Application.Document.Create
# Creates a workset or worksets from input names.

worksetNames = Input()
empty = List.Empty()
create = List.Create(worksetNames, empty)
flatten = Flatten(create)
python_script = Python(IN[0]=flatten)
# ---------- python_script.python (42 lines) ----------
#Rhythm
#sixtysecondrevit.blogspot.com
import clr
clr.AddReference('ProtoGeometry')
from Autodesk.DesignScript.Geometry import *
# Import ToDSType(bool) extension method
clr.AddReference("RevitNodes")
import Revit
clr.ImportExtensions(Revit.Elements)
# Import geometry conversion extension methods
clr.ImportExtensions(Revit.GeometryConversion)
# Import DocumentManager and TransactionManager
clr.AddReference("RevitServices")
import RevitServices
from RevitServices.Persistence import DocumentManager
from RevitServices.Transactions import TransactionManager
from System.Collections.Generic import *
# Import RevitAPI
clr.AddReference("RevitAPI")
import Autodesk
from Autodesk.Revit.DB import *

doc = DocumentManager.Instance.CurrentDBDocument
uiapp = DocumentManager.Instance.CurrentUIApplication
app = uiapp.Application
uidoc=DocumentManager.Instance.CurrentUIApplication.ActiveUIDocument

worksetnames = IN[0]
mDoc = DocumentManager.Instance.CurrentDBDocument
newWorksets = list()

# Start Transaction
TransactionManager.Instance.EnsureInTransaction(doc)

for name in worksetnames:
	Workset.Create(mDoc,name)
	newWorksets.append(name)

# End Transaction
TransactionManager.Instance.TransactionTaskDone()

OUT = newWorksets
# ----------------------------------------
names = Output(python_script)
