# Dynamo custom node All Upper.dyf (Dynamo 1.3.3.4651)
# category: Rhythm.Tools
# This converts the ase of selected items to UPPER. Inputs require booleans to enable for category.

# group: Input toggles
convertText = Input(convertText : bool = false)
convertRooms = Input(convertRooms : bool = false)
convertLevels = Input(convertLevels : bool = false)
convertSheets = Input(convertSheets : bool = false)
convertViewsTitleOnSheet = Input(convertViewsTitleOnSheet : bool = false)

# group: convert text notes
categories = Categories("TextNotes")
all_elements_of_category = ElementsOfCategory(categories)
toggle = Rhythm.Revit.Helpers.Helpers.Toggle(all_elements_of_category, convertText)
python_script = Python(IN[0]=toggle)
# ---------- python_script.python (49 lines) ----------
#DPS Text Uppercase Script
#Original Credit for python script goes to dwane@dsdraughting.com

import clr
clr.AddReference('ProtoGeometry')
from Autodesk.DesignScript.Geometry import *

# Import ToDSType(bool) extension method
clr.AddReference("RevitNodes")
import Revit
clr.ImportExtensions(Revit.Elements)

# Import DocumentManager and TransactionManager
clr.AddReference("RevitServices")
import RevitServices
from RevitServices.Persistence import DocumentManager
from RevitServices.Transactions import TransactionManager

from System.Collections.Generic import *

# Import RevitAPI
clr.AddReference("RevitAPI")
import Autodesk

doc = DocumentManager.Instance.CurrentDBDocument
uiapp = DocumentManager.Instance.CurrentUIApplication
app = uiapp.Application

#The inputs to this node will be stored as a list in the IN variable.
dataEnteringNode = IN

#unwrap all elements to use with API
elements = []
for i in IN[0]:
	elements.append(UnwrapElement(i))

# "Start" the transaction
TransactionManager.Instance.EnsureInTransaction(doc)

#apply color override to elements in an input list
for i in elements:
	id = i.Id
	i.Text=i.Text.upper()

# "End" the transaction
TransactionManager.Instance.TransactionTaskDone()

#Assign your output to the OUT variable
OUT = IN[0]
# ----------------------------------------

# group: convert rooms to uppercase
categories_2 = Categories("Rooms")
all_elements_of_category_2 = ElementsOfCategory(categories_2)
code_block = CodeBlock { "Name"; }
getParameterValueByName = Element.GetParameterValueByName(element=all_elements_of_category_2, parameterName=code_block)
toUpper = String.ToUpper(getParameterValueByName)
toggle_2 = Rhythm.Revit.Helpers.Helpers.Toggle(toUpper, convertRooms)
setParameterByName = Element.SetParameterByName(element=all_elements_of_category_2, parameterName=code_block, value=toggle_2)

# group: convert levels to uppercase
categories_3 = Categories("Levels")
all_elements_of_category_3 = ElementsOfCategory(categories_3)
code_block_2 = CodeBlock { "Name"; }
getParameterValueByName_2 = Element.GetParameterValueByName(element=all_elements_of_category_3, parameterName=code_block_2)
toUpper_2 = String.ToUpper(getParameterValueByName_2)
toggle_3 = Rhythm.Revit.Helpers.Helpers.Toggle(toUpper_2, convertLevels)
setParameterByName_2 = Element.SetParameterByName(element=all_elements_of_category_3, parameterName=code_block_2, value=toggle_3)

# group: convert sheets to uppercase
categories_4 = Categories("Sheets")
all_elements_of_category_4 = ElementsOfCategory(categories_4)
code_block_3 = CodeBlock { "Sheet Name"; }
getParameterValueByName_3 = Element.GetParameterValueByName(element=all_elements_of_category_4, parameterName=code_block_3)
toUpper_3 = String.ToUpper(getParameterValueByName_3)
toggle_4 = Rhythm.Revit.Helpers.Helpers.Toggle(toUpper_3, convertSheets)
setParameterByName_3 = Element.SetParameterByName(element=all_elements_of_category_4, parameterName=code_block_3, value=toggle_4)

# group: convert title on sheet parameters
element_types = ElementTypes("ViewDrafting")
all_elements_of_type = ElementsOfType(element_types)
element_types_2 = ElementTypes("ViewPlan")
all_elements_of_type_2 = ElementsOfType(element_types_2)
element_types_3 = ElementTypes("ViewSection")
all_elements_of_type_3 = ElementsOfType(element_types_3)
create = List.Create(all_elements_of_type, all_elements_of_type_2, all_elements_of_type_3)
flatten = Flatten(create)
code_block_4 = CodeBlock { "Title on Sheet"; }
getParameterValueByName_4 = Element.GetParameterValueByName(element=flatten, parameterName=code_block_4)
string_from_object = FromObject(getParameterValueByName_4)
toUpper_4 = String.ToUpper(string_from_object)
toggle_5 = Rhythm.Revit.Helpers.Helpers.Toggle(toUpper_4, convertViewsTitleOnSheet)
setParameterByName_4 = Element.SetParameterByName(element=flatten, parameterName=code_block_4, value=toggle_5)

# group: outputs
textNotes = Output(python_script)
rooms = Output(setParameterByName)
levels = Output(setParameterByName_2)
sheets = Output(setParameterByName_3)
views = Output(setParameterByName_4)
