# Dynamo custom node Rhythm.RenumberRoomsByCurve.dyf (Dynamo 1.3.3.4651)
# category: Rhythm.Tools
# Complete revamp of the previous proposed workflows that break on rooms whose solids were irregular.

runMe = Input(runMe : bool = false)
# note: **Rhythm v.2018.8.27
placedRooms = Custom[Collector.PlacedRooms](toggle=runMe)  # This will collect placed rooms in current file.
modelCurve = Input()
curve = CurveElement.Curve(modelCurve)

# group: Intersect the rooms with the spline and get the first intersecting point.
# note: **Rhythm v.2018.8.27
intersectWithCurve = Rhythm.Revit.Elements.Room.IntersectWithCurve(placedRooms, curve)
create = List.Create(placedRooms, intersectWithCurve)
transpose = List.Transpose(create)
isEmpty = List.IsEmpty(intersectWithCurve@L2)
filterByBoolMask = List.FilterByBoolMask(list=transpose, mask=isEmpty)
firstItem = List.FirstItem(filterByBoolMask.out@L3)
lastItem = List.LastItem(filterByBoolMask.out@L3)
firstItem_2 = List.FirstItem(lastItem@L2)
startPoint = Curve.StartPoint(firstItem_2)

parameterAtPoint = Curve.ParameterAtPoint(curve=curve, point=startPoint)
sortByKey = List.SortByKey(list=firstItem, keys=parameterAtPoint)
toggle = Rhythm.Revit.Helpers.Helpers.Toggle(sortByKey.sorted_list, runMe)
code_block = CodeBlock { "Number"; }
startNumber = Input(startNumber : int = 100)
code_block_2 = CodeBlock(startNumber=startNumber, rooms=sortByKey.sorted_list) { startNumber..#Count(rooms)..1; }
string_from_object = FromObject(code_block_2)
setParameterByName = Element.SetParameterByName(element=toggle, parameterName=code_block, value=string_from_object)
rooms = Output(setParameterByName)
